# Grasshopper definition 01_Slime Intro_v4_high.gh (Grasshopper 1.0.9)
# plug-ins: Nuclei4

# ---- group: Define Design Space
number_slider = Slider(4000, range=0..4000)
construct_voxels = ConstructVoxels(VoxelSize=1, XVoxels=number_slider, YVoxels=number_slider, ZVoxels=Slider(1, range=0..1))

# ----
construct_slime_particles = ConstructSlimeParticles(
    VoxelField=construct_voxels,
    ParticleCount=Slider(1000000, range=0..1000000),
    Speed=1.3,
    SensorDistance=6,
    SensorAngle=45,
    RotationAngle=45,
    Deposit=1,
    Exploration=0,
    Colour=RGBA(220, 255, 0, 125),
    ProbabilisticSteering=False)  # -> flatten(OutputParticleGroup)

voxel_settings_slime = VoxelSettingsSlime(
    DiffuseRate=Slider(0.15, range=0..1),
    DecayRate=Slider(0.03, range=0..1),
    Falloff=Slider(0, range=0..1),
    DiffuseRange=Slider(5, range=0..10),
    Input2StoresLegacyGradual=False,
    VoxelSettingsSlimeSchema=2)

trigger = Trigger(Interval=10, TimerInterval=10, Target=solver)  # disabled
solver = Nuclei3Solver(
    Reset=Toggle(False),
    Voxels=construct_voxels,
    Particles=flatten(construct_slime_particles),
    SolverSettings=flatten(voxel_settings_slime))  # -> OutputParticles, OutputVoxels, GPUStatus

list = ValueList({"Minimum Density": 0, "Maximum Density": 1, "Speed": 2, "Sensor Distance": 3, "Sensor Angle": 4, "Rotation Angle": 5, "Slime Food": 6, "Slime Chemoattractants": 7, "Ant Food Pheromones": 8, "Ant Base Pheromones": 9, "Ant Pheromones": 10, "Ants and Slime": 11, "Ant Food": 13}, selected="Slime Chemoattractants")
particle_preview = ParticlePreviewSettings(Particles=solver.OutputParticles, PointSize=2)
preview_voxel_density = PreviewVoxelDensity(
    Voxels=solver.OutputVoxels,
    Type=list,
    MinimumTreshold=0,
    MaximumTreshold=100,
    Colour=RGBA(0, 0, 0, 0),
    HighResolutionPreview=False)
