# Grasshopper definition 00_basic intro_v2.gh (Grasshopper 1.0.7)
# plug-ins: Nuclei2

# ---- group: Define Design Space
number_slider = Slider(350, range=0..1000)
construct_voxels = ConstructVoxels(VoxelSize=1, XVoxels=number_slider, YVoxels=number_slider, ZVoxels=Slider(1, range=1..30))

# ---- group: Particle Start Positions
voxel_centers = ExtractVoxelPositions(Voxels=construct_voxels)
lng = ListLength(List=voxel_centers)
multiplication = Multiplication(A=lng, B=Slider(0.95, range=0..1))
reduce = RandomReduce(List=voxel_centers, Reduction=expr("x*0.9", multiplication), Seed=1)

# ---- group: Define Particles
particles = ConstructParticles(InitialParticles=reduce, ParticleTag="no tag")

# ----
trigger = Trigger(Interval=10, TimerInterval=10, Target=solver)  # disabled
solver = Nuclei2Solver(Reset=Toggle(True), Voxels=construct_voxels, Particles=flatten(particles))  # -> OutputParticles, OutputVoxels

# ---- group: Display
particle_positions = ExtractParticlePositions(Particles=solver.OutputParticles)
cloud = CloudDisplay(Points=particle_positions, Colours=RGB(255, 20, 147), Size=1, SpriteType=0)
