# Grasshopper definition 01_intro_v2.gh (Grasshopper 1.0.7)
# plug-ins: Nuclei2, ghgl

# ---- group: Define Design Space
number_slider = Slider(200, range=0..1000)
construct_voxels = ConstructVoxels(VoxelSize=1, XVoxels=number_slider, YVoxels=number_slider, ZVoxels=Slider(1, range=1..30))

# ---- group: Particle Start Positions
voxel_centers = ExtractVoxelPositions(Voxels=construct_voxels)
reduction_factor = Slider(0.9, range=0..1)
lng = ListLength(List=voxel_centers)
multiplication = Multiplication(A=lng, B=reduction_factor)
reduce = RandomReduce(List=voxel_centers, Reduction=multiplication, Seed=1)

# ---- group: Define Particles
particle_settings = ParticleSettings(
    ParticleTag="no tag",
    Speed=Slider(2, range=0..10),
    SensorDistance=Slider(4, range=0..10),
    SensorAngle=Slider(30, range=0..100),
    RotationAngle=Slider(30, range=0..100),
    Deposit=Slider(2, range=0..10))
trail_settings = ParticleTrailSettings(TrailSize=Slider(5, range=1..10), TrailFrequency=Slider(1, range=1..10))
particles = ConstructParticles(InitialParticles=reduce, ParticleTag="no tag")

# ---- group: Environment Settings
voxel_settings = VoxelSettings(
    DiffuseRate=Slider(0.3, range=0..1),
    DiffuseRange=Slider(2, range=0..10),
    DecayRate=Slider(0.01, range=0..0.1),
    Wrap=Toggle(True))

# ----
trigger = Trigger(Interval=10, TimerInterval=10, Target=solver)  # disabled
solver = Nuclei2Solver(
    Reset=Toggle(True),
    Voxels=construct_voxels,
    Particles=flatten(particles),
    SolverSettings=flatten([particle_settings, voxel_settings, trail_settings]))  # -> OutputParticles, OutputVoxels

# ---- group: Display Environment
list = ValueList({"Minimum Density": 0, "Maximum Density": 1, "Speed": 2, "Sensor Distance": 3, "Sensor Angle": 4, "Rotation Angle": 5, "Food": 6, "Density": 7}, selected="Density")  # disabled
voxel_centers_2 = ExtractVoxelPositions(Voxels=construct_voxels)  # disabled
voxel_values = ExtractVoxelValues(Voxels=solver.OutputVoxels, Type=list)  # disabled
bnd = Bounds(Numbers=voxel_values)  # disabled
remap = RemapNumbers(Value=voxel_values, Source=bnd, Target=Domain(0, 1))  # -> Mapped, Clipped; disabled
gradient = Gradient(LowerLimit=0, UpperLimit=1, Parameter=remap.Mapped, stops=[0: RGBA(255, 255, 255, 0), 1: RGB(220, 0, 40)])  # disabled
cloud = CloudDisplay(Points=voxel_centers_2, Colours=gradient, Size=1, SpriteType=0)  # disabled

# ---- group: Display Particles (faster)
particle_positions = ExtractParticlePositions(Particles=solver.OutputParticles)
cloud_2 = CloudDisplay(Points=particle_positions, Colours=RGB(255, 20, 147), Size=1, SpriteType=0)

# ---- group: FANY Preview for Trails (slower)
trail_points = ExtractParticleTrails(Particles=solver.OutputParticles)  # disabled
lng_2 = ListLength(List=trail_points)  # disabled
number_slider_2 = Slider(0.35, range=0..1)  # disabled
swatch = ColourSwatch(SwatchColor=RGB(105, 237, 255))  # disabled
swatch_2 = ColourSwatch(SwatchColor=RGB(255, 0, 255))  # disabled
range = Range(Domain=Domain(0, 1), Steps=expr("x-1", lng_2))  # disabled
gl_shader = GLShader(
    Vertex=trail_points,
    Vcolor1=swatch,
    Vcolor2=swatch_2,
    T=range,
    Alpha=number_slider_2,
    DepthTestingEnabled=False,
    DepthWritingEnabled=False,
    DrawMode=3,
    FragmentShader="""#version 330

in vec4 vertex_color;
out vec4 fragment_color;
uniform sampler2D _depthBuffer;
uniform vec2 _viewportSize;
float ndcDepth;

void main() {
    
  //vec2 uv = gl_FragCoord.xy / _viewportSize;
  
  //vec4 buffer = texture(_depthBuffer, uv);
  
  //ndcDepth  = ((2.0 * gl_FragCoord.z - 1) - gl_DepthRange.near - gl_DepthRange.far/2) / (gl_DepthRange.far - gl_DepthRange.near);

  fragment_color = vertex_color;

}""",
    GLShader=(0, 2, 0),
    PreviewSortOrder=2,
    VertexShader="""#version 330

layout(location = 0) in vec3 vertex;
layout(location = 1) in vec4 vcolor1;
layout(location = 2) in float t;
layout(location = 3) in vec4 vcolor2;
layout(location = 4) in float alpha;

uniform mat4 _worldToClip;
out vec4 vertex_color;
  

void main() {
  
  vertex_color.r = pow(t,2) * vcolor1.r + (1-pow(t,2))* vcolor2.r ;
  vertex_color.g = pow(t,2) * vcolor1.g + (1-pow(t,2))* vcolor2.g;
  vertex_color.b = pow(t,2) * vcolor1.b + (1-pow(t,2))* vcolor2.b;
  vertex_color.a = (1-t/3) * alpha;
  
  gl_Position = _worldToClip * vec4(vertex, 1.0);
}""",
    glLineWidth=1,
    glPointSize=1)  # -> Color, Depth; disabled
