# Grasshopper definition 02_multiple populations_v2.gh (Grasshopper 1.0.7)
# plug-ins: Nuclei2, ghgl

# ---- group: Define Design Space
number_slider = Slider(250, range=0..1000)
construct_voxels = ConstructVoxels(VoxelSize=1, XVoxels=number_slider, YVoxels=number_slider, ZVoxels=Slider(1, range=1..30))

# ---- group: Particle Start Positions
voxel_centers = ExtractVoxelPositions(Voxels=construct_voxels)
reduction_factor = Slider(0.9, range=0..1)
lng = ListLength(List=voxel_centers)
multiplication = Multiplication(A=lng, B=reduction_factor)
reduce = RandomReduce(List=voxel_centers, Reduction=multiplication, Seed=Slider(12313, range=0..100000))

voxel_centers_2 = ExtractVoxelPositions(Voxels=construct_voxels)
reduction_factor_2 = Slider(0.8, range=0..1)
lng_2 = ListLength(List=voxel_centers_2)
multiplication_2 = Multiplication(A=lng_2, B=reduction_factor_2)
reduce_2 = RandomReduce(List=voxel_centers_2, Reduction=multiplication_2, Seed=Slider(45983, range=0..100000))

# ---- group: Trail Settings (For All Particles)
trail_settings = ParticleTrailSettings(TrailSize=Slider(5, range=1..10), TrailFrequency=Slider(1, range=1..10))

# ---- group: Define Particles
particle_settings = ParticleSettings(
    ParticleTag="bonnie",
    Speed=Slider(1, range=0..10),
    SensorDistance=Slider(2, range=0..10),
    SensorAngle=Slider(120, range=0..120),
    RotationAngle=Slider(120, range=0..120),
    Deposit=Slider(2, range=0..10))
particles = ConstructParticles(InitialParticles=reduce, ParticleTag="bonnie")

particle_settings_2 = ParticleSettings(
    ParticleTag="clyde",
    Speed=Slider(3, range=0..10),
    SensorDistance=Slider(7, range=0..10),
    SensorAngle=Slider(30, range=0..120),
    RotationAngle=Slider(30, range=0..120),
    Deposit=Slider(2, range=0..10))
particles_2 = ConstructParticles(InitialParticles=reduce_2, ParticleTag="clyde")

# ---- group: Environment Settings
voxel_settings = VoxelSettings(
    DiffuseRate=Slider(0.28, range=0..1),
    DiffuseRange=Slider(2, range=0..10),
    DecayRate=Slider(0.1, range=0..0.1),
    Wrap=Toggle(False))

# ----
trigger = Trigger(Interval=10, TimerInterval=10, Target=solver)  # disabled
solver = Nuclei2Solver(
    Reset=Toggle(True),
    Voxels=construct_voxels,
    Particles=flatten([particles_2, particles]),
    SolverSettings=flatten([particle_settings, voxel_settings, particle_settings_2, trail_settings]))  # -> OutputParticles, OutputVoxels

# ---- group: FANCY Preview Multiple Trails (Slower)
trail_points = ExtractParticleTrails(Particles=solver.OutputParticles)  # disabled
swatch = ColourSwatch(SwatchColor=RGB(173, 129, 227))  # disabled
swatch_2 = ColourSwatch(SwatchColor=RGB(111, 16, 227))  # disabled
swatch_3 = ColourSwatch(SwatchColor=RGB(136, 235, 202))  # disabled
swatch_4 = ColourSwatch(SwatchColor=RGB(16, 227, 157))  # disabled

# ---- group: FANCY Preview Multiple Trails (Slower) / Split The Tree
tstat = TreeStatistics(Tree=trail_points)  # -> Paths, Length, Count; disabled
dpath = DeconstructPath(Branch=tstat.Paths)  # disabled
item = ListItem(List=dpath, Index=0, Wrap=True)  # -> flatten(Item); disabled
lng_3 = ListLength(List=item)  # disabled
shift = ShiftList(List=item, Shift=1, Wrap=False)  # disabled
series = Series(Start=0, Step=1, Count=lng_3)  # disabled
equals = Equality(FirstNumber=item, SecondNumber=shift)  # -> Equality, Inequality; disabled
cull = CullPattern(List=series, CullPattern=equals.Inequality)  # disabled
split = SplitList(List=flatten(tstat.Paths), Index=expr("x+1", cull))  # -> ListA, ListB; disabled

# ---- group: FANCY Preview Multiple Trails (Slower) / Preview Trails 1
branch = TreeBranch(Tree=trail_points, Path=split.ListA, MaintainPaths=True)  # disabled
lng_4 = ListLength(List=branch)  # disabled
number_slider_2 = Slider(0.5, range=0..1)  # disabled
range = Range(Domain=Domain(0, 1), Steps=expr("x-1", lng_4))  # disabled
gl_shader = GLShader(
    Vertex=branch,
    Vcolor1=swatch,
    Vcolor2=swatch_2,
    T=range,
    Alpha=number_slider_2,
    DepthTestingEnabled=False,
    DepthWritingEnabled=False,
    DrawMode=0,
    FragmentShader="""#version 330

in vec4 vertex_color;
out vec4 fragment_color;
uniform sampler2D _depthBuffer;
uniform vec2 _viewportSize;
float ndcDepth;

void main() {
    
  //vec2 uv = gl_FragCoord.xy / _viewportSize;
  
  //vec4 buffer = texture(_depthBuffer, uv);
  
  //ndcDepth  = ((2.0 * gl_FragCoord.z - 1) - gl_DepthRange.near - gl_DepthRange.far/2) / (gl_DepthRange.far - gl_DepthRange.near);

  fragment_color = vertex_color;

}""",
    GLShader=(0, 2, 0),
    PreviewSortOrder=2,
    VertexShader="""#version 330

layout(location = 0) in vec3 vertex;
layout(location = 1) in vec4 vcolor1;
layout(location = 2) in float t;
layout(location = 3) in vec4 vcolor2;
layout(location = 4) in float alpha;

uniform mat4 _worldToClip;
out vec4 vertex_color; 

void main() {
  
  vertex_color.r = pow(t,2) * vcolor1.r + (1-pow(t,2))* vcolor2.r ;
  vertex_color.g = pow(t,2) * vcolor1.g + (1-pow(t,2))* vcolor2.g;
  vertex_color.b = pow(t,2) * vcolor1.b + (1-pow(t,2))* vcolor2.b;
  
  vertex_color.a = (1-t/3) * alpha;
  
  gl_Position = _worldToClip * vec4(vertex, 1.0);
}""",
    glLineWidth=1,
    glPointSize=2)  # -> Color, Depth; disabled

# ---- group: FANCY Preview Multiple Trails (Slower) / Preview Trails 2
branch_2 = TreeBranch(Tree=trail_points, Path=split.ListB, MaintainPaths=True)  # disabled
lng_5 = ListLength(List=branch_2)  # disabled
number_slider_3 = Slider(0.5, range=0..1)  # disabled
range_2 = Range(Domain=Domain(0, 1), Steps=expr("x-1", lng_5))  # disabled
gl_shader_2 = GLShader(
    Vertex=branch_2,
    Vcolor1=swatch_3,
    Vcolor2=swatch_4,
    T=range_2,
    Alpha=number_slider_3,
    DepthTestingEnabled=False,
    DepthWritingEnabled=False,
    DrawMode=0,
    FragmentShader="""#version 330

in vec4 vertex_color;
out vec4 fragment_color;
uniform sampler2D _depthBuffer;
uniform vec2 _viewportSize;
float ndcDepth;

void main() {
    
  //vec2 uv = gl_FragCoord.xy / _viewportSize;
  
  //vec4 buffer = texture(_depthBuffer, uv);
  
  //ndcDepth  = ((2.0 * gl_FragCoord.z - 1) - gl_DepthRange.near - gl_DepthRange.far/2) / (gl_DepthRange.far - gl_DepthRange.near);

  fragment_color = vertex_color;

}""",
    GLShader=(0, 2, 0),
    PreviewSortOrder=2,
    VertexShader="""#version 330

layout(location = 0) in vec3 vertex;
layout(location = 1) in vec4 vcolor1;
layout(location = 2) in float t;
layout(location = 3) in vec4 vcolor2;
layout(location = 4) in float alpha;

uniform mat4 _worldToClip;
out vec4 vertex_color; 

void main() {
  
  vertex_color.r = pow(t,2) * vcolor1.r + (1-pow(t,2))* vcolor2.r ;
  vertex_color.g = pow(t,2) * vcolor1.g + (1-pow(t,2))* vcolor2.g;
  vertex_color.b = pow(t,2) * vcolor1.b + (1-pow(t,2))* vcolor2.b;
  
  vertex_color.a = (1-t/3) * alpha;
  
  gl_Position = _worldToClip * vec4(vertex, 1.0);
}""",
    glLineWidth=1,
    glPointSize=2)  # -> Color, Depth; disabled

# ---- group: Display Particles (faster)
particle_positions = ExtractParticlePositions(Particles=solver.OutputParticles)

# ----
bang = ExplodeTree(Data=particle_positions)  # -> Branch0, Branch1

# ---- group: Display Particles (faster) (continued)
cloud = CloudDisplay(Points=bang.Branch0, Colours=ColourSwatch(SwatchColor=RGB(111, 16, 227)), Size=1.5, SpriteType=0)
cloud_2 = CloudDisplay(Points=bang.Branch1, Colours=ColourSwatch(SwatchColor=RGB(16, 227, 157)), Size=1, SpriteType=0)
