# Grasshopper definition 03_minimizing transport networks_v2.gh (Grasshopper 1.0.7)
# plug-ins: Nuclei2, ghgl

# ---- group: Define Design Space
number_slider = Slider(250, range=0..1000)
construct_voxels = ConstructVoxels(VoxelSize=1, XVoxels=number_slider, YVoxels=number_slider, ZVoxels=Slider(1, range=1..30))

# ---- group: Extract Centre of Environment
voxel_box = ExtractVoxelBoundingBox(Voxels=construct_voxels)
environment = Brep(voxel_box)
expression = Expression(x=number_slider, Expression="x/2")
volume = Volume(Geometry=environment)  # -> Volume, Centroid
xy = XYPlane(Origin=Point(0, 0, 0))
project = Project(Geometry=volume.Centroid, Plane=xy)  # -> Geometry, Transform

# ----
environment_centre = Point(project.Geometry)

# ---- group: Create Disc
circle = CircleCNR(Center=environment_centre, Normal=Vector(0, 0, 1), Radius=expression)
Z = UnitZ(Factor=1)
extr = Extrude(Base=circle, Direction=Z)
cap = CapHoles(Brep=extr)
mesh = MeshBrep(
    Brep=cap,
    Settings={GridMaxCount=0, GridMinCount=16, JaggedSeams=False, MaxEdgeLength=0, MinEdgeLength=0.0001, MinTolerance=0, Refine=True, RefineAngle=0, RelativeTolerance=0.65, SimplePlanes=True, Tolerance=0})

# ---- group: Create Food Points
polygon = Polygon(Plane=environment_centre, Radius=Slider(100, range=0..100), Segments=6, FilletRadius=0)  # -> Polygon, Length
explode = Explode(Curve=polygon.Polygon, Recursive=True)  # -> Segments, Vertices
cullpt = CullDuplicates(Points=explode.Vertices, Tolerance=0.1, CullMode=3)  # -> Points, Indices, Valence

# ---- group: Particle Start Positions
voxel_centers = ExtractVoxelPositions(Voxels=construct_voxels)
reduction_factor = Slider(0.9, range=0..1)
lng = ListLength(List=voxel_centers)
multiplication = Multiplication(A=lng, B=reduction_factor)
reduce = RandomReduce(List=voxel_centers, Reduction=multiplication, Seed=1)

# ----
mesh_disc_simulation_will_only_run_insid = Mesh(mesh)  # "Mesh Disc (Simulation Will Only Run Inside It)"

# ---- group: Point Attractor Selects Voxels Around Attractor Points
point_attractor = PointAttractorForVoxels(
    Voxels=construct_voxels,
    AttractorPoints=flatten(cullpt.Points),
    MinimumRange=0,
    MaximumRange=Slider(5, range=0..10),
    InvertVoxelSelection=False)

# ---- group: Preview Selected Voxel Centers
voxel_centers_2 = ExtractVoxelPositions(Voxels=point_attractor)

# ---- group: Instantiate Food Values In Selected Voxels
list = ValueList({"Minimum Density": 0, "Maximum Density": 1, "Speed": 2, "Sensor Distance": 3, "Sensor Angle": 4, "Rotation Angle": 5, "Food": 6}, selected="Food")
voxel_values = DefineVoxelValues(Voxels=point_attractor, Type=list, MultiplierValue=Slider(10, range=0..10))

# ---- group: Select Voxels Inside Mesh
mesh_inclusion = VoxelInclusionInMesh(
    Voxels=construct_voxels,
    InclusionMeshes=flatten(mesh_disc_simulation_will_only_run_insid),
    InvertVoxelSelection=Toggle(False))

# ---- group: Preview Selected Voxel Centers
voxel_centers_3 = ExtractVoxelPositions(Voxels=mesh_inclusion)

# ---- group: Define Particles
particle_settings = ParticleSettings(
    ParticleTag="no tag",
    Speed=Slider(2, range=0..10),
    SensorDistance=Slider(6, range=0..10),
    SensorAngle=Slider(45, range=0..120),
    RotationAngle=Slider(45, range=0..120),
    Deposit=Slider(1, range=0..10))
particles = ConstructParticles(InitialParticles=reduce, ParticleTag="no tag")

# ---- group: Environment Settings
voxel_settings = VoxelSettings(
    DiffuseRate=Slider(0.1, range=0..1),
    DiffuseRange=Slider(1, range=0..2),
    DecayRate=Slider(0.01, range=0..0.05),
    Wrap=False)

# ---- group: Combine Voxels
voxel_selection_union = VoxelSelectionUnion(V1=mesh_inclusion, V2=voxel_values, Average=True, Maximum=False, Minimum=False)

# ----
trigger = Trigger(Interval=10, TimerInterval=10, Target=solver)  # disabled

# ---- group: Let it run for 2500+ iterations
solver = Nuclei2Solver(
    Reset=Toggle(True),
    Voxels=voxel_selection_union,
    Particles=flatten(particles),
    SolverSettings=flatten([particle_settings, voxel_settings]))  # -> OutputParticles, OutputVoxels

# ----
particle_positions = ExtractParticlePositions(Particles=solver.OutputParticles)

# ---- group: Preview Food Values
voxels = Data(voxel_selection_union)
list_2 = ValueList({"Minimum Density": 0, "Maximum Density": 1, "Speed": 2, "Sensor Distance": 3, "Sensor Angle": 4, "Rotation Angle": 5, "Food": 6, "Density": 7}, selected="Food")
voxel_centers_4 = ExtractVoxelPositions(Voxels=voxels)
voxel_values_2 = ExtractVoxelValues(Voxels=voxels, Type=list_2)
bnd = Bounds(Numbers=voxel_values_2)
remap = RemapNumbers(Value=voxel_values_2, Source=bnd, Target=Domain(0, 1))  # -> Mapped, Clipped
gradient = Gradient(LowerLimit=0, UpperLimit=1, Parameter=remap.Mapped, stops=[0: RGB(0, 0, 0), 1: RGB(255, 255, 255)])
cloud = CloudDisplay(Points=voxel_centers_4, Colours=gradient, Size=1, SpriteType=0)

# ----
swatch = ColourSwatch(SwatchColor=RGBA(255, 105, 242, 114))

# ---- group: FANCY Preview
gl_shader = GLShader(
    Vertex=particle_positions,
    Vcolor=swatch,
    DepthTestingEnabled=True,
    DepthWritingEnabled=True,
    DrawMode=0,
    FragmentShader="""#version 330

in vec4 vertex_color;
out vec4 fragment_color;

void main() {
  fragment_color = vertex_color;
}""",
    GLShader=(0, 2, 0),
    PreviewSortOrder=5,
    VertexShader="""#version 330

layout(location = 0) in vec3 vertex;
layout(location = 1) in vec4 vcolor;

uniform mat4 _worldToClip;
out vec4 vertex_color;

void main() {
  vertex_color = vcolor;
  gl_Position = _worldToClip * vec4(vertex, 1.0);
}""",
    glLineWidth=3,
    glPointSize=6)  # -> Color, Depth; disabled

# ---- group: Preview
cloud_2 = CloudDisplay(Points=particle_positions, Colours=swatch, Size=1, SpriteType=0)
