# Grasshopper definition 04_attractor curves_v2.gh (Grasshopper 1.0.7)
# plug-ins: Nuclei2, ghgl

number_slider = Slider(400, range=0..1000)
construct_voxels = ConstructVoxels(VoxelSize=1, XVoxels=number_slider, YVoxels=number_slider, ZVoxels=1)

attractor_crv_1 = Curve(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)
attractor_crv_2 = Curve(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)

# ---- group: Create Particle Start Positions
voxel_centers = ExtractVoxelPositions(Voxels=construct_voxels)
lng = ListLength(List=voxel_centers)
multiplication = Multiplication(A=lng, B=Slider(0.9, range=0..1))
reduce = RandomReduce(List=voxel_centers, Reduction=multiplication, Seed=1)

# ----
particle_start_positions = Point(reduce)

particle_settings = ParticleSettings(
    ParticleTag="no tag",
    Speed=Slider(1, range=0..10),
    SensorDistance=Slider(4, range=0..10),
    SensorAngle=45,
    RotationAngle=45,
    Deposit=2)

trail_settings = ParticleTrailSettings(TrailSize=Slider(10, range=0..10), TrailFrequency=Slider(1, range=0..1))

particles = ConstructParticles(InitialParticles=particle_start_positions, ParticleTag="no tag")
trigger = Trigger(Interval=10, TimerInterval=10, Target=solver)  # disabled

# ---- group: Curve Attractor
curve_attractor = CurveAttractorForVoxels(
    Voxels=construct_voxels,
    AttractorCurves=flatten(attractor_crv_1),
    MinimumRange=0,
    MaximumRange=Slider(70, range=0..100),
    InvertVoxelSelection=False)
voxel_centers_2 = ExtractVoxelPositions(Voxels=curve_attractor)
dom = ConstructDomain(DomainStart=Slider(0, range=0..1), DomainEnd=Slider(1, range=0..1))

# ----
crv_cp = CurveClosestPoint(Point=voxel_centers_2, Curve=attractor_crv_1)  # -> Point, Parameter, Distance

# ---- group: Curve Attractor (continued)
bnd = Bounds(Numbers=crv_cp.Distance)
remap = RemapNumbers(Value=crv_cp.Distance, Source=bnd, Target=dom)  # -> Mapped, Clipped

# ----
remapped_value = Number(remap.Mapped)

list = ValueList({"Minimum Density": 0, "Maximum Density": 1, "Speed": 2, "Sensor Distance": 3, "Sensor Angle": 4, "Rotation Angle": 5, "Food": 6}, selected="Minimum Density")
voxel_values = DefineVoxelValues(Voxels=curve_attractor, Type=list, MultiplierValue=remapped_value)

# ---- group: Curve Attractor
curve_attractor_2 = CurveAttractorForVoxels(
    Voxels=construct_voxels,
    AttractorCurves=flatten(attractor_crv_2),
    MinimumRange=0,
    MaximumRange=Slider(100, range=0..100),
    InvertVoxelSelection=False)
voxel_centers_3 = ExtractVoxelPositions(Voxels=curve_attractor_2)
dom_2 = ConstructDomain(DomainStart=Slider(0, range=0..1), DomainEnd=Slider(1, range=0..1))

# ----
crv_cp_2 = CurveClosestPoint(Point=voxel_centers_3, Curve=attractor_crv_2)  # -> Point, Parameter, Distance

# ---- group: Curve Attractor (continued)
bnd_2 = Bounds(Numbers=crv_cp_2.Distance)
remap_2 = RemapNumbers(Value=crv_cp_2.Distance, Source=bnd_2, Target=dom_2)  # -> Mapped, Clipped

# ----
remapped_value_2 = Number(remap_2.Mapped)

list_2 = ValueList({"Minimum Density": 0, "Maximum Density": 1, "Speed": 2, "Sensor Distance": 3, "Sensor Angle": 4, "Rotation Angle": 5, "Food": 6}, selected="Minimum Density")
voxel_values_2 = DefineVoxelValues(Voxels=curve_attractor_2, Type=list_2, MultiplierValue=remapped_value_2)

voxel_selection_union = VoxelSelectionUnion(V1=voxel_values, V2=voxel_values_2, Average=False, Maximum=True, Minimum=False)
solver = Nuclei2Solver(
    Reset=Toggle(True),
    Voxels=voxel_selection_union,
    Particles=flatten(particles),
    SolverSettings=flatten([particle_settings, trail_settings]))  # -> OutputParticles, OutputVoxels

# ---- group: Preview Voxel Values
list_3 = ValueList({"Minimum Density": 0, "Maximum Density": 1, "Speed": 2, "Sensor Distance": 3, "Sensor Angle": 4, "Rotation Angle": 5, "Food": 6, "Density": 7}, selected="Minimum Density")
voxel_centers_4 = ExtractVoxelPositions(Voxels=voxel_selection_union)
voxel_values_3 = ExtractVoxelValues(Voxels=voxel_selection_union, Type=list_3)
bnd_3 = Bounds(Numbers=voxel_values_3)
remap_3 = RemapNumbers(Value=voxel_values_3, Source=bnd_3, Target=Domain(0, 1))  # -> Mapped, Clipped
gradient = Gradient(LowerLimit=0, UpperLimit=1, Parameter=voxel_values_3, stops=[0: RGB(0, 0, 0), 1: RGB(255, 255, 255)])
Z = UnitZ(Factor=Slider(2, range=0..100))
move = Move(Geometry=voxel_centers_4, Motion=expr("-x", Z))  # -> Geometry, Transform
cloud = CloudDisplay(Points=move.Geometry, Colours=gradient, Size=1, SpriteType=0)

# ---- group: FANY Preview for Trails (slower)
trail_points = ExtractParticleTrails(Particles=solver.OutputParticles)  # disabled
lng_2 = ListLength(List=trail_points)  # disabled
number_slider_2 = Slider(0.35, range=0..1)  # disabled
swatch = ColourSwatch(SwatchColor=RGB(105, 237, 255))  # disabled
swatch_2 = ColourSwatch(SwatchColor=RGB(255, 0, 255))  # disabled
range = Range(Domain=Domain(0, 1), Steps=expr("x-1", lng_2))  # disabled
gl_shader = GLShader(
    Vertex=trail_points,
    Vcolor1=swatch,
    Vcolor2=swatch_2,
    T=range,
    Alpha=number_slider_2,
    DepthTestingEnabled=False,
    DepthWritingEnabled=False,
    DrawMode=3,
    FragmentShader="""#version 330

in vec4 vertex_color;
out vec4 fragment_color;
uniform sampler2D _depthBuffer;
uniform vec2 _viewportSize;
float ndcDepth;

void main() {
    
  //vec2 uv = gl_FragCoord.xy / _viewportSize;
  
  //vec4 buffer = texture(_depthBuffer, uv);
  
  //ndcDepth  = ((2.0 * gl_FragCoord.z - 1) - gl_DepthRange.near - gl_DepthRange.far/2) / (gl_DepthRange.far - gl_DepthRange.near);

  fragment_color = vertex_color;

}""",
    GLShader=(0, 2, 0),
    PreviewSortOrder=2,
    VertexShader="""#version 330

layout(location = 0) in vec3 vertex;
layout(location = 1) in vec4 vcolor1;
layout(location = 2) in float t;
layout(location = 3) in vec4 vcolor2;
layout(location = 4) in float alpha;

uniform mat4 _worldToClip;
out vec4 vertex_color;
  

void main() {
  
  vertex_color.r = pow(t,2) * vcolor1.r + (1-pow(t,2))* vcolor2.r ;
  vertex_color.g = pow(t,2) * vcolor1.g + (1-pow(t,2))* vcolor2.g;
  vertex_color.b = pow(t,2) * vcolor1.b + (1-pow(t,2))* vcolor2.b;
  vertex_color.a = (1-t/3) * alpha;
  
  gl_Position = _worldToClip * vec4(vertex, 1.0);
}""",
    glLineWidth=1,
    glPointSize=1)  # -> Color, Depth; disabled

# ---- group: Preview Particles
particle_positions = ExtractParticlePositions(Particles=solver.OutputParticles)
cloud_2 = CloudDisplay(Points=particle_positions, Colours=RGB(255, 20, 147), Size=1, SpriteType=0)
