# Grasshopper definition 05_map_v2.gh (Grasshopper 1.0.7)
# plug-ins: Nuclei2, ghgl

number_slider = Slider(800, range=0..1000)
construct_voxels = ConstructVoxels(VoxelSize=1, XVoxels=number_slider, YVoxels=number_slider, ZVoxels=1)

# ---- group: Sample Image Values (feel free to try out height maps as well)
voxel_centers = ExtractVoxelPositions(Voxels=construct_voxels)
# make sure you input
# the resolution from construct voxels into the image sampler domains
image = ImageSampler(voxel_centers, Filter="Value", Interpolate=False, Umax=800, Umin=0, Vmax=800, Vmin=0, Wrap=1)

# ---- group: Attractor Points
pt = Point([Point(119.602345, 332.1570227, 0), Point(620.2380407, 684.8424368, 0)])
point_attractor = PointAttractorForVoxels(
    Voxels=construct_voxels,
    AttractorPoints=flatten(pt),
    MinimumRange=Slider(0, range=0..100),
    MaximumRange=Slider(150, range=0..200),
    InvertVoxelSelection=False)
voxel_centers_2 = ExtractVoxelPositions(Voxels=point_attractor)
cp = ClosestPoint(Point=voxel_centers_2, Cloud=pt)  # -> ClosestPoint, CPIndex, Distance

# ---- group: Create Particle Start Positions
voxel_centers_3 = ExtractVoxelPositions(Voxels=construct_voxels)
lng = ListLength(List=voxel_centers_3)
multiplication = Multiplication(A=lng, B=Slider(0.9, range=0..1))
reduce = RandomReduce(List=voxel_centers_3, Reduction=multiplication, Seed=1)

# ----
particle_start_positions = Point(reduce)
image_sampler_value = Number(image)

# ---- group: Remap Values based on Distance
bnd = Bounds(Numbers=cp.Distance)
remap = RemapNumbers(Value=cp.Distance, Source=bnd, Target=Domain(0, 1))  # -> Mapped, Clipped
graph = GraphMapper(remap.Mapped, x0=0, x1=1, y0=0, y1=1, container_name="Bezier", cpx=[0, 1, 0.7539858818, 1], cpy=[0, 0, 1, 1])

graph_2 = GraphMapper(remap.Mapped, x0=0, x1=1, y0=0, y1=1, container_name="Bezier", cpx=[0, 0.4060606062, 1, 1], cpy=[1, 1, 0.5080645084, 0])
dom = ConstructDomain(DomainStart=Slider(1, range=0..1), DomainEnd=Slider(2, range=0..3))
remap_2 = RemapNumbers(Value=graph_2, Source=Domain(0, 1), Target=dom)  # -> Mapped, Clipped

# ----
dom_2 = ConstructDomain(DomainStart=0, DomainEnd=Slider(0.6, range=0..1))

# ---- group: Remap Values
bnd_2 = Bounds(Numbers=image_sampler_value)
remap_3 = RemapNumbers(Value=image_sampler_value, Source=bnd_2, Target=dom_2)  # -> Mapped, Clipped

# ----
remap_4 = RemapNumbers(Value=graph, Source=Domain(0, 1), Target=dom_2)  # -> Mapped, Clipped

remapped_value = Number(remap_3.Mapped)
remapped_value_2 = Number(remap_4.Mapped)
remapped_value_3 = Number(remap_2.Mapped)

particle_settings = ParticleSettings(
    ParticleTag="no tag",
    Speed=Slider(2, range=0..10),
    SensorDistance=Slider(4, range=0..10),
    SensorAngle=Slider(45, range=0..90),
    RotationAngle=Slider(45, range=0..90),
    Deposit=Slider(2, range=0..10))

trail_settings = ParticleTrailSettings(TrailSize=Slider(5, range=0..10), TrailFrequency=Slider(1, range=0..1))

voxel_settings = VoxelSettings(DiffuseRate=Slider(0.3, range=0..1), DiffuseRange=1, DecayRate=0.01, Wrap=False)

# ---- group: Instantiate Minimum Density Values
list = ValueList({"Minimum Density": 0, "Maximum Density": 1, "Speed": 2, "Sensor Distance": 3, "Sensor Angle": 4, "Rotation Angle": 5, "Food": 6}, selected="Minimum Density")
voxel_values = DefineVoxelValues(Voxels=construct_voxels, Type=list, MultiplierValue=remapped_value)

list_2 = ValueList({"Minimum Density": 0, "Maximum Density": 1, "Speed": 2, "Sensor Distance": 3, "Sensor Angle": 4, "Rotation Angle": 5, "Food": 6}, selected="Minimum Density")
voxel_values_2 = DefineVoxelValues(Voxels=point_attractor, Type=list_2, MultiplierValue=remapped_value_2)

# ---- group: Instantiate Speed Values
list_3 = ValueList({"Minimum Density": 0, "Maximum Density": 1, "Speed": 2, "Sensor Distance": 3, "Sensor Angle": 4, "Rotation Angle": 5, "Food": 6}, selected="Speed")
voxel_values_3 = DefineVoxelValues(Voxels=point_attractor, Type=list_3, MultiplierValue=remapped_value_3)

# ---- group: Instantiate Sensor Distance Values
list_4 = ValueList({"Minimum Density": 0, "Maximum Density": 1, "Speed": 2, "Sensor Distance": 3, "Sensor Angle": 4, "Rotation Angle": 5, "Food": 6}, selected="Sensor Distance")
voxel_values_4 = DefineVoxelValues(Voxels=point_attractor, Type=list_4, MultiplierValue=remapped_value_3)

# ----
particles = ConstructParticles(InitialParticles=particle_start_positions, ParticleTag="no tag")

# ---- group: Combine Mimimum Density Values
voxel_selection_union = VoxelSelectionUnion(V1=voxel_values, V2=voxel_values_2, Average=False, Maximum=False, Minimum=True)

# ---- group: Combine Speed And Sensor Distance Values
voxel_selection_union_2 = VoxelSelectionUnion(V1=voxel_values_3, V2=voxel_values_4, Average=False, Maximum=True, Minimum=False)

# ---- group: Combine All
voxel_selection_union_3 = VoxelSelectionUnion(V1=voxel_selection_union, V2=voxel_selection_union_2, Average=False, Maximum=True, Minimum=False)

# ----
trigger = Trigger(Interval=10, TimerInterval=10, Target=solver)  # disabled
solver = Nuclei2Solver(
    Reset=Toggle(True),
    Voxels=voxel_selection_union_3,
    Particles=flatten(particles),
    SolverSettings=flatten([particle_settings, voxel_settings, trail_settings]))  # -> OutputParticles, OutputVoxels
voxels = Data(voxel_selection_union_3)

# ---- group: Preview Minimum Density Values
list_5 = ValueList({"Minimum Density": 0, "Maximum Density": 1, "Speed": 2, "Sensor Distance": 3, "Sensor Angle": 4, "Rotation Angle": 5, "Food": 6, "Density": 7}, selected="Minimum Density")
voxels_2 = Data(voxels)
voxel_centers_4 = ExtractVoxelPositions(Voxels=voxels_2)
voxel_values_5 = ExtractVoxelValues(Voxels=voxels_2, Type=list_5)
Z = UnitZ(Factor=Slider(8, range=0..100))
bnd_3 = Bounds(Numbers=voxel_values_5)
move = Move(Geometry=voxel_centers_4, Motion=expr("-x", Z))  # -> Geometry, Transform
remap_5 = RemapNumbers(Value=voxel_values_5, Source=bnd_3, Target=Domain(0, 1))  # -> Mapped, Clipped
gradient = Gradient(LowerLimit=0, UpperLimit=1, Parameter=remap_5.Mapped, stops=[0: RGB(0, 0, 0), 1: RGB(255, 255, 255)])
cloud = CloudDisplay(Points=move.Geometry, Colours=gradient, Size=1, SpriteType=0)

# ---- group: Preview Speed Values
list_6 = ValueList({"Minimum Density": 0, "Maximum Density": 1, "Speed": 2, "Sensor Distance": 3, "Sensor Angle": 4, "Rotation Angle": 5, "Food": 6, "Density": 7}, selected="Speed")
voxels_3 = Data(voxels)
voxel_centers_5 = ExtractVoxelPositions(Voxels=voxels_3)
voxel_values_6 = ExtractVoxelValues(Voxels=voxels_3, Type=list_6)
Z_2 = UnitZ(Factor=Slider(6, range=0..100))
bnd_4 = Bounds(Numbers=voxel_values_6)
move_2 = Move(Geometry=voxel_centers_5, Motion=expr("-x", Z_2))  # -> Geometry, Transform
remap_6 = RemapNumbers(Value=voxel_values_6, Source=bnd_4, Target=Domain(0, 1))  # -> Mapped, Clipped
gradient_2 = Gradient(LowerLimit=0, UpperLimit=1, Parameter=remap_6.Mapped, stops=[0.501: RGBA(255, 255, 255, 0), 1: RGB(128, 255, 255)])
cloud_2 = CloudDisplay(Points=move_2.Geometry, Colours=gradient_2, Size=1, SpriteType=0)

# ---- group: Preview Sensor Distance Values
list_7 = ValueList({"Minimum Density": 0, "Maximum Density": 1, "Speed": 2, "Sensor Distance": 3, "Sensor Angle": 4, "Rotation Angle": 5, "Food": 6, "Density": 7}, selected="Speed")
voxels_4 = Data(voxels)
voxel_centers_6 = ExtractVoxelPositions(Voxels=voxels_4)
voxel_values_7 = ExtractVoxelValues(Voxels=voxels_4, Type=list_7)
Z_3 = UnitZ(Factor=Slider(4, range=0..100))
bnd_5 = Bounds(Numbers=voxel_values_7)
move_3 = Move(Geometry=voxel_centers_6, Motion=expr("-x", Z_3))  # -> Geometry, Transform
remap_7 = RemapNumbers(Value=voxel_values_7, Source=bnd_5, Target=Domain(0, 1))  # -> Mapped, Clipped
gradient_3 = Gradient(LowerLimit=0, UpperLimit=1, Parameter=remap_7.Mapped, stops=[0.499: RGBA(255, 255, 255, 0), 1: RGB(128, 128, 255)])
cloud_3 = CloudDisplay(Points=move_3.Geometry, Colours=gradient_3, Size=1, SpriteType=0)

# ---- group: FANCY Preview for Trails (slower)
trail_points = ExtractParticleTrails(Particles=solver.OutputParticles)  # disabled
lng_2 = ListLength(List=trail_points)  # disabled
number_slider_2 = Slider(0.35, range=0..1)  # disabled
swatch = ColourSwatch(SwatchColor=RGB(105, 237, 255))  # disabled
swatch_2 = ColourSwatch(SwatchColor=RGB(255, 0, 255))  # disabled
range = Range(Domain=Domain(0, 1), Steps=expr("x-1", lng_2))  # disabled
gl_shader = GLShader(
    Vertex=trail_points,
    Vcolor1=swatch,
    Vcolor2=swatch_2,
    T=range,
    Alpha=number_slider_2,
    DepthTestingEnabled=False,
    DepthWritingEnabled=False,
    DrawMode=3,
    FragmentShader="""#version 330

in vec4 vertex_color;
out vec4 fragment_color;
uniform sampler2D _depthBuffer;
uniform vec2 _viewportSize;
float ndcDepth;

void main() {
    
  //vec2 uv = gl_FragCoord.xy / _viewportSize;
  
  //vec4 buffer = texture(_depthBuffer, uv);
  
  //ndcDepth  = ((2.0 * gl_FragCoord.z - 1) - gl_DepthRange.near - gl_DepthRange.far/2) / (gl_DepthRange.far - gl_DepthRange.near);

  fragment_color = vertex_color;

}""",
    GLShader=(0, 2, 0),
    PreviewSortOrder=2,
    VertexShader="""#version 330

layout(location = 0) in vec3 vertex;
layout(location = 1) in vec4 vcolor1;
layout(location = 2) in float t;
layout(location = 3) in vec4 vcolor2;
layout(location = 4) in float alpha;

uniform mat4 _worldToClip;
out vec4 vertex_color;
  

void main() {
  
  vertex_color.r = pow(t,2) * vcolor1.r + (1-pow(t,2))* vcolor2.r ;
  vertex_color.g = pow(t,2) * vcolor1.g + (1-pow(t,2))* vcolor2.g;
  vertex_color.b = pow(t,2) * vcolor1.b + (1-pow(t,2))* vcolor2.b;
  vertex_color.a = (1-t/3) * alpha;
  
  gl_Position = _worldToClip * vec4(vertex, 1.0);
}""",
    glLineWidth=1,
    glPointSize=1)  # -> Color, Depth; disabled

# ---- group: Preview Particles
particle_positions = ExtractParticlePositions(Particles=solver.OutputParticles)
cloud_4 = CloudDisplay(Points=particle_positions, Colours=RGB(255, 20, 147), Size=2, SpriteType=0)
