# Grasshopper definition 06_vector fields_v2.gh (Grasshopper 1.0.7)
# plug-ins: Nuclei2, DendroGH, ghgl

# ---- group: Define Design Space
number_slider = Slider(250, range=0..1000)
construct_voxels = ConstructVoxels(VoxelSize=1, XVoxels=number_slider, YVoxels=number_slider, ZVoxels=Slider(1, range=1..30))

# ---- group: Create VectorField
pt = Point(Point(81.74959573, 93.21354674, 0))
voxel_box = ExtractVoxelBoundingBox(Voxels=construct_voxels)
pt_2 = Point(Point(160.2051266, 160.7217942, 0))
fspin = SpinForce(Plane=pt, Strength="-0.75", Radius=Slider(60, range=0..100), Decay=2, Bounds=voxel_box)
fspin_2 = SpinForce(Plane=pt_2, Strength="1", Radius=Slider(90, range=0..100), Decay=2, Bounds=voxel_box)
voxel_centers = ExtractVoxelPositions(Voxels=construct_voxels)
mergef = MergeFields(Fields=flatten([fspin, fspin_2]))
evf = EvaluateField(Field=mergef, Point=voxel_centers)  # -> Tensor, Strength

# ---- group: Particle Start Positions
voxel_centers_2 = ExtractVoxelPositions(Voxels=construct_voxels)
reduction_factor = Slider(0.7, range=0..1)
lng = ListLength(List=voxel_centers_2)
multiplication = Multiplication(A=lng, B=reduction_factor)
reduce = RandomReduce(List=voxel_centers_2, Reduction=multiplication, Seed=1)

# ---- group: Preview VectorField
pop2d = Populate2D(Region=voxel_box, Count=100, Seed=1)
fline = FieldLine(Field=mergef, Point=pop2d, Steps=1000, Accuracy=0.1, Method=3)
crv = Curve(fline)

# ----
vectors = Vector(evf.Tensor)

number_slider_2 = Slider(100, range=0..100)
trail_settings = ParticleTrailSettings(TrailSize=number_slider_2, TrailFrequency=Slider(1, range=0..10))

# ---- group: Define Particles
particle_settings = ParticleSettings(
    ParticleTag="no tag",
    Speed=Slider(1, range=0..10),
    SensorDistance=Slider(3, range=0..10),
    SensorAngle=Slider(30, range=0..120),
    RotationAngle=Slider(30, range=0..120),
    Deposit=Slider(0.5, range=0..10))
particles = ConstructParticles(InitialParticles=reduce, ParticleTag="no tag")

# ---- group: Environment Settings
voxel_settings = VoxelSettings(
    DiffuseRate=Slider(0.1, range=0..1),
    DiffuseRange=Slider(1, range=0..1),
    DecayRate=Slider(0.01, range=0..0.01),
    Wrap=Toggle(True))

# ---- group: Instantiate Vector Field
voxel_vectors = DefineVoxelVectors(Voxels=construct_voxels, VoxelVector=flatten(vectors), Frequency=flatten(Slider(7, range=1..15)))

# ----
blend_vectorfield = VoxelVectorsBlend(
    Voxels=voxel_vectors,
    BlendStrength=Slider(1, range=0..1),
    BlendRange=Slider(1, range=0..10),
    BlendIterations=Slider(3, range=0..10),
    WrapBlend=Toggle(True))

# ---- group: Preview Vector Field
voxels = Data(blend_vectorfield)
voxel_centers_3 = ExtractVoxelPositions(Voxels=voxels)
voxel_vectors_2 = ExtractVoxelVector(Voxels=voxels)
unit = UnitVector(Vector=voxel_vectors_2)
move = Move(Geometry=voxel_centers_3, Motion=unit)  # -> Geometry, Transform
ln = Line(StartPoint=voxel_centers_3, EndPoint=move.Geometry)

# ---- group: Stop it after 100-ish frames
solver = Nuclei2Solver(
    Reset=Toggle(True),
    Voxels=blend_vectorfield,
    Particles=flatten(particles),
    SolverSettings=flatten([particle_settings, voxel_settings, trail_settings]))  # -> OutputParticles, OutputVoxels

# ----
trigger = Trigger(Interval=10, TimerInterval=10, Target=solver)  # disabled

# ---- group: Display Particles
particle_positions = ExtractParticlePositions(Particles=solver.OutputParticles)
cloud = CloudDisplay(Points=particle_positions, Colours=RGB(255, 20, 147), Size=1, SpriteType=0)

# ---- group: Move Trail Points on Height
trail_points = ExtractParticleTrails(Particles=solver.OutputParticles)  # disabled
lng_2 = ListLength(List=trail_points)  # -> flatten(Length)
series = Series(Start=0, Step=1, Count=number_slider_2)
series_2 = Series(Start=0, Step=1, Count=lng_2)
Z = UnitZ(Factor=series)  # -> reverse(UnitVector)
item = ListItem(List=Z, Index=series_2, Wrap=True)
move_2 = Move(Geometry=trail_points, Motion=item)  # -> Geometry, Transform

# ----
moved_trail_points = Point(move_2.Geometry)

# ---- group: Preview Trails / Extract Particle Trails
moved_trail_points_2 = Point(moved_trail_points)
lng_3 = ListLength(List=moved_trail_points_2)
range = Range(Domain=Domain(0, 1), Steps=expr("x-1", lng_3))
gl_shader = GLShader(
    Vertex=moved_trail_points_2,
    Vcolor1=ColourSwatch(SwatchColor=RGB(105, 237, 255)),
    Vcolor2=ColourSwatch(SwatchColor=RGB(255, 0, 255)),
    T=range,
    Alpha=Slider(0.3, range=0..1),
    DepthTestingEnabled=False,
    DepthWritingEnabled=False,
    DrawMode=3,
    FragmentShader="""#version 330

in vec4 vertex_color;
out vec4 fragment_color;
uniform sampler2D _depthBuffer;
uniform vec2 _viewportSize;
float ndcDepth;

void main() {
    
  //vec2 uv = gl_FragCoord.xy / _viewportSize;
  
  //vec4 buffer = texture(_depthBuffer, uv);
  
  //ndcDepth  = ((2.0 * gl_FragCoord.z - 1) - gl_DepthRange.near - gl_DepthRange.far/2) / (gl_DepthRange.far - gl_DepthRange.near);

  fragment_color = vertex_color;

}""",
    GLShader=(0, 2, 0),
    PreviewSortOrder=2,
    VertexShader="""#version 330

layout(location = 0) in vec3 vertex;
layout(location = 1) in vec4 vcolor1;
layout(location = 2) in float t;
layout(location = 3) in vec4 vcolor2;
layout(location = 4) in float alpha;

uniform mat4 _worldToClip;
out vec4 vertex_color;
  

void main() {
  
  vertex_color.r = pow(t,2) * vcolor1.r + (1-pow(t,2))* vcolor2.r ;
  vertex_color.g = pow(t,2) * vcolor1.g + (1-pow(t,2))* vcolor2.g;
  vertex_color.b = pow(t,2) * vcolor1.b + (1-pow(t,2))* vcolor2.b;
  vertex_color.a = (1-t/3) * alpha;
  
  gl_Position = _worldToClip * vec4(vertex, 1.0);
}""",
    glLineWidth=1,
    glPointSize=1)  # -> Color, Depth

# ----
moved_trail_points_3 = Point(moved_trail_points)
vsettings = CreateSettings(VoxelSize=Slider(0.8, range=0..1), Bandwidth=1, Isovalue=0, Adaptivity=0.1)
vpoints = PointsToVolume(Points=flatten(moved_trail_points_3), PointRadius=Slider(1.2, range=1..2), Settings=vsettings)
vsmooth = SmoothVolume(Volume=vpoints, Width=1, Type=2, Iterations=Slider(3, range=0..10))
mvolume = VolumeToMesh(Volume=vsmooth, VolumeSettings=vsettings)
