# Grasshopper definition 07_mesh constrain (lowRes)_v2.gh (Grasshopper 1.0.7)
# plug-ins: Nuclei2, ghgl

number_slider = Slider(1, range=0..1)
number_slider_2 = Slider(150, range=0..1000)
construct_voxels = ConstructVoxels(VoxelSize=number_slider, XVoxels=number_slider_2, YVoxels=number_slider_2, ZVoxels=number_slider_2)

# ---- group: Create Mesh Points with Formula
list = ValueList({"Gyroid": 1, "Schwarz D": 2, "Schwarz G": 3, "Schwarz P": 4, "Neovius": 5, "Diamond": 6, "Holes": 7}, selected="Gyroid")
pi = Pi(Factor=Slider(2.3, range=0..10))
resx = Integer(number_slider_2)
resy = Integer(number_slider_2)
resz = Integer(number_slider_2)
c_periodic_surface_points = CSharpScript(type=list, voxelSize=number_slider, resX=resx, resY=resy, resZ=resz, scale=pi, isoValue=Slider(0.1, range=0..1))  # -> out, points; inputs type: Int32, voxelSize: Double, resX: Int32, resY: Int32, resZ: Int32, scale: Double, isoValue: Double
# ---------- c_periodic_surface_points: C# usings ----------
using System.Threading.Tasks;
using System.Linq;
using System.Collections.Concurrent;
# ---------- c_periodic_surface_points: C# ----------
    List <Point3d> outputPt = new List <Point3d> ();


    for(int i = 0; i < resX; i++)
    {
      double x = scale * ((double) i / (double) resX);
      for(int j = 0; j < resY; j++)
      {
        double y = scale * ((double) j / (double) resY);
        for(int k = 0; k < resZ; k++)
        {
          double z = scale * ((double) k / (double) resZ);

          double voxelValue = 0.0;

          if(type == 1){
            //1 Gyroid
            voxelValue = Math.Cos(x) * Math.Sin(y) + Math.Cos(y) * Math.Sin(z) + Math.Cos(z) * Math.Sin(x);
          }

          if(type == 2){
            //2 Schwarz D
            voxelValue = Math.Cos(x) * Math.Cos(y) * Math.Cos(z) - Math.Sin(x) * Math.Sin(y) * Math.Sin(z);
          }

          if(type == 3){
            //3 Schwarz G
            voxelValue = Math.Sin(x) * Math.Cos(y) + Math.Sin(z) * Math.Cos(x) + Math.Sin(y) * Math.Cos(z);
          }

          if(type == 4){
            //4 Schwarz P
            voxelValue = -Math.Cos(x) + Math.Cos(y) + Math.Cos(z);
          }

          if(type == 5){
            //5 Neovius
            voxelValue = 3 * (Math.Cos(x) + Math.Cos(y) + Math.Cos(z)) + 4 * (Math.Cos(x) * Math.Cos(y) * Math.Cos(z));
          }

          if(type == 6){
            //6 Diamond
            voxelValue = Math.Sin(x) * Math.Sin(y) * Math.Sin(z) + Math.Sin(x) * Math.Cos(y) * Math.Cos(z) + Math.Cos(x) * Math.Sin(y) * Math.Cos(z) + Math.Cos(x) * Math.Cos(y) * Math.Sin(z);
          }

          if(type == 7){
            //7 P W Hybrid
            voxelValue = (Math.Cos(x) + Math.Cos(y) + Math.Cos(z)) + 4 * Math.Cos(x) * Math.Cos(y) * Math.Cos(z);
          }

          if(voxelValue + 0.1 >= isoValue && voxelValue - 0.1 <= isoValue)
          {
            outputPt.Add(new Point3d(i * voxelSize + voxelSize / 2, j * voxelSize + voxelSize / 2, k * voxelSize + voxelSize / 2));
          }
        }
      }
    }

    points = outputPt;
# ---------- end c_periodic_surface_points ----------

# ----
pt = Point(c_periodic_surface_points.points)

# ---- group: Define Design Space (Sphere)
voxel_box = ExtractVoxelBoundingBox(Voxels=construct_voxels)
debox = DeconstructBox(Box=voxel_box)  # -> Plane, X, Y, Z
dedomain = DeconstructDomain(Domain=debox.X)  # -> Start, End
volume = Volume(Geometry=voxel_box)  # -> Volume, Centroid
multiplication = Multiplication(A=dedomain.End, B=Slider(0.4, range=0..1))
point_attractor = PointAttractorForVoxels(
    Voxels=construct_voxels,
    AttractorPoints=flatten(volume.Centroid),
    MinimumRange=0,
    MaximumRange=multiplication,
    InvertVoxelSelection=False)

# ---- group: Define Design Space (Periodic Surface)
point_attractor_2 = PointAttractorForVoxels(
    Voxels=construct_voxels,
    AttractorPoints=flatten(pt),
    MinimumRange=Slider(0, range=0..5),
    MaximumRange=Slider(2.5, range=0..5),
    InvertVoxelSelection=Toggle(False))

# ---- group: Preview Voxel Selection
voxel_centers = ExtractVoxelPositions(Voxels=point_attractor)

voxel_centers_2 = ExtractVoxelPositions(Voxels=point_attractor_2)

# ---- group: Intersect Design Spaces
voxel_selection_intersection = VoxelSelectionIntersection(V1=point_attractor, V2=point_attractor_2, Average=True, Maximum=False, Minimum=False)

# ---- group: Create Particle Start Positions
voxel_centers_3 = ExtractVoxelPositions(Voxels=voxel_selection_intersection)
lng = ListLength(List=voxel_centers_3)
multiplication_2 = Multiplication(A=lng, B=Slider(0.8, range=0..1))
reduce = RandomReduce(List=voxel_centers_3, Reduction=multiplication_2, Seed=1)

# ----
particle_start_positions = Point(reduce)

voxel_settings = VoxelSettings(DiffuseRate=Slider(0.1, range=0..1), DiffuseRange=1, DecayRate=0.01, Wrap=False)

particle_settings = ParticleSettings(
    ParticleTag="no tag",
    Speed=Slider(1, range=0..10),
    SensorDistance=Slider(2, range=0..10),
    SensorAngle=Slider(45, range=0..90),
    RotationAngle=Slider(45, range=0..90),
    Deposit=Slider(0.5, range=0..10))
particles = ConstructParticles(InitialParticles=particle_start_positions, ParticleTag="no tag")

trail_settings = ParticleTrailSettings(TrailSize=Slider(5, range=0..10), TrailFrequency=Slider(1, range=0..10))

solver = Nuclei2Solver(
    Reset=Toggle(True),
    Voxels=voxel_selection_intersection,
    Particles=flatten(particles),
    SolverSettings=flatten([particle_settings, voxel_settings, trail_settings]))  # -> OutputParticles, OutputVoxels
trigger = Trigger(Interval=10, TimerInterval=10, Target=solver)  # disabled

# ---- group: Preview Particles
particle_positions = ExtractParticlePositions(Particles=solver.OutputParticles)
cloud = CloudDisplay(Points=particle_positions, Colours=RGB(255, 20, 147), Size=0.5, SpriteType=0)

# ---- group: Preview Trails / Extract Particle Trails
trail_points = ExtractParticleTrails(Particles=solver.OutputParticles)  # disabled
lng_2 = ListLength(List=trail_points)  # disabled
number_slider_3 = Slider(0.3, range=0..1)  # disabled
range = Range(Domain=Domain(0, 1), Steps=expr("x-1", lng_2))  # disabled
swatch = ColourSwatch(SwatchColor=RGB(105, 237, 255))  # disabled
swatch_2 = ColourSwatch(SwatchColor=RGB(255, 0, 255))  # disabled
gl_shader = GLShader(
    Vertex=trail_points,
    Vcolor1=swatch,
    Vcolor2=swatch_2,
    T=range,
    Alpha=number_slider_3,
    DepthTestingEnabled=False,
    DepthWritingEnabled=False,
    DrawMode=3,
    FragmentShader="""#version 330

in vec4 vertex_color;
out vec4 fragment_color;
uniform sampler2D _depthBuffer;
uniform vec2 _viewportSize;
float ndcDepth;

void main() {
    
  //vec2 uv = gl_FragCoord.xy / _viewportSize;
  
  //vec4 buffer = texture(_depthBuffer, uv);
  
  //ndcDepth  = ((2.0 * gl_FragCoord.z - 1) - gl_DepthRange.near - gl_DepthRange.far/2) / (gl_DepthRange.far - gl_DepthRange.near);

  fragment_color = vertex_color;

}""",
    GLShader=(0, 2, 0),
    PreviewSortOrder=2,
    VertexShader="""#version 330

layout(location = 0) in vec3 vertex;
layout(location = 1) in vec4 vcolor1;
layout(location = 2) in float t;
layout(location = 3) in vec4 vcolor2;
layout(location = 4) in float alpha;

uniform mat4 _worldToClip;
out vec4 vertex_color;
  

void main() {
  
  vertex_color.r = pow(t,2) * vcolor1.r + (1-pow(t,2))* vcolor2.r ;
  vertex_color.g = pow(t,2) * vcolor1.g + (1-pow(t,2))* vcolor2.g;
  vertex_color.b = pow(t,2) * vcolor1.b + (1-pow(t,2))* vcolor2.b;
  vertex_color.a = (1-t/3) * alpha;
  
  gl_Position = _worldToClip * vec4(vertex, 1.0);
}""",
    glLineWidth=1,
    glPointSize=1)  # -> Color, Depth; disabled

# ---- group: Preview Density
list_2 = ValueList({"Minimum Density": 0, "Maximum Density": 1, "Speed": 2, "Sensor Distance": 3, "Sensor Angle": 4, "Rotation Angle": 5, "Food": 6, "Density": 7}, selected="Density")  # disabled
voxel_centers_4 = ExtractVoxelPositions(Voxels=solver.OutputVoxels)  # disabled
voxel_values = ExtractVoxelValues(Voxels=solver.OutputVoxels, Type=list_2)  # disabled
gradient = Gradient(
    LowerLimit=0,
    UpperLimit=1,
    Parameter=voxel_values,
    stops=[0: RGBA(255, 255, 255, 0), 0.361: RGB(138, 43, 226), 1: RGB(255, 0, 255)])  # disabled
cloud_2 = CloudDisplay(Points=voxel_centers_4, Colours=gradient, Size=0.8, SpriteType=0)  # disabled
