# Grasshopper definition 08_growth_v2.gh (Grasshopper 1.0.7)
# plug-ins: Nuclei2, DendroGH, ghgl

voxelres = Slider(120, range=0..200)
construct_voxels = ConstructVoxels(VoxelSize=1, XVoxels=voxelres, YVoxels=voxelres, ZVoxels=voxelres)

voxel_box = ExtractVoxelBoundingBox(Voxels=construct_voxels)
volume = Volume(Geometry=voxel_box)  # -> Volume, Centroid
expression = Expression(x=voxelres, Expression="x/2")
pt = Point(volume.Centroid)

# ---- group: Particle Starting Positions Around Attractor Point
point_attractor = PointAttractorForVoxels(
    Voxels=construct_voxels,
    AttractorPoints=flatten(pt),
    MinimumRange=Slider(0, range=0..10),
    MaximumRange=Slider(5, range=0..10),
    InvertVoxelSelection=Toggle(False))

# ---- group: Particle Growth Settings / Inside This Range They Divide
number_slider = Slider(30, range=0..200)
number_slider_2 = Slider(1, range=0..10)

# ---- group: Particle Growth Settings / Outside This Range They Die
number_slider_3 = Slider(0, range=0..10)
number_slider_4 = Slider(100, range=0..300)

# ---- group: Particle Settings
voxel_centers = ExtractVoxelPositions(Voxels=point_attractor)
particle_settings = ParticleSettings(
    ParticleTag="no tag",
    Speed=Slider(1.5, range=0..3),
    SensorDistance=Slider(6, range=0..20),
    SensorAngle=Slider(30, range=0..100),
    RotationAngle=Slider(30, range=0..100),
    Deposit=Slider(2, range=0..10))
particles = ConstructParticles(InitialParticles=voxel_centers, ParticleTag="no tag")

# ---- group: Particle Trail Settings
trail_settings = ParticleTrailSettings(TrailSize=Slider(10, range=0..30), TrailFrequency=Slider(1, range=0..5))

# ---- group: Particle Growth Settings
population_settings = ParticlePopulationSettings(MinimumPopulation=100, MaximumPopulation="50000")
death_settings = ParticleDeathSettings(
    Die=Toggle(True),
    DieRange=Slider(2, range=0..10),
    MinimumNeighbours=number_slider_3,
    MaximumNeighbours=number_slider_4,
    DieFrequency=Slider(10, range=0..10))
division_settings = ParticleDivisionSettings(
    Divide=Toggle(True),
    DivisionRange=Slider(3, range=0..5),
    MinimumNeighbours=number_slider_2,
    MaximumNeighbours=number_slider,
    DivFrequency=Slider(4, range=0..10))

# ---- group: Voxel Settings
voxel_settings = VoxelSettings(
    DiffuseRate=Slider(0.3, range=0..1),
    DiffuseRange=Slider(1, range=0..10),
    DecayRate=Slider(0.01, range=0..0.3),
    Wrap=Toggle(False))

# ---- group: Define Design Space Inside Sphere
msphere = MeshSphere(Base=pt, Radius=expression, UCount=10, VCount=20)
mesh_inclusion = VoxelInclusionInMesh(Voxels=construct_voxels, InclusionMeshes=flatten(msphere), InvertVoxelSelection=False)

# ----
trigger = Trigger(Interval=10, TimerInterval=10, Target=solver)  # disabled
solver = Nuclei2Solver(
    Reset=Toggle(True),
    Voxels=mesh_inclusion,
    Particles=flatten(particles),
    SolverSettings=flatten([voxel_settings, death_settings, division_settings, population_settings, trail_settings, particle_settings]))  # -> OutputParticles, OutputVoxels

# ---- group: Preview Particles
particle_positions = ExtractParticlePositions(Particles=solver.OutputParticles)
cloud = CloudDisplay(Points=particle_positions, Colours=RGB(255, 20, 147), Size=0.5, SpriteType=0)

# ----
trail_points = ExtractParticleTrails(Particles=solver.OutputParticles)  # disabled

# ---- group: Convert To Geometry
number_slider_5 = Slider(5, range=0..10)  # disabled
prune = PruneTree(Tree=trail_points, Minimum=number_slider_5, Maximum=0)  # disabled
pline = PolyLine(Vertices=prune, Closed=False)  # disabled
number_slider_6 = Slider(0.1, range=0..1)  # disabled
number_slider_7 = Slider(0.16, range=0..10)  # disabled
vsettings = CreateSettings(VoxelSize=number_slider_6, Bandwidth=1, Isovalue=0, Adaptivity=0.1)  # disabled
vcurve = CurveToVolume(Curves=flatten(pline), CurveRadius=number_slider_7, Settings=vsettings)  # disabled
mvolume = VolumeToMesh(Volume=vcurve, VolumeSettings=vsettings)  # disabled

# ---- group: Mesh Preview
number_slider_8 = Slider(5, range=0..10)  # disabled
prune_2 = PruneTree(Tree=trail_points, Minimum=number_slider_8, Maximum=0)  # disabled
number_slider_9 = Slider(1.1, range=0..10)  # disabled
number_slider_10 = Slider(0.7, range=0..1)  # disabled
vsettings_2 = CreateSettings(VoxelSize=number_slider_10, Bandwidth=1, Isovalue=0, Adaptivity=0.1)  # disabled
vpoints = PointsToVolume(Points=flatten(prune_2), PointRadius=number_slider_9, Settings=vsettings_2)  # disabled
mvolume_2 = VolumeToMesh(Volume=vpoints, VolumeSettings=vsettings_2)  # disabled

# ----
lng = ListLength(List=particle_positions)

lng_2 = ListLength(List=trail_points)  # disabled
number_slider_11 = Slider(0.2, range=0..1)  # disabled
swatch = ColourSwatch(SwatchColor=RGB(105, 237, 255))  # disabled
swatch_2 = ColourSwatch(SwatchColor=RGB(255, 0, 255))  # disabled
range = Range(Domain=Domain(0, 1), Steps=expr("x-1", lng_2))  # disabled
gl_shader = GLShader(
    Vertex=trail_points,
    Vcolor1=swatch,
    Vcolor2=swatch_2,
    T=range,
    Alpha=number_slider_11,
    DepthTestingEnabled=False,
    DepthWritingEnabled=False,
    DrawMode=3,
    FragmentShader="""#version 330

in vec4 vertex_color;
out vec4 fragment_color;
uniform sampler2D _depthBuffer;
uniform vec2 _viewportSize;
float ndcDepth;

void main() {
    
  //vec2 uv = gl_FragCoord.xy / _viewportSize;
  
  //vec4 buffer = texture(_depthBuffer, uv);
  
  //ndcDepth  = ((2.0 * gl_FragCoord.z - 1) - gl_DepthRange.near - gl_DepthRange.far/2) / (gl_DepthRange.far - gl_DepthRange.near);

  fragment_color = vertex_color;

}""",
    GLShader=(0, 2, 0),
    PreviewSortOrder=2,
    VertexShader="""#version 330

layout(location = 0) in vec3 vertex;
layout(location = 1) in vec4 vcolor1;
layout(location = 2) in float t;
layout(location = 3) in vec4 vcolor2;
layout(location = 4) in float alpha;

uniform mat4 _worldToClip;
out vec4 vertex_color;
  

void main() {
  
  vertex_color.r = pow(t,2) * vcolor1.r + (1-pow(t,2))* vcolor2.r ;
  vertex_color.g = pow(t,2) * vcolor1.g + (1-pow(t,2))* vcolor2.g;
  vertex_color.b = pow(t,2) * vcolor1.b + (1-pow(t,2))* vcolor2.b;
  vertex_color.a = (1-t/3) * alpha;
  
  gl_Position = _worldToClip * vec4(vertex, 1.0);
}""",
    glLineWidth=1,
    glPointSize=1)  # -> Color, Depth; disabled

number_of_particles = Panel(lng)
