# Grasshopper definition 09_growth on mesh_v2.gh (Grasshopper 1.0.7)
# plug-ins: Nuclei2, DendroGH, ghgl

voxelres = Slider(80, range=0..200)
number_slider = Slider(250, range=0..1000)
construct_voxels = ConstructVoxels(VoxelSize=1, XVoxels=voxelres, YVoxels=voxelres, ZVoxels=number_slider)

voxel_box = ExtractVoxelBoundingBox(Voxels=construct_voxels)
volume = Volume(Geometry=voxel_box)  # -> Volume, Centroid
project = Project(Geometry=volume.Centroid, Plane=PlaneXY(0, 0, 0))  # -> Geometry, Transform

# ---- group: Create Attractor Curves
circle = CircleCNR(Center=project.Geometry, Normal=Vector(0, 0, 1), Radius=Slider(33, range=0..100))
number_slider_2 = Slider(14, range=0..15)
dom = ConstructDomain(DomainStart=Slider(66, range=0..1000), DomainEnd=Slider(200, range=0..1000))
random = Random(Range=dom, Number=number_slider_2, Seed=Slider(437, range=0..1000))
divide = DivideCurve(Curve=circle, Count=number_slider_2, Kinks=False)  # -> Points, Tangents, Parameters
Z = UnitZ(Factor=random)
move = Move(Geometry=divide.Points, Motion=Z)  # -> Geometry, Transform
ln = Line(StartPoint=divide.Points, EndPoint=move.Geometry)

# ---- group: Create Attractor Mesh
circle_2 = Curve(circle)
resz = Integer(number_slider)
Z_2 = UnitZ(Factor=resz)
move_2 = Move(Geometry=circle_2, Motion=Z_2)  # -> Geometry, Transform
loft = Loft(
    Curves=[circle_2, move_2.Geometry],
    Options={Adjust=False, Closed=False, LoftEnds=0, LoftSimp=0, LoftType=0, Rebuild=10, Refit=0.01})
custom_mesh_settings = SettingsCustom(
    StitchSeams=True,
    SimplePlanes=False,
    Refine=True,
    MinCount=16,
    MaxCount=400,
    AspectRatio=20,
    MaxDistance=0,
    MaxAngle=20,
    MinEdge=0,
    MaxEdge=Slider(1, range=0..1))
mesh = MeshBrep(Brep=loft, Settings=custom_mesh_settings)

# ----
attractor_curve = Curve(ln)
attractor_mesh = Mesh(mesh)

# ---- group: Attractor Paths Influence Particle Behavior
curve_attractor = CurveAttractorForVoxels(
    Voxels=construct_voxels,
    AttractorCurves=flatten(attractor_curve),
    MinimumRange=0,
    MaximumRange=1,
    InvertVoxelSelection=False)
list = ValueList({"Minimum Density": 0, "Maximum Density": 1, "Speed": 2, "Sensor Distance": 3, "Sensor Angle": 4, "Rotation Angle": 5, "Food": 6}, selected="Minimum Density")
voxel_values = DefineVoxelValues(Voxels=curve_attractor, Type=list, MultiplierValue=Slider(0.9, range=0..1))

# ---- group: Select Design Space
mesh_attractor = MeshAttractorForVoxel(
    Voxels=construct_voxels,
    AttractorMeshes=flatten(attractor_mesh),
    MinimumRange=0,
    MaximumRange=Slider(8, range=0..10),
    InvertVoxelSelection=False)

# ---- group: Create Particle Starting Positions
point_attractor = PointAttractorForVoxels(
    Voxels=construct_voxels,
    AttractorPoints=flatten(project.Geometry),
    MinimumRange=0,
    MaximumRange=Slider(50, range=0..100),
    InvertVoxelSelection=False)

# ----
voxel_selection_union = VoxelSelectionUnion(V1=voxel_values, V2=mesh_attractor, Average=True, Maximum=False, Minimum=False)

# ---- group: Increase The Speed & Sensor Distance on the Z Axis
voxel_centers = ExtractVoxelPositions(Voxels=voxel_selection_union)
pdecon = Deconstruct(Point=voxel_centers)  # -> XComponent, YComponent, ZComponent
bnd = Bounds(Numbers=pdecon.ZComponent)
dom_2 = ConstructDomain(DomainStart=Slider(1, range=0..1), DomainEnd=Slider(6, range=0..10))
remap = RemapNumbers(Value=pdecon.ZComponent, Source=bnd, Target=dom_2)  # -> Mapped, Clipped
list_2 = ValueList({"Minimum Density": 0, "Maximum Density": 1, "Speed": 2, "Sensor Distance": 3, "Sensor Angle": 4, "Rotation Angle": 5, "Food": 6}, selected="Speed")
list_3 = ValueList({"Minimum Density": 0, "Maximum Density": 1, "Speed": 2, "Sensor Distance": 3, "Sensor Angle": 4, "Rotation Angle": 5, "Food": 6}, selected="Sensor Distance")
voxel_values_2 = DefineVoxelValues(Voxels=voxel_selection_union, Type=list_2, MultiplierValue=remap.Mapped)
voxel_values_3 = DefineVoxelValues(Voxels=voxel_selection_union, Type=list_3, MultiplierValue=remap.Mapped)
voxel_selection_union_2 = VoxelSelectionUnion(V1=voxel_values_2, V2=voxel_values_3, Average=True, Maximum=False, Minimum=False)

# ----
voxel_selection_intersection = VoxelSelectionIntersection(V1=mesh_attractor, V2=point_attractor, Average=True, Maximum=False, Minimum=False)
voxel_centers_2 = ExtractVoxelPositions(Voxels=voxel_selection_intersection)
lng = ListLength(List=voxel_centers_2)
multiplication = Multiplication(A=lng, B=Slider(0.8, range=0..1))
reduce = RandomReduce(List=voxel_centers_2, Reduction=multiplication, Seed=1)

population_settings = ParticlePopulationSettings(MinimumPopulation=100, MaximumPopulation="200000")
death_settings = ParticleDeathSettings(
    Die=Toggle(True),
    DieRange=Slider(2, range=0..10),
    MinimumNeighbours=Slider(0, range=0..10),
    MaximumNeighbours=Slider(50, range=0..300),
    DieFrequency=Slider(10, range=0..20))
division_settings = ParticleDivisionSettings(
    Divide=Toggle(True),
    DivisionRange=Slider(3, range=0..5),
    MinimumNeighbours=Slider(1, range=0..10),
    MaximumNeighbours=Slider(50, range=0..200),
    DivFrequency=Slider(2, range=0..10))

particle_settings = ParticleSettings(
    ParticleTag="no tag",
    Speed=Slider(1, range=0..3),
    SensorDistance=Slider(2, range=0..20),
    SensorAngle=Slider(45, range=0..100),
    RotationAngle=Slider(45, range=0..100),
    Deposit=Slider(3, range=0..10))
particles = ConstructParticles(InitialParticles=reduce, ParticleTag="no tag")

trail_settings = ParticleTrailSettings(TrailSize=Slider(5, range=0..30), TrailFrequency=Slider(1, range=0..5))

voxel_settings = VoxelSettings(
    DiffuseRate=Slider(0.4, range=0..1),
    DiffuseRange=Slider(1, range=0..10),
    DecayRate=Slider(0.01, range=0..0.3),
    Wrap=Toggle(False))

trigger = Trigger(Interval=10, TimerInterval=10, Target=solver)  # disabled
solver = Nuclei2Solver(
    Reset=Toggle(True),
    Voxels=voxel_selection_union_2,
    Particles=flatten(particles),
    SolverSettings=flatten([voxel_settings, death_settings, division_settings, population_settings, trail_settings, particle_settings]))  # -> OutputParticles, OutputVoxels

# ---- group: Preview Particles
particle_positions = ExtractParticlePositions(Particles=solver.OutputParticles)
cloud = CloudDisplay(Points=particle_positions, Colours=RGB(255, 20, 147), Size=0.35, SpriteType=0)

# ----
trail_points = ExtractParticleTrails(Particles=solver.OutputParticles)  # disabled

# ---- group: Convert To Geometry
number_slider_3 = Slider(5, range=0..10)  # disabled
number_slider_4 = Slider(0.15, range=0..1)  # disabled
prune = PruneTree(Tree=trail_points, Minimum=number_slider_3, Maximum=0)  # disabled
vsettings = CreateSettings(VoxelSize=number_slider_4, Bandwidth=1, Isovalue=0, Adaptivity=0.1)  # disabled
intcrv = Interpolate(Vertices=prune, Degree=3, Periodic=False, KnotStyle=1)  # -> flatten(Curve), Length, Domain; disabled
null = NullItem(Item=intcrv.Curve)  # -> NullFlags, InvalidFlags, Description; disabled
number_slider_5 = Slider(0.24, range=0..10)  # disabled
cull = CullPattern(List=intcrv.Curve, CullPattern=invert(null.NullFlags))  # disabled
vcurve = CurveToVolume(Curves=flatten(cull), CurveRadius=number_slider_5, Settings=vsettings)  # disabled
mvolume = VolumeToMesh(Volume=vcurve, VolumeSettings=vsettings)  # disabled

# ----
lng_2 = ListLength(List=particle_positions)
panel = Panel(lng_2)

lng_3 = ListLength(List=trail_points)  # disabled
number_slider_6 = Slider(0.2, range=0..1)  # disabled
swatch = ColourSwatch(SwatchColor=RGB(105, 237, 255))  # disabled
swatch_2 = ColourSwatch(SwatchColor=RGB(255, 0, 255))  # disabled
range = Range(Domain=Domain(0, 1), Steps=expr("x-1", lng_3))  # disabled
gl_shader = GLShader(
    Vertex=trail_points,
    Vcolor1=swatch,
    Vcolor2=swatch_2,
    T=range,
    Alpha=number_slider_6,
    DepthTestingEnabled=False,
    DepthWritingEnabled=False,
    DrawMode=3,
    FragmentShader="""#version 330

in vec4 vertex_color;
out vec4 fragment_color;
uniform sampler2D _depthBuffer;
uniform vec2 _viewportSize;
float ndcDepth;

void main() {
    
  //vec2 uv = gl_FragCoord.xy / _viewportSize;
  
  //vec4 buffer = texture(_depthBuffer, uv);
  
  //ndcDepth  = ((2.0 * gl_FragCoord.z - 1) - gl_DepthRange.near - gl_DepthRange.far/2) / (gl_DepthRange.far - gl_DepthRange.near);

  fragment_color = vertex_color;

}""",
    GLShader=(0, 2, 0),
    PreviewSortOrder=2,
    VertexShader="""#version 330

layout(location = 0) in vec3 vertex;
layout(location = 1) in vec4 vcolor1;
layout(location = 2) in float t;
layout(location = 3) in vec4 vcolor2;
layout(location = 4) in float alpha;

uniform mat4 _worldToClip;
out vec4 vertex_color;
  

void main() {
  
  vertex_color.r = pow(t,2) * vcolor1.r + (1-pow(t,2))* vcolor2.r ;
  vertex_color.g = pow(t,2) * vcolor1.g + (1-pow(t,2))* vcolor2.g;
  vertex_color.b = pow(t,2) * vcolor1.b + (1-pow(t,2))* vcolor2.b;
  vertex_color.a = (1-t/3) * alpha;
  
  gl_Position = _worldToClip * vec4(vertex, 1.0);
}""",
    glLineWidth=1,
    glPointSize=1)  # -> Color, Depth; disabled

# ---- group: Preview Voxel Values
list_4 = ValueList({"Minimum Density": 0, "Maximum Density": 1, "Speed": 2, "Sensor Distance": 3, "Sensor Angle": 4, "Rotation Angle": 5, "Food": 6, "Density": 7}, selected="Speed")
voxel_centers_3 = ExtractVoxelPositions(Voxels=voxel_selection_union_2)
voxel_values_4 = ExtractVoxelValues(Voxels=voxel_selection_union_2, Type=list_4)

# ----
bnd_2 = Bounds(Numbers=voxel_values_4)
remap_2 = RemapNumbers(Value=voxel_values_4, Source=bnd_2, Target=Domain(0, 1))  # -> Mapped, Clipped

# ---- group: Preview Voxel Values (continued)
gradient = Gradient(LowerLimit=0, UpperLimit=1, Parameter=remap_2.Mapped, stops=[0: RGBA(255, 255, 255, 0), 1: RGB(220, 0, 40)])
cloud_2 = CloudDisplay(Points=voxel_centers_3, Colours=gradient, Size=1, SpriteType=0)
