# Grasshopper definition 01_Slime Intro.gh (Grasshopper 1.0.8)
# plug-ins: Nuclei3

# ---- group: Define Design Space
construct_voxels = ConstructVoxels(VoxelSize=1, XVoxels=Slider(500, range=0..1000), YVoxels=Slider(500, range=0..1000), ZVoxels=Slider(1, range=0..1))

# ----
construct_slime_particles = ConstructSlimeParticles(
    VoxelField=construct_voxels,
    ParticleCount=Slider(25000, range=0..100000),
    Speed=1.3,
    SensorDistance=6,
    SensorAngle=45,
    RotationAngle=45,
    Deposit=1,
    Wander=0,
    Colour=RGBA(220, 255, 0, 125))  # -> flatten(OutputParticleGroup)

voxel_settings_slime = VoxelSettingsSlime(
    DiffuseRate=Slider(0.15, range=0..1),
    DecayRate=Slider(0.03, range=0..1),
    Falloff=Slider(0, range=0..1),
    DiffuseRange=Slider(1, range=0..10),
    Input2StoresLegacyGradual=False,
    VoxelSettingsSlimeSchema=2)

trigger = Trigger(Interval=10, TimerInterval=10, Target=solver)  # disabled
solver = Nuclei3Solver(
    Reset=Toggle(False),
    Voxels=construct_voxels,
    Particles=flatten(construct_slime_particles),
    SolverSettings=flatten(voxel_settings_slime))  # -> OutputParticles, OutputVoxels

list = ValueList({"Minimum Density": 0, "Maximum Density": 1, "Speed": 2, "Sensor Distance": 3, "Sensor Angle": 4, "Rotation Angle": 5, "Slime Food": 6, "Slime Chemoattractants": 7, "Ant Food Pheromones": 8, "Ant Base Pheromones": 9, "Ant Pheromones": 10, "Ants and Slime": 11, "Ant Food": 13}, selected="Slime Chemoattractants")
particle_preview = ParticlePreviewSettings(Particles=solver.OutputParticles, PointSize=2)
preview_voxel_density = PreviewVoxelDensity(Voxels=solver.OutputVoxels, Type=list, MinimumTreshold=0, MaximumTreshold=100, Colour=RGBA(0, 0, 0, 0))
