# Grasshopper definition 06_Multiple Populations.gh (Grasshopper 1.0.8)
# plug-ins: Nuclei3

number_slider = Slider(500, range=0..1000)
construct_voxels = ConstructVoxels(VoxelSize=1, XVoxels=number_slider, YVoxels=number_slider, ZVoxels=1)

construct_slime_particles = ConstructSlimeParticles(
    VoxelField=construct_voxels,
    ParticleCount=Slider(6000, range=0..100000),
    Speed=Slider(1.6, range=0..10),
    SensorDistance=Slider(2, range=0..10),
    SensorAngle=Slider(75, range=0..180),
    RotationAngle=Slider(45, range=0..180),
    Deposit=Slider(5, range=0..5),
    Wander=Slider(0.7, range=0..1),
    Colour=ColourSwatch(SwatchColor=RGB(166, 230, 71)))  # -> flatten(OutputParticleGroup)

construct_slime_particles_2 = ConstructSlimeParticles(
    VoxelField=construct_voxels,
    ParticleCount=Slider(15000, range=0..100000),
    Speed=Slider(3, range=0..10),
    SensorDistance=Slider(10, range=0..10),
    SensorAngle=Slider(20, range=0..180),
    RotationAngle=Slider(20, range=0..180),
    Deposit=Slider(0.75, range=0..5),
    Wander=Slider(0, range=0..1),
    Colour=ColourSwatch(SwatchColor=RGB(222, 71, 230)))  # -> flatten(OutputParticleGroup)

voxel_settings_slime = VoxelSettingsSlime(
    DiffuseRate=Slider(0.6, range=0..1),
    DecayRate=Slider(0.01, range=0..1),
    Falloff=Slider(0.33, range=0..1),
    DiffuseRange=Slider(10, range=0..10),
    Input2StoresLegacyGradual=False,
    VoxelSettingsSlimeSchema=2)

voxel_wrap_settings = VoxelWrapSettings(Wrap=Toggle(False))

trigger = Trigger(Interval=-20, TimerInterval=20, Target=nuclei3_solver)
nuclei3_solver = Nuclei3Solver(
    Reset=Toggle(True),
    Voxels=construct_voxels,
    Particles=flatten([construct_slime_particles_2, construct_slime_particles]),
    SolverSettings=flatten([voxel_wrap_settings, voxel_settings_slime]))  # -> OutputParticles, OutputVoxels
particle_preview = ParticlePreview(Particles=nuclei3_solver.OutputParticles, PointSize=2)
