# Grasshopper definition 14_3D Intro.gh (Grasshopper 1.0.8)
# plug-ins: DendroGH, Nuclei3

# ---- group: Define Design Space
number_slider = Slider(200, range=0..200)
construct_voxels = ConstructVoxels(VoxelSize=1, XVoxels=number_slider, YVoxels=number_slider, ZVoxels=number_slider)

# ----
construct_slime_particles = ConstructSlimeParticles(
    VoxelField=construct_voxels,
    ParticleCount=Slider(20000, range=0..150000),
    Speed=Slider(1.5, range=0..10),
    SensorDistance=Slider(9, range=0..10),
    SensorAngle=Slider(45, range=0..180),
    RotationAngle=Slider(45, range=0..180),
    Deposit=Slider(3, range=0..5),
    Wander=Slider(0, range=0..1),
    Colour=RGBA(220, 255, 0, 125))  # -> flatten(OutputParticleGroup)

voxel_settings_slime = VoxelSettingsSlime(
    DiffuseRate=Slider(0.05, range=0..1),
    DecayRate=Slider(0.005, range=0..1),
    Falloff=Slider(1, range=0..1),
    DiffuseRange=Slider(1, range=0..10),
    Input2StoresLegacyGradual=False,
    VoxelSettingsSlimeSchema=2)

voxel_wrap_settings = VoxelWrapSettings(Wrap=Toggle(True))

trigger = Trigger(Interval=10, TimerInterval=10, Target=solver)  # disabled
solver = Nuclei3Solver(
    Reset=Toggle(True),
    Voxels=construct_voxels,
    Particles=flatten(construct_slime_particles),
    SolverSettings=flatten([voxel_settings_slime, voxel_wrap_settings]))  # -> OutputParticles, OutputVoxels
list = ValueList({"Minimum Density": 0, "Maximum Density": 1, "Speed": 2, "Sensor Distance": 3, "Sensor Angle": 4, "Rotation Angle": 5, "Slime Food": 6, "Slime Chemoattractants": 7, "Ant Food Pheromones": 8, "Ant Base Pheromones": 9, "Ant Pheromones": 10, "Ants and Slime": 11, "Ant Food": 13}, selected="Slime Chemoattractants")

list_2 = ValueList({"Minimum Density": 0, "Maximum Density": 1, "Speed": 2, "Sensor Distance": 3, "Sensor Angle": 4, "Rotation Angle": 5, "Slime Food": 6, "Slime Chemoattractants": 7, "Ant Food Pheromones": 8, "Ant Base Pheromones": 9, "Ant Pheromones": 10, "Ants and Slime": 11, "Ant Food": 13}, selected="Slime Chemoattractants")
preview_voxel_density = PreviewVoxelDensity(
    Voxels=solver.OutputVoxels,
    Type=list_2,
    MinimumTreshold=Slider(0.85, range=0..1),
    MaximumTreshold=100,
    Colour=RGBA(0, 0, 0, 0))

to_dendro = Nuclei3ToDendroVolume(Voxels=solver.OutputVoxels, Type=list, IsoValue=Slider(0.5, range=0..1), Convert=Toggle(False))
particle_preview = ParticlePreviewSettings(Particles=solver.OutputParticles, PointSize=2)
vsmooth = SmoothVolume(Volume=to_dendro, Width=1, Type=3, Iterations=Slider(5, range=0..10))
vsettings = CreateSettings(VoxelSize=Slider(0.5, range=0..1), Bandwidth=1, Isovalue=0, Adaptivity=0.1)
mvolume = VolumeToMesh(Volume=vsmooth, VolumeSettings=vsettings)
