# Grasshopper definition 18_Ants 3D Intro.gh (Grasshopper 1.0.8)
# plug-ins: Nuclei3

# ---- group: Define Design Space
number_slider = Slider(150, range=0..250)
construct_voxels = ConstructVoxels(VoxelSize=1, XVoxels=number_slider, YVoxels=number_slider, ZVoxels=number_slider)

# ----
voxel_box = ExtractVoxelBoundingBox(Voxels=construct_voxels)
area = Area(Geometry=voxel_box)  # -> Area, Centroid
attractor_point = Point(area.Centroid)
point_attractor = PointAttractorForVoxels(
    Voxels=construct_voxels,
    AttractorPoints=flatten(attractor_point),
    MinimumRange=0,
    MaximumRange=Slider(10, range=0..1000),
    InvertVoxelSelection=False,
    Average=False,
    Maximum=False,
    Minimum=True)  # -> OutputVoxels, OutputVoxelPositions, OutputDistancesToVoxels, OutputVoxelIndices

food_points = Point([Point(130.2252369, 31.07209084, 32.89464944), Point(31.16828468, 24.04365963, 17.14278351), Point(37.53780046, 118.048927, 104.8921734), Point(120.1218671, 131.4468739, 43.94768534), Point(106.5042816, 13.72065131, 126.9161659), Point(13.59720668, 54.13413072, 83.48019626)])
point_attractor_2 = PointAttractorForVoxels(
    Voxels=construct_voxels,
    AttractorPoints=flatten(food_points),
    MinimumRange=0,
    MaximumRange=Slider(5, range=0..1000),
    InvertVoxelSelection=False,
    Average=False,
    Maximum=False,
    Minimum=True)  # -> OutputVoxels, OutputVoxelPositions, OutputDistancesToVoxels, OutputVoxelIndices

lng = ListLength(List=point_attractor.OutputVoxelPositions)
multiplication = Multiplication(A=lng, B=Slider(0.66, range=0..1))
reduce = RandomReduce(List=point_attractor.OutputVoxelPositions, Reduction=multiplication, Seed=1)

particle_start_positions = Point(reduce)

falloff = Slider(0, range=0..1)
voxel_settings_ant = VoxelSettingsAnt(
    FoodPheromonesDiffuseRate=Slider(0.1, range=0..1),
    FoodDecayRate=Slider(0.0001, range=0..1),
    BasePheromonesDiffuseRate=Slider(0.1, range=0..1),
    BaseDecayRate=Slider(0.0003, range=0..1),
    Falloff=falloff,
    DiffuseRange=Slider(1, range=0..10))

list = ValueList({"Minimum Density": 0, "Maximum Density": 1, "Speed": 2, "Sensor Distance": 3, "Sensor Angle": 4, "Rotation Angle": 5, "Slime Food": 6, "Ant Food": 13}, selected="Ant Food")
voxel_values = DefineVoxelValues(Voxels=point_attractor_2.OutputVoxels, Type=list, MultiplierValue=Slider(1, range=0..5), ValueOrderMode=0)

ant_particles = ConstructAntParticles(
    VoxelField=construct_voxels,
    InitialParticlePositions=particle_start_positions,
    Speed=Slider(2, range=0..10),
    SensorDistance=Slider(9, range=0..10),
    SensorAngle=Slider(45, range=0..180),
    RotationAngle=Slider(45, range=0..180),
    Deposit=Slider(10, range=0..20),
    Wander=Slider(0.15, range=0..1),
    Colour=RGBA(66, 236, 122, 125))  # -> flatten(OutputParticleGroup)

voxel_selection_union = VoxelSelectionUnion(V1=construct_voxels, V2=voxel_values, Average=True, Maximum=False, Minimum=False)
trigger = Trigger(Interval=1, TimerInterval=5, Target=solver)  # disabled
solver = Nuclei3Solver(
    Reset=Toggle(True),
    Voxels=voxel_selection_union,
    Particles=flatten(ant_particles),
    SolverSettings=flatten(voxel_settings_ant))  # -> OutputParticles, OutputVoxels
list_2 = ValueList({"Minimum Density": 0, "Maximum Density": 1, "Speed": 2, "Sensor Distance": 3, "Sensor Angle": 4, "Rotation Angle": 5, "Slime Food": 6, "Slime Chemoattractants": 7, "Ant Food Pheromones": 8, "Ant Base Pheromones": 9, "Ant Pheromones": 10, "Ants and Slime": 11, "Ant Food": 13}, selected="Ants and Slime")
particle_preview = ParticlePreview(Particles=solver.OutputParticles, PointSize=2)
preview_voxel_density = PreviewVoxelDensity(
    Voxels=solver.OutputVoxels,
    Type=list_2,
    MinimumTreshold=Slider(0.43, range=0..1),
    MaximumTreshold=1,
    Colour=RGBA(0, 0, 0, 0))
