# Grasshopper definition 01_Slime Intro.gh (Grasshopper 1.0.9)
# plug-ins: Nuclei4

# ---- group: Define Design Space
number_slider = Slider(1000, range=0..1000)
construct_voxels = ConstructVoxels(VoxelSize=1, XVoxels=number_slider, YVoxels=number_slider, ZVoxels=Slider(1, range=0..1))

# ----
construct_slime_particles = ConstructSlimeParticles(
    VoxelField=construct_voxels,
    ParticleCount=Slider(50000, range=0..100000),
    Speed=Slider(1.3, range=0..20),
    SensorDistance=Slider(6, range=0..20),
    SensorAngle=Slider(45, range=0..180),
    RotationAngle=Slider(45, range=0..180),
    Deposit=Slider(1, range=0..5),
    Exploration=Slider(0, range=0..1),
    Colour=RGBA(220, 255, 0, 125),
    ProbabilisticSteering=False)  # -> flatten(OutputParticleGroup)

particle_trail_settings = ParticleTrailSettings(TrailSize=Slider(10, range=0..20))

voxel_settings_slime = VoxelSettingsSlime(
    DiffuseRate=Slider(0.15, range=0..1),
    DecayRate=Slider(0.03, range=0..1),
    Falloff=Slider(0, range=0..1),
    DiffuseRange=Slider(5, range=0..10),
    Input2StoresLegacyGradual=False,
    VoxelSettingsSlimeSchema=2)

trigger = Trigger(Interval=10, TimerInterval=10, Target=solver)  # disabled
solver = Nuclei3Solver(
    Reset=Toggle(True),
    Voxels=construct_voxels,
    Particles=flatten(construct_slime_particles),
    SolverSettings=flatten([voxel_settings_slime, particle_trail_settings]))  # -> OutputParticles, OutputVoxels, GPUStatus
particle_trail_preview = ParticleTrailPreview(Particles=solver.OutputParticles, Alpha=0.35, DepthFocus=0.55)
