# Grasshopper definition 04_Growth 1.gh (Grasshopper 1.0.9)
# plug-ins: Nuclei4

# ---- group: Define Design Space
construct_voxels = ConstructVoxels(VoxelSize=1, XVoxels=Slider(500, range=0..1000), YVoxels=Slider(500, range=0..1000), ZVoxels=Slider(1, range=0..1))

# ---- group: Extract Voxels According To Proximity To Point
voxel_box = ExtractVoxelBoundingBox(Voxels=construct_voxels)
area = Area(Geometry=voxel_box)  # -> Area, Centroid
point_attractor = PointAttractorForVoxels(
    Voxels=construct_voxels,
    AttractorPoints=flatten(area.Centroid),
    MinimumRange=0,
    MaximumRange=Slider(50, range=0..100),
    InvertVoxelSelection=False,
    Average=False,
    Maximum=False,
    Minimum=True)  # -> OutputVoxels, OutputVoxelPositions, OutputDistancesToVoxels, OutputVoxelIndices

# ----
voxel_position = Point(point_attractor.OutputVoxelPositions)

lng = ListLength(List=voxel_position)
multiplication = Multiplication(A=lng, B=Slider(0.8, range=0..1))
reduce = RandomReduce(List=voxel_position, Reduction=multiplication, Seed=1)

particle_start_positions = Point(reduce)

# ---- group: OUTSIDE This Range They Die
number_slider = Slider(20, range=0..100)
number_slider_2 = Slider(4, range=0..100)

# ---- group: INSIDE This Range They Divide
number_slider_3 = Slider(10, range=0..100)
number_slider_4 = Slider(2, range=0..100)

# ----
population_settings = ParticlePopulationSettings(
    MinimumPopulation=Slider(2000, range=0..10000),
    MaximumPopulation=Slider(50000, range=0..100000),
    RandomDivision=0,
    RandomDeath=0,
    Frequency=1)

construct_slime_particles = ConstructSlimeParticles(
    VoxelField=construct_voxels,
    InitialParticlePositions=particle_start_positions,
    ParticleCount=0,
    Speed=Slider(1, range=0..10),
    SensorDistance=Slider(3, range=0..10),
    SensorAngle=Slider(45, range=0..180),
    RotationAngle=Slider(45, range=0..180),
    Deposit=Slider(1.5, range=0..5),
    Wander=Slider(0, range=0..1),
    Colour=RGBA(220, 255, 0, 125))  # -> flatten(OutputParticleGroup)

division_settings = ParticleDivisionSettings(
    Divide=Toggle(True),
    MinimumAge=Slider(5, range=0..30),
    DivisionRange=Slider(3, range=0..10),
    MinimumNeighbours=number_slider_4,
    MaximumNeighbours=number_slider_3,
    DivFrequency=Slider(2, range=0..10))

death_settings = ParticleDeathSettings(
    Die=Toggle(True),
    MinimumAge=Slider(30, range=0..30),
    DieRange=Slider(3, range=0..10),
    MinimumNeighbours=number_slider_2,
    MaximumNeighbours=number_slider,
    DieFrequency=Slider(2, range=0..10))

voxel_settings_slime = VoxelSettingsSlime(
    DiffuseRate=Slider(0.25, range=0..1),
    DecayRate=Slider(0.03, range=0..1),
    Falloff=Slider(0.1, range=0..1),
    DiffuseRange=Slider(3, range=0..10),
    Input2StoresLegacyGradual=False,
    VoxelSettingsSlimeSchema=2)

particle_trail_settings = ParticleTrailSettings(TrailSize=Slider(10, range=0..10))

trigger = Trigger(Interval=10, TimerInterval=10, Target=solver)  # disabled
solver = Nuclei3Solver(
    Reset=Toggle(True),
    Voxels=construct_voxels,
    Particles=flatten(construct_slime_particles),
    SolverSettings=flatten([voxel_settings_slime, death_settings, division_settings, population_settings, particle_trail_settings]))  # -> OutputParticles, OutputVoxels
list = ValueList({"Minimum Density": 0, "Maximum Density": 1, "Speed": 2, "Sensor Distance": 3, "Sensor Angle": 4, "Rotation Angle": 5, "Slime Food": 6, "Slime Chemoattractants": 7, "Ant Food Pheromones": 8, "Ant Base Pheromones": 9, "Ant Pheromones": 10, "Ants and Slime": 11, "Ant Food": 13}, selected="Slime Chemoattractants")
particle_trail_preview = ParticleTrailPreview(Particles=solver.OutputParticles, Alpha=0.35, DepthFocus=0.55)
preview_voxel_density = PreviewVoxelDensity(
    Voxels=solver.OutputVoxels,
    Type=list,
    MinimumTreshold=0,
    MaximumTreshold=1,
    Colour=RGBA(0, 0, 0, 0),
    HighResolutionPreview=False)
