# Grasshopper definition 05_City Map.gh (Grasshopper 1.0.9)
# plug-ins: Nuclei4

# ---- group: Define Design Space
number_slider = Slider(1, range=0..1)
number_slider_2 = Slider(2000, range=0..3000)
construct_voxels = ConstructVoxels(VoxelSize=number_slider, XVoxels=number_slider_2, YVoxels=number_slider_2, ZVoxels=Slider(1, range=0..1))

# ---- group: Sample Image Values
expression = Expression(voxelSize=number_slider, resX=number_slider_2, Expression="voxelSize/resX")
expression_2 = Expression(voxelSize=number_slider, resY=number_slider_2, Expression="voxelSize/resY")
voxel_centers = ExtractVoxelPositions(Voxels=construct_voxels)
scale_nu = ScaleNU(Geometry=voxel_centers, Plane=PlaneXY(0, 0, 0), ScaleX=expression, ScaleY=expression_2, ScaleZ=1)  # -> Geometry, Transform
image = ImageSampler(scale_nu.Geometry, Filter="Value", Interpolate=False, Umax=1, Umin=0, Vmax=1, Vmin=0, Wrap=1)
image_2 = ImageSampler(scale_nu.Geometry, Filter="Value", Interpolate=False, Umax=1, Umin=0, Vmax=1, Vmin=0, Wrap=1)

# ---- group: Remap Values
bnd = Bounds(Numbers=image)
dom = ConstructDomain(DomainStart=Slider(0, range=0..1), DomainEnd=Slider(1, range=0..1))
remap = RemapNumbers(Value=image, Source=bnd, Target=dom)  # -> Mapped, Clipped

# ----
bnd_2 = Bounds(Numbers=image_2)
dom_2 = ConstructDomain(DomainStart=Slider(0, range=0..1), DomainEnd=Slider(1, range=0..1))
remap_2 = RemapNumbers(Value=image_2, Source=bnd_2, Target=dom_2)  # -> Mapped, Clipped

construct_slime_particles = ConstructSlimeParticles(
    VoxelField=construct_voxels,
    ParticleCount=Slider(100000, range=0..1000000),
    Speed=Slider(1.3, range=0..10),
    SensorDistance=Slider(10, range=0..20),
    SensorAngle=Slider(45, range=0..180),
    RotationAngle=Slider(45, range=0..180),
    Deposit=Slider(5, range=0..5),
    Exploration=Slider(0, range=0..1),
    Colour=RGBA(220, 255, 0, 125),
    ProbabilisticSteering=False)  # -> flatten(OutputParticleGroup)

voxel_settings_slime = VoxelSettingsSlime(
    DiffuseRate=Slider(0.25, range=0..1),
    DecayRate=Slider(0.01, range=0..1),
    Falloff=Slider(0.5, range=0..1),
    DiffuseRange=Slider(3, range=0..10),
    Input2StoresLegacyGradual=False,
    VoxelSettingsSlimeSchema=2)

nuclei4_solver_iterations = Nuclei4SolverIterations(Iterations=Slider(100, range=0..1000))

trail_settings = ParticleTrailSettings(TrailSize=Slider(10, range=0..100))

list = ValueList({"Minimum Density": 0, "Maximum Density": 1, "Speed": 2, "Sensor Distance": 3, "Sensor Angle": 4, "Rotation Angle": 5, "Slime Food": 6, "Ant Food": 13}, selected="Maximum Density")
remapped_values = Number(remap_2.Mapped)
voxel_values = DefineVoxelValues(Voxels=construct_voxels, Type=list, MultiplierValue=remapped_values)

voxel_wrap_settings = VoxelWrapSettings(Wrap=Toggle(False))

remapped_values_2 = Number(remap.Mapped)

list_2 = ValueList({"Minimum Density": 0, "Maximum Density": 1, "Speed": 2, "Sensor Distance": 3, "Sensor Angle": 4, "Rotation Angle": 5, "Slime Food": 6, "Ant Food": 13}, selected="Minimum Density")
voxel_values_2 = DefineVoxelValues(Voxels=construct_voxels, Type=list_2, MultiplierValue=remapped_values_2)

voxel_selection_union = VoxelSelectionUnion(V1=voxel_values_2, V2=voxel_values, Average=True, Maximum=False, Minimum=False)
solver = Nuclei3Solver(
    Reset=Toggle(True),
    Voxels=voxel_selection_union,
    Particles=flatten(construct_slime_particles),
    SolverSettings=flatten([voxel_wrap_settings, voxel_settings_slime, trail_settings, nuclei4_solver_iterations]))  # -> OutputParticles, OutputVoxels, GPUStatus
trigger = Trigger(Interval=1, TimerInterval=5, Target=solver)  # disabled
list_3 = ValueList({"Minimum Density": 0, "Maximum Density": 1, "Speed": 2, "Sensor Distance": 3, "Sensor Angle": 4, "Rotation Angle": 5, "Slime Food": 6, "Slime Chemoattractants": 7, "Ant Food Pheromones": 8, "Ant Base Pheromones": 9, "Ant Pheromones": 10, "Ants and Slime": 11, "Ant Food": 13}, selected="Maximum Density")
particle_trail_preview = ParticleTrailPreview(Particles=solver.OutputParticles, Alpha=0.35, DepthFocus=0.55)
preview_voxel_density = PreviewVoxelDensity(
    Voxels=voxel_selection_union,
    Type=list_3,
    MinimumTreshold=0,
    MaximumTreshold=1,
    Colour=ColourSwatch(SwatchColor=RGB(112, 112, 112)),
    HighResolutionPreview=False)
