# Grasshopper definition 08_Vector Fields 1.gh (Grasshopper 1.0.9)
# plug-ins: Nuclei4

# ---- group: Define Design Space
construct_voxels = ConstructVoxels(
    VoxelSize=Slider(1, range=0..1),
    XVoxels=Slider(800, range=0..1000),
    YVoxels=Slider(800, range=0..1000),
    ZVoxels=Slider(1, range=0..1))

# ----
voxel_box = ExtractVoxelBoundingBox(Voxels=construct_voxels)

construct_slime_particles = ConstructSlimeParticles(
    VoxelField=construct_voxels,
    ParticleCount=Slider(65000, range=0..100000),
    Speed=Slider(1.3, range=0..10),
    SensorDistance=Slider(6, range=0..10),
    SensorAngle=Slider(45, range=0..180),
    RotationAngle=Slider(45, range=0..180),
    Deposit=Slider(0.4, range=0..5),
    Exploration=Slider(0, range=0..1),
    Colour=RGBA(220, 255, 0, 125),
    ProbabilisticSteering=False)  # -> flatten(OutputParticleGroup)

iterations = Nuclei3SolverIterations(Iterations=Slider(300, range=0..300))

trail_settings = ParticleTrailSettings(TrailSize=Slider(5, range=0..100))

voxel_settings_slime = VoxelSettingsSlime(
    DiffuseRate=Slider(0.1, range=0..1),
    DecayRate=Slider(0.03, range=0..1),
    Falloff=Slider(0, range=0..1),
    DiffuseRange=Slider(1, range=0..10),
    Input2StoresLegacyGradual=False,
    VoxelSettingsSlimeSchema=2)

trigger = Trigger(Interval=10, TimerInterval=10, Target=solver)  # disabled

# ---- group: Extract Voxels Depending On Point Proximity
area = Area(Geometry=voxel_box)  # -> Area, Centroid

# ----
attractor_point = Point(area.Centroid)

# ---- group: Extract Voxels Depending On Point Proximity (continued)
point_attractor = PointAttractorForVoxels(
    Voxels=construct_voxels,
    AttractorPoints=flatten(attractor_point),
    MinimumRange=Slider(50, range=0..100),
    MaximumRange=Slider(300, range=0..1000),
    InvertVoxelSelection=False,
    Average=False,
    Maximum=False,
    Minimum=True)  # -> OutputVoxels, OutputVoxelPositions, OutputDistancesToVoxels, OutputVoxelIndices

# ----
distance_values = Number(point_attractor.OutputDistancesToVoxels)
voxel_position = Point(point_attractor.OutputVoxelPositions)

# ---- group: Graph Values
bnd = Bounds(Numbers=distance_values)
remap = RemapNumbers(Value=distance_values, Source=bnd, Target=Domain(0, 1))  # -> Mapped, Clipped
graph = GraphMapper(remap.Mapped, x0=0, x1=1, y0=0, y1=1, container_name="Bezier", cpx=[0, 0.6939393878, 0.6484848261, 1], cpy=[0, 0, 1, 1])

# ----
grapped_values = Number(graph)
attractor_point_2 = Point(attractor_point)

# ---- group: Remap Values
dom = ConstructDomain(DomainStart=Slider(1.5, range=0..100), DomainEnd=Slider(0, range=0..1))
remap_2 = RemapNumbers(Value=grapped_values, Source=Domain(0, 1), Target=dom)  # -> Mapped, Clipped

# ---- group: Create Vectors
voxel_position_2 = Point(voxel_position)
vec2pt = Vector2Pt(PointA=voxel_position_2, PointB=attractor_point_2, Unitize=True)  # -> Vector, Length
multiplication = Multiplication(A=vec2pt.Vector, B=remap_2.Mapped)
move = Move(Geometry=voxel_position_2, Motion=multiplication)  # -> Geometry, Transform

# ---- group: Remap Values
dom_2 = ConstructDomain(DomainStart=Slider(1, range=0..10), DomainEnd=Slider(10, range=0..100))
remap_3 = RemapNumbers(Value=grapped_values, Source=Domain(0, 1), Target=dom_2)  # -> Mapped, Clipped

# ---- group: Preview Vectors
ln = Line(StartPoint=voxel_position_2, EndPoint=move.Geometry)

# ----
voxel_vectors = DefineVoxelVectors(Voxels=point_attractor.OutputVoxels, VoxelVector=flatten(multiplication), Frequency=flatten(remap_3.Mapped))
voxel_selection_union = VoxelSelectionUnion(V1=construct_voxels, V2=voxel_vectors, Average=True, Maximum=False, Minimum=False)
solver = Nuclei3Solver(
    Reset=Toggle(True),
    Voxels=voxel_selection_union,
    Particles=flatten(construct_slime_particles),
    SolverSettings=flatten([voxel_settings_slime, trail_settings, iterations]))  # -> OutputParticles, OutputVoxels, GPUStatus
particle_trail_preview = ParticleTrailPreview(Particles=solver.OutputParticles, Alpha=0.35, DepthFocus=0.55)
