# Grasshopper definition 09_City Map + Multiple Populations.gh (Grasshopper 1.0.9)
# plug-ins: Nuclei4

# ---- group: Define Design Space
number_slider = Slider(3000, range=0..3000)
construct_voxels = ConstructVoxels(VoxelSize=Slider(1, range=0..1), XVoxels=number_slider, YVoxels=number_slider, ZVoxels=Slider(1, range=0..1))

# ----
list = ValueList({"Minimum Density": 0, "Maximum Density": 1, "Speed": 2, "Sensor Distance": 3, "Sensor Angle": 4, "Rotation Angle": 5, "Slime Food": 6, "Ant Food": 13}, selected="Minimum Density")
list_2 = ValueList({"Minimum Density": 0, "Maximum Density": 1, "Speed": 2, "Sensor Distance": 3, "Sensor Angle": 4, "Rotation Angle": 5, "Slime Food": 6, "Ant Food": 13}, selected="Maximum Density")
image_mapper = ImageMapperForVoxels(
    Voxels=construct_voxels,
    Type=list,
    TargetStart=Slider(0, range=0..1),
    TargetEnd=Slider(0.5, range=0..1),
    MapImageName="city-3000x3000.png")
image_mapper_2 = ImageMapperForVoxels(Voxels=construct_voxels, Type=list_2, TargetStart=0, TargetEnd=1, MapImageName="river-3000x3000.png")
voxel_selection_union = VoxelSelectionUnion(V1=image_mapper, V2=image_mapper_2, Average=True, Maximum=False, Minimum=False)

construct_slime_particles = ConstructSlimeParticles(
    VoxelField=construct_voxels,
    ParticleCount=Slider(100000, range=0..1000000),
    Speed=Slider(1.5, range=0..10),
    SensorDistance=Slider(10, range=0..20),
    SensorAngle=Slider(45, range=0..180),
    RotationAngle=Slider(45, range=0..180),
    Deposit=Slider(3, range=0..10),
    Wander=Slider(0, range=0..1),
    Colour=RGBA(220, 255, 0, 125))  # -> flatten(OutputParticleGroup)

construct_slime_particles_2 = ConstructSlimeParticles(
    VoxelField=construct_voxels,
    ParticleCount=Slider(10000, range=0..1000000),
    Speed=Slider(6, range=0..10),
    SensorDistance=Slider(20, range=0..20),
    SensorAngle=Slider(45, range=0..180),
    RotationAngle=Slider(45, range=0..180),
    Deposit=Slider(5, range=0..10),
    Wander=Slider(0, range=0..1),
    Colour=ColourSwatch(SwatchColor=RGB(0, 255, 217)))  # -> flatten(OutputParticleGroup)

voxel_settings_slime = VoxelSettingsSlime(
    DiffuseRate=Slider(0.05, range=0..1),
    DecayRate=Slider(0.005, range=0..0.1),
    Falloff=Slider(0.5, range=0..1),
    DiffuseRange=Slider(1, range=0..10),
    Input2StoresLegacyGradual=False,
    VoxelSettingsSlimeSchema=2)

nuclei4_solver_iterations = Nuclei4SolverIterations(Iterations=Slider(500, range=0..1000))

trail_settings = ParticleTrailSettings(TrailSize=Slider(20, range=0..20))

voxel_wrap_settings = VoxelWrapSettings(Wrap=Toggle(False))

solver = Nuclei3Solver(
    Reset=Toggle(True),
    Voxels=voxel_selection_union,
    Particles=flatten([construct_slime_particles, construct_slime_particles_2]),
    SolverSettings=flatten([voxel_wrap_settings, voxel_settings_slime, trail_settings, nuclei4_solver_iterations]))  # -> OutputParticles, OutputVoxels
trigger = Trigger(Interval=1, TimerInterval=5, Target=solver)  # disabled
list_3 = ValueList({"Minimum Density": 0, "Maximum Density": 1, "Speed": 2, "Sensor Distance": 3, "Sensor Angle": 4, "Rotation Angle": 5, "Slime Food": 6, "Slime Chemoattractants": 7, "Ant Food Pheromones": 8, "Ant Base Pheromones": 9, "Ant Pheromones": 10, "Ants and Slime": 11, "Ant Food": 13}, selected="Minimum Density")
particle_trail_preview = ParticleTrailPreview(Particles=solver.OutputParticles, Alpha=0.35, DepthFocus=0.55)
preview_voxel_density = PreviewVoxelDensity(
    Voxels=voxel_selection_union,
    Type=list_3,
    MinimumTreshold=0,
    MaximumTreshold=1,
    Colour=ColourSwatch(SwatchColor=RGB(41, 41, 41)),
    HighResolutionPreview=False)
