# Grasshopper definition 09_Vector Fields 2.gh (Grasshopper 1.0.9)
# plug-ins: Nuclei4

# ---- group: Define Design Space
construct_voxels = ConstructVoxels(
    VoxelSize=Slider(1, range=0..1),
    XVoxels=Slider(800, range=0..1000),
    YVoxels=Slider(800, range=0..1000),
    ZVoxels=Slider(1, range=0..1))

# ----
attractor_points = Point([Point(676.5771253, 646.4616545, 0), Point(188.8536009, 301.7356033, 0), Point(294.8249426, 568.5791022, 0), Point(603.8016256, 248.1115509, 0)])

# ---- group: Extract Voxels Depending On Point Proximity
point_attractor = PointAttractorForVoxels(
    Voxels=construct_voxels,
    AttractorPoints=flatten(attractor_points),
    MinimumRange=0,
    MaximumRange=Slider(500, range=0..1000),
    InvertVoxelSelection=False,
    Average=False,
    Maximum=False,
    Minimum=True)  # -> OutputVoxels, OutputVoxelPositions, OutputDistancesToVoxels, OutputVoxelIndices

# ---- group: Create Vector Field
pcharge = PointCharge(Point=attractor_points, Charge=Slider(-20, range=-100..100), Decay=Slider(1, range=0..1))
mergef = MergeFields(Fields=pcharge)

# ---- group: Preview Field
voxel_box = ExtractVoxelBoundingBox(Voxels=construct_voxels)
pop2d = Populate2D(Region=voxel_box, Count=100, Seed=1)
preview_field = FieldLine(Field=mergef, Point=pop2d, Steps=1000, Accuracy=0.1, Method=3)

# ----
distance_values = Number(point_attractor.OutputDistancesToVoxels)
voxel_position = Point(point_attractor.OutputVoxelPositions)
voxel_indices = Integer(point_attractor.OutputVoxelIndices)

bnd = Bounds(Numbers=distance_values)
dom = ConstructDomain(DomainStart=Slider(1, range=0..5), DomainEnd=Slider(10, range=0..10))
remap = RemapNumbers(Value=distance_values, Source=bnd, Target=dom)  # -> Mapped, Clipped
remapped_value = Number(remap.Mapped)

# ---- group: Extract Vectors From Vector Field
evf = EvaluateField(Field=mergef, Point=voxel_position)  # -> Tensor, Strength

# ---- group: Preview Vectors
move = Move(Geometry=voxel_position, Motion=evf.Tensor)  # -> Geometry, Transform
ln = Line(StartPoint=voxel_position, EndPoint=move.Geometry)

# ----
sort = SortList(Keys=flatten(voxel_indices), ValuesA=flatten(evf.Tensor))  # -> Keys, ValuesA
sort_2 = SortList(Keys=flatten(voxel_indices), ValuesA=flatten(remapped_value))  # -> Keys, ValuesA
uniform_frequency = Slider(3, range=0..10)

construct_slime_particles = ConstructSlimeParticles(
    VoxelField=construct_voxels,
    ParticleCount=Slider(65000, range=0..100000),
    Speed=Slider(1.3, range=0..10),
    SensorDistance=Slider(6, range=0..10),
    SensorAngle=Slider(45, range=0..180),
    RotationAngle=Slider(45, range=0..180),
    Deposit=Slider(0.4, range=0..5),
    Exploration=Slider(0, range=0..1),
    Colour=RGBA(220, 255, 0, 125),
    ProbabilisticSteering=False)  # -> flatten(OutputParticleGroup)

sorted_frequency_values = Number(sort_2.ValuesA)

iterations = Nuclei3SolverIterations(Iterations=Slider(200, range=0..300))

particle_trail_settings = ParticleTrailSettings(TrailSize=Slider(5, range=0..100))

voxel_settings_slime = VoxelSettingsSlime(
    DiffuseRate=Slider(0.1, range=0..1),
    DecayRate=Slider(0.03, range=0..1),
    Falloff=Slider(0.5, range=0..1),
    DiffuseRange=Slider(1, range=0..10),
    Input2StoresLegacyGradual=False,
    VoxelSettingsSlimeSchema=2)

sorted_vectors = Vector(sort.ValuesA)

voxel_wrap_settings = VoxelWrapSettings(Wrap=Toggle(True))

voxel_vectors = DefineVoxelVectors(Voxels=point_attractor.OutputVoxels, VoxelVector=flatten(sorted_vectors), Frequency=flatten(sorted_frequency_values))
voxel_selection_union = VoxelSelectionUnion(V1=construct_voxels, V2=voxel_vectors, Average=True, Maximum=False, Minimum=False)
solver = Nuclei3Solver(
    Reset=Toggle(True),
    Voxels=voxel_selection_union,
    Particles=flatten(construct_slime_particles),
    SolverSettings=flatten([voxel_wrap_settings, voxel_settings_slime, iterations, particle_trail_settings]))  # -> OutputParticles, OutputVoxels, GPUStatus
trigger = Trigger(Interval=10, TimerInterval=10, Target=solver)  # disabled
particle_trail_preview = ParticleTrailPreview(Particles=solver.OutputParticles, Alpha=0.35, DepthFocus=0.55)
