# Grasshopper definition 10_Multiple Populations.gh (Grasshopper 1.0.9)
# plug-ins: Nuclei4

number_slider = Slider(1000, range=0..1000)
construct_voxels = ConstructVoxels(VoxelSize=1, XVoxels=number_slider, YVoxels=number_slider, ZVoxels=1)

construct_slime_particles = ConstructSlimeParticles(
    VoxelField=construct_voxels,
    ParticleCount=Slider(12000, range=0..100000),
    Speed=Slider(1.6, range=0..10),
    SensorDistance=Slider(2, range=0..10),
    SensorAngle=Slider(75, range=0..180),
    RotationAngle=Slider(45, range=0..180),
    Deposit=Slider(5, range=0..10),
    Exploration=Slider(0.7, range=0..1),
    Colour=ColourSwatch(SwatchColor=RGB(191, 255, 0)),
    ProbabilisticSteering=False)  # -> flatten(OutputParticleGroup)

construct_slime_particles_2 = ConstructSlimeParticles(
    VoxelField=construct_voxels,
    ParticleCount=Slider(30000, range=0..100000),
    Speed=Slider(3, range=0..10),
    SensorDistance=Slider(10, range=0..10),
    SensorAngle=Slider(20, range=0..180),
    RotationAngle=Slider(20, range=0..180),
    Deposit=Slider(0.75, range=0..5),
    Exploration=Slider(0, range=0..1),
    Colour=ColourSwatch(SwatchColor=RGB(222, 71, 230)),
    ProbabilisticSteering=False)  # -> flatten(OutputParticleGroup)

particle_trail_settings = ParticleTrailSettings(TrailSize=Slider(3, range=0..10))

voxel_settings_slime = VoxelSettingsSlime(
    DiffuseRate=Slider(0.6, range=0..1),
    DecayRate=Slider(0.01, range=0..1),
    Falloff=Slider(0.33, range=0..1),
    DiffuseRange=Slider(10, range=0..30),
    Input2StoresLegacyGradual=False,
    VoxelSettingsSlimeSchema=2)

voxel_wrap_settings = VoxelWrapSettings(Wrap=Toggle(False))

trigger = Trigger(Interval=20, TimerInterval=20, Target=nuclei3_solver)  # disabled
nuclei3_solver = Nuclei3Solver(
    Reset=Toggle(True),
    Voxels=construct_voxels,
    Particles=flatten([construct_slime_particles_2, construct_slime_particles]),
    SolverSettings=flatten([voxel_wrap_settings, voxel_settings_slime, particle_trail_settings]))  # -> OutputParticles, OutputVoxels, GPUStatus
list = ValueList({"Minimum Density": 0, "Maximum Density": 1, "Speed": 2, "Sensor Distance": 3, "Sensor Angle": 4, "Rotation Angle": 5, "Slime Food": 6, "Ant Food": 13, "Slime Chemoattractants": 7, "Ant Food Pheromones": 8, "Ant Base Pheromones": 9, "Ant Pheromones": 10, "Ants and Slime": 11}, selected="Slime Chemoattractants")
particle_trail_preview = ParticleTrailPreview(Particles=nuclei3_solver.OutputParticles, Alpha=0.35, DepthFocus=0.55)
voxel_preview = VoxelPreview(
    Voxels=nuclei3_solver.OutputVoxels,
    Type=list,
    MinimumTreshold=0,
    MaximumTreshold=1,
    Colour=RGBA(0, 0, 0, 0),
    HighResolutionPreview=False)
