# Grasshopper definition 15_Function Voxels.gh (Grasshopper 1.0.9)
# plug-ins: MeshEdit Components, Nuclei4, DendroGH

# ---- group: Define Design Space
number_slider = Slider(300, range=0..1000)
construct_voxels = ConstructVoxels(VoxelSize=1, XVoxels=number_slider, YVoxels=number_slider, ZVoxels=number_slider)

# ----
# Connect this Custom Formula to the custom input: Math.Sin(x*x) + Math.Sin(y*y) + Math.Sin(z*z)
number_slider_2 = Slider(7, range=0..10)
list = ValueList({"Gyroid": 1, "Schwarz D": 2, "Schwarz G": 3, "Schwarz P": 4, "Neovius": 5, "Diamond": 6, "P W Hybrid": 7, "IWP": 9, "Fischer-Koch S": 10, "Lidinoid": 11, "Twisted Sheets": 12, "Interference Field": 14, "Tanglecube": 15, "Trefoil Knot": 16, "Warped Caves": 18}, selected="Gyroid")
function_attractor = FunctionAttractor(
    Voxels=construct_voxels,
    Surface=list,
    Scale=Slider(9, range=0..20),
    IsoValue=0,
    MinimumRange=0,
    MaximumRange=number_slider_2,
    FunctionAttractorInputOrder=1)  # -> OutputVoxels, OutputVoxelPositions, OutputVoxelIndices

# ---- group: Convert To Mesh
number_slider_3 = Slider(1, range=0..1)  # disabled
list_2 = ValueList({"Minimum Density": 0, "Maximum Density": 1, "Speed": 2, "Sensor Distance": 3, "Sensor Angle": 4, "Rotation Angle": 5, "Slime Food": 6, "Ant Food": 13}, selected="Minimum Density")  # disabled
number_slider_4 = Slider(50000000, range=0..100000000)  # disabled
define_voxel_values = DefineVoxelValues(Voxels=function_attractor.OutputVoxels, Type=list_2, MultiplierValue=number_slider_3)  # disabled
toggle = BooleanToggle(True)  # disabled
list_3 = ValueList({"Continuous": 0, "Discrete": 1}, selected="Continuous")  # disabled
nuclei4_to_dendro_volume = Nuclei4ToDendroVolume(
    Voxels=define_voxel_values,
    Type=list_2,
    IsoValue=0.8,
    Method=list_3,
    MaximumElements=number_slider_4,
    Update=toggle,
    SmoothingIterations=1)  # disabled
number_slider_5 = Slider(20, range=0..20)  # disabled
vsettings = CreateSettings(VoxelSize=number_slider_5, Bandwidth=1, Isovalue=0, Adaptivity=0.1)  # disabled
mvolume = VolumeToMesh(Volume=nuclei4_to_dendro_volume, VolumeSettings=vsettings)  # disabled
unifynormals = MeshUnifyNormals(Mesh=mvolume)  # disabled

# ----
construct_slime_particles = ConstructSlimeParticles(
    VoxelField=function_attractor.OutputVoxels,
    ParticleCount=Slider(100000, range=0..100000),
    Speed=Slider(1.3, range=0..20),
    SensorDistance=Slider(6, range=0..20),
    SensorAngle=Slider(45, range=0..180),
    RotationAngle=Slider(45, range=0..180),
    Deposit=Slider(5, range=0..10),
    Wander=Slider(0, range=0..1),
    Colour=RGBA(220, 255, 0, 125))  # -> flatten(OutputParticleGroup)

particle_trail_settings = ParticleTrailSettings(TrailSize=Slider(10, range=0..20))

voxel_settings_slime = VoxelSettingsSlime(
    DiffuseRate=Slider(0.1, range=0..1),
    DecayRate=Slider(0.005, range=0..0.1),
    Falloff=Slider(0, range=0..1),
    DiffuseRange=Slider(6, range=0..10),
    Input2StoresLegacyGradual=False,
    VoxelSettingsSlimeSchema=2)

mesh = Mesh(unifynormals)  # disabled
trigger = Trigger(Interval=10, TimerInterval=10, Target=solver)  # disabled
solver = Nuclei3Solver(
    Reset=Toggle(True),
    Voxels=function_attractor.OutputVoxels,
    Particles=flatten(construct_slime_particles),
    SolverSettings=flatten([voxel_settings_slime, particle_trail_settings]))  # -> OutputParticles, OutputVoxels, GPUStatus
list_4 = ValueList({"Minimum Density": 0, "Maximum Density": 1, "Speed": 2, "Sensor Distance": 3, "Sensor Angle": 4, "Rotation Angle": 5, "Slime Food": 6, "Ant Food": 13, "Slime Chemoattractants": 7, "Ant Food Pheromones": 8, "Ant Base Pheromones": 9, "Ant Pheromones": 10, "Ants and Slime": 11}, selected="Slime Chemoattractants")
particle_trail_preview = ParticleTrailPreview(Particles=solver.OutputParticles, Alpha=0.35, DepthFocus=0.55)
voxel_preview = VoxelPreview(
    Voxels=solver.OutputVoxels,
    Type=list_4,
    MinimumTreshold=0,
    MaximumTreshold=1,
    Colour=RGBA(0, 0, 0, 0),
    HighResolutionPreview=False)
