# Grasshopper definition 17_Ants Complex.gh (Grasshopper 1.0.9)
# plug-ins: Nuclei4

# ---- group: Define Design Space
construct_voxels = ConstructVoxels(VoxelSize=1, XVoxels=Slider(800, range=0..1000), YVoxels=Slider(800, range=0..1000), ZVoxels=Slider(1, range=0..1))

# ----
food_points = Point([Point(712.2134248, 483.8924501, 0), Point(28.90970505, 658.8512655, 0)])
point_attractor = PointAttractorForVoxels(
    Voxels=construct_voxels,
    AttractorPoints=flatten(food_points),
    MinimumRange=0,
    MaximumRange=Slider(5, range=0..1000),
    InvertVoxelSelection=False,
    Average=False,
    Maximum=False,
    Minimum=True)  # -> OutputVoxels, OutputVoxelPositions, OutputDistancesToVoxels, OutputVoxelIndices

food_curve = Curve(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)
curve_attractor = CurveAttractorForVoxels(
    Voxels=construct_voxels,
    AttractorCurves=flatten(food_curve),
    MinimumRange=0,
    MaximumRange=Slider(2, range=0..10),
    InvertVoxelSelection=False,
    Average=False,
    Maximum=False,
    Minimum=True)  # -> OutputVoxels, OutputVoxelPositions, OutputDistancesToVoxels, OutputVoxelIndices

max_density_points = Point([Point(421.5338182, 211.1220136, 0), Point(174.9383226, 379.1926866, 0), Point(498.6810124, 629.9210677, 0)])
point_attractor_2 = PointAttractorForVoxels(
    Voxels=construct_voxels,
    AttractorPoints=flatten(max_density_points),
    MinimumRange=0,
    MaximumRange=Slider(50, range=0..1000),
    InvertVoxelSelection=False,
    Average=False,
    Maximum=False,
    Minimum=True)  # -> OutputVoxels, OutputVoxelPositions, OutputDistancesToVoxels, OutputVoxelIndices

attractor_point = Point(Point(407.7575335, 63.71576764, 0))
point_attractor_3 = PointAttractorForVoxels(
    Voxels=construct_voxels,
    AttractorPoints=flatten(attractor_point),
    MinimumRange=0,
    MaximumRange=Slider(40, range=0..1000),
    InvertVoxelSelection=False,
    Average=False,
    Maximum=False,
    Minimum=True)  # -> OutputVoxels, OutputVoxelPositions, OutputDistancesToVoxels, OutputVoxelIndices

lng = ListLength(List=point_attractor_3.OutputVoxelPositions)
multiplication = Multiplication(A=lng, B=Slider(0.75, range=0..1))
reduce = RandomReduce(List=point_attractor_3.OutputVoxelPositions, Reduction=multiplication, Seed=1)

particle_start_positions = Point(reduce)

falloff = Slider(0, range=0..1)
voxel_settings_ant = VoxelSettingsAnt(
    FoodPheromonesDiffuseRate=Slider(0.15, range=0..1),
    FoodDecayRate=Slider(0.001, range=0..1),
    BasePheromonesDiffuseRate=Slider(0.1, range=0..1),
    BaseDecayRate=Slider(0.003, range=0..1),
    Falloff=falloff,
    DiffuseRange=Slider(2, range=0..10))

ant_particles = ConstructAntParticles(
    VoxelField=construct_voxels,
    InitialParticlePositions=particle_start_positions,
    Speed=Slider(3, range=0..10),
    SensorDistance=Slider(9, range=0..10),
    SensorAngle=Slider(45, range=0..180),
    RotationAngle=Slider(45, range=0..180),
    Deposit=Slider(8, range=0..100),
    Wander=Slider(0.1, range=0..1),
    Colour=RGBA(66, 236, 122, 125))  # -> flatten(OutputParticleGroup)

list = ValueList({"Minimum Density": 0, "Maximum Density": 1, "Speed": 2, "Sensor Distance": 3, "Sensor Angle": 4, "Rotation Angle": 5, "Slime Food": 6, "Ant Food": 13}, selected="Maximum Density")
voxel_values = DefineVoxelValues(Voxels=point_attractor_2.OutputVoxels, Type=list, MultiplierValue=Slider(0, range=0..100))

list_2 = ValueList({"Minimum Density": 0, "Maximum Density": 1, "Speed": 2, "Sensor Distance": 3, "Sensor Angle": 4, "Rotation Angle": 5, "Slime Food": 6, "Ant Food": 13}, selected="Ant Food")

voxel_values_2 = DefineVoxelValues(Voxels=point_attractor.OutputVoxels, Type=list_2, MultiplierValue=Slider(2, range=0..10))

list_3 = ValueList({"Minimum Density": 0, "Maximum Density": 1, "Speed": 2, "Sensor Distance": 3, "Sensor Angle": 4, "Rotation Angle": 5, "Slime Food": 6, "Ant Food": 13}, selected="Ant Food")

voxel_values_3 = DefineVoxelValues(Voxels=curve_attractor.OutputVoxels, Type=list_3, MultiplierValue=Slider(1, range=0..10))

voxel_selection_union = VoxelSelectionUnion(V1=construct_voxels, V2=voxel_values_2, V3=voxel_values_3, V4=voxel_values, Average=True, Maximum=False, Minimum=False)
trigger = Trigger(Interval=10, TimerInterval=10, Target=solver)  # disabled
solver = Nuclei3Solver(
    Reset=Toggle(True),
    Voxels=voxel_selection_union,
    Particles=flatten(ant_particles),
    SolverSettings=flatten(voxel_settings_ant))  # -> OutputParticles, OutputVoxels
list_4 = ValueList({"Minimum Density": 0, "Maximum Density": 1, "Speed": 2, "Sensor Distance": 3, "Sensor Angle": 4, "Rotation Angle": 5, "Slime Food": 6, "Ant Food": 13, "Slime Chemoattractants": 7, "Ant Food Pheromones": 8, "Ant Base Pheromones": 9, "Ant Pheromones": 10, "Ants and Slime": 11}, selected="Ants and Slime")
particle_preview = ParticlePreview(Particles=solver.OutputParticles, PointSize=2)
preview_voxel_density = PreviewVoxelDensity(
    Voxels=solver.OutputVoxels,
    Type=list_4,
    MinimumTreshold=0,
    MaximumTreshold=1,
    Colour=RGBA(0, 0, 0, 0),
    HighResolutionPreview=False)
