# Grasshopper definition 02_Gradient Map_v3.gh (Grasshopper 1.0.8)
# plug-ins: MeshEdit Components, ghgl, Nuclei4

# ---- group: Define Design Space
number_slider = Slider(1, range=0..1)
number_slider_2 = Slider(1000, range=0..1000)
number_slider_3 = Slider(500, range=0..1000)
construct_voxels = ConstructVoxels(VoxelSize=number_slider, XVoxels=number_slider_2, YVoxels=number_slider_3, ZVoxels=Slider(1, range=0..1))

# ---- group: Sample Image Values
voxel_centers = ExtractVoxelPositions(Voxels=construct_voxels)
expression = Expression(voxelSize=number_slider, resX=number_slider_2, Expression="voxelSize/resX")
expression_2 = Expression(voxelSize=number_slider, resY=number_slider_3, Expression="voxelSize/resY")
scale_nu = ScaleNU(Geometry=voxel_centers, Plane=PlaneXY(0, 0, 0), ScaleX=expression, ScaleY=expression_2, ScaleZ=1)  # -> Geometry, Transform
image = ImageSampler(scale_nu.Geometry, Filter="Value", Interpolate=False, Umax=1, Umin=0, Vmax=1, Vmin=0, Wrap=1)

# ----
image_sampler_values = Number(image)

# ---- group: Remap Values
number_slider_4 = Slider(0.5, range=0..1)
number_slider_5 = Slider(2, range=0..10)
bnd = Bounds(Numbers=image_sampler_values)
dom = ConstructDomain(DomainStart=number_slider_4, DomainEnd=number_slider_5)
remap = RemapNumbers(Value=image_sampler_values, Source=bnd, Target=dom)  # -> Mapped, Clipped

# ----
number_slider_6 = Slider(6, range=0..10)
number_slider_7 = Slider(45, range=0..180)
number_slider_8 = Slider(50000, range=0..100000)
number_slider_9 = Slider(45, range=0..180)
number_slider_10 = Slider(0, range=0..1)
number_slider_11 = Slider(1, range=0..5)
number_slider_12 = Slider(1.3, range=0..10)
construct_slime_particles = ConstructSlimeParticles(
    VoxelField=construct_voxels,
    ParticleCount=number_slider_8,
    Speed=number_slider_12,
    SensorDistance=number_slider_6,
    SensorAngle=number_slider_9,
    RotationAngle=number_slider_7,
    Deposit=number_slider_11,
    Exploration=number_slider_10,
    Colour=RGBA(220, 255, 0, 125),
    ProbabilisticSteering=False)  # -> flatten(OutputParticleGroup)

number_slider_13 = Slider(25, range=0..100)
trail_settings = ParticleTrailSettings(TrailSize=number_slider_13)

number_slider_14 = Slider(100, range=0..100)
iterations = Nuclei3SolverIterations(Iterations=number_slider_14)

number_slider_15 = Slider(0, range=0..1)

number_slider_16 = Slider(0.1, range=0..1)
number_slider_17 = Slider(1, range=0..10)
number_slider_18 = Slider(0.03, range=0..1)
voxel_settings_slime = VoxelSettingsSlime(DiffuseRate=number_slider_16, DecayRate=number_slider_18, Falloff=number_slider_15, DiffuseRange=number_slider_17)

remapped_voxel_value = Number(remap.Mapped)
list = ValueList({"Minimum Density": 0, "Maximum Density": 1, "Speed": 2, "Sensor Distance": 3, "Sensor Angle": 4, "Rotation Angle": 5, "Slime Food": 6, "Ant Food": 13}, selected="Sensor Distance")
voxel_values = DefineVoxelValues(Voxels=construct_voxels, Type=list, MultiplierValue=remapped_voxel_value, ValueOrderMode=0)

voxel_wrap_settings = VoxelWrapSettings(Wrap=Toggle(True))

toggle = BooleanToggle(True)
trigger = Trigger(Interval=10, TimerInterval=10, Target=[solver, c_script])  # disabled
solver = Nuclei3Solver(
    Reset=toggle,
    Voxels=voxel_values,
    Particles=flatten(construct_slime_particles),
    SolverSettings=flatten([voxel_wrap_settings, voxel_settings_slime, iterations, trail_settings]))  # -> OutputParticles, OutputVoxels, GPUStatus
list_2 = ValueList({"Minimum Density": 0, "Maximum Density": 1, "Speed": 2, "Sensor Distance": 3, "Sensor Angle": 4, "Rotation Angle": 5, "Slime Food": 6, "Slime Chemoattractants": 7, "Ant Food Pheromones": 8, "Ant Base Pheromones": 9, "Ant Pheromones": 10, "Ants and Slime": 11, "Ant Food": 13}, selected="Slime Chemoattractants")

panel = Panel("""Minimum Density
Maximum Density
Speed
Sensor Distance
Sensor Angle
Rotation Angle
Food""")
expression_3 = Expression(start=number_slider_4, end=number_slider_5, Expression="\"Domain: \" & start & \" to \" & end")  # -> flatten(R)
item = ListItem(List=panel, Index=0, Wrap=True)
expression_4 = Expression(x=item, Expression="\"Value Type: \" & x")  # -> flatten(R)

expression_5 = Expression(resX=number_slider_2, resY=number_slider_3, Expression="\"Voxel Resolution: \" & resX & \" x \" & resY")  # -> flatten(R)
expression_6 = Expression(x=number_slider_17, Expression="\"Diffuse Range: \" & x")  # -> flatten(R)
expression_7 = Expression(x=number_slider_16, Expression="\"Diffuse Rate: \" & x")  # -> flatten(R)
expression_8 = Expression(x=number_slider_18, Expression="\"Decay Rate: \" & x")  # -> flatten(R)
expression_9 = Expression(x=number_slider_15, Expression="\"Falloff: \" & x")  # -> flatten(R)

c_script = CSharpScript(reset=toggle, maxIterations=number_slider_14)  # -> out, A; inputs reset: Boolean, maxIterations: Int32
# ---------- c_script: C# ----------
// Grasshopper Script Instance
#region Usings
using System;
using System.Linq;
using System.Collections;
using System.Collections.Generic;
using System.Drawing;

using Rhino;
using Rhino.Geometry;

using Grasshopper;
using Grasshopper.Kernel;
using Grasshopper.Kernel.Data;
using Grasshopper.Kernel.Types;
#endregion

public class Script_Instance : GH_ScriptInstance
{
    #region Notes
    /* 
      Members:
        RhinoDoc RhinoDocument
        GH_Document GrasshopperDocument
        IGH_Component Component
        int Iteration

      Methods (Virtual & overridable):
        Print(string text)
        Print(string format, params object[] args)
        Reflect(object obj)
        Reflect(object obj, string method_name)
    */
    #endregion

    private void RunScript(bool reset, int maxIterations, ref object A)
    {
           if(reset == true)
    {
      x = 0;
    }else
    {
      if(x < maxIterations)
        x += 1;
    }

    A = x;
    }

      int x = 0;
}
# ---------- end c_script ----------
expression_10 = Expression(x=c_script.A, Expression="\"Iterations: \" & x")  # -> flatten(R)

Y = UnitY(Factor=expr("x+20", number_slider_3))

# ---- group: Display Gradient
overlap = BooleanToggle(False)
vec = VectorXYZ(XComponent=0, YComponent=0, ZComponent=0)  # -> Vector, Length
merge = Merge(Data1=Y, Data2=vec.Vector)
gradient = Gradient(
    LowerLimit=number_slider_4,
    UpperLimit=number_slider_5,
    Parameter=remap.Mapped,
    stops=[0: RGB(0, 0, 0), 1: RGB(255, 255, 255)])
item_2 = ListItem(List=merge, Index=overlap, Wrap=True)
move = Move(Geometry=voxel_centers, Motion=item_2)  # -> Geometry, Transform
frompoints = MeshFromPoints(Points=move.Geometry, UDirection=number_slider_2, VDirection=number_slider_3, Colour=gradient)
demesh = DeconstructMesh(Mesh=frompoints)  # -> Vertices, Faces, Colours, Normals
partition = PartitionList(List=demesh.Vertices, Size=number_slider_3)  # -> simplify(Chunks)
partition_2 = PartitionList(List=demesh.Colours, Size=number_slider_3)  # -> simplify(Chunks)
tstat = TreeStatistics(Tree=partition)  # -> Paths, Length, Count
number_slider_19 = Slider(100, range=0..100)
partition_3 = PartitionList(List=tstat.Paths, Size=number_slider_19)
item_3 = ListItem(List=partition_3, Index=0, Wrap=True)
branch = TreeBranch(Tree=partition, Path=item_3, MaintainPaths=True)
branch_2 = TreeBranch(Tree=partition_2, Path=item_3, MaintainPaths=True)
partition_4 = PartitionList(List=branch, Size=number_slider_19)
partition_5 = PartitionList(List=branch_2, Size=number_slider_19)
item_4 = ListItem(List=partition_4, Index=0, Wrap=True)  # -> flatten(Item)
item_5 = ListItem(List=partition_5, Index=0, Wrap=True)  # -> flatten(Item)
devec = DeconstructVector(Vector=item_5)  # -> XComponent, YComponent, ZComponent
vec_2 = VectorXYZ(XComponent=expr("x/2", number_slider_19), YComponent=expr("x/2", number_slider_19), ZComponent=0)  # -> Vector, Length
bnd_2 = Bounds(Numbers=devec.XComponent)
move_2 = Move(Geometry=item_4, Motion=vec_2.Vector)  # -> Geometry, Transform
remap_2 = RemapNumbers(Value=devec.XComponent, Source=bnd_2, Target=dom)  # -> Mapped, Clipped
expression_11 = Expression(x=remap_2.Mapped, Expression="Floor(x*100)/100")
c_invert_color = CSharpScript(x=item_5)  # -> out, A; inputs x: list of Color
# ---------- c_invert_color: C# ----------
    List <System.Drawing.Color> colors = new List <System.Drawing.Color> ();

    byte offset = 40;

    for(int i = 0; i < x.Count; i++)
    {
      System.Drawing.Color c = x[i];
      byte r = c.R;
      byte g = c.G;
      byte b = c.B;

      byte newR = (byte) (255 - r);
      byte newG = (byte) (255 - g);
      byte newB = (byte) (255 - b);

      if(Math.Abs(r - newR) < 10) newR += offset;
      if(Math.Abs(g - newG) < 10) newG += offset;
      if(Math.Abs(b - newB) < 10) newB += offset;

      System.Drawing.Color c1 = System.Drawing.Color.FromArgb(newR, newG, newB);
      colors.Add(c1);
    }

    A = colors;
# ---------- end c_invert_color ----------
tag = TextTag3D(Location=move_2.Geometry, Text=expression_11, Size=10, Colour=c_invert_color.A, Justification=5)

# ---- group: Extract Particle Trails
trail_points = ExtractParticleTrails(Particles=solver.OutputParticles)  # disabled
lng = ListLength(List=trail_points)
range = Range(Domain=Domain(0, 1), Steps=expr("x-1", lng))
gl_shader = GLShader(
    Vertex=trail_points,
    Vcolor1=ColourSwatch(SwatchColor=RGB(105, 237, 255)),
    Vcolor2=ColourSwatch(SwatchColor=RGB(255, 0, 255)),
    T=range,
    Alpha=Slider(0.35, range=0..1),
    DepthTestingEnabled=False,
    DepthWritingEnabled=False,
    DrawMode=3,
    FragmentShader="""#version 330

in vec4 vertex_color;
out vec4 fragment_color;
uniform sampler2D _depthBuffer;
uniform vec2 _viewportSize;
float ndcDepth;

void main() {
    
  //vec2 uv = gl_FragCoord.xy / _viewportSize;
  
  //vec4 buffer = texture(_depthBuffer, uv);
  
  //ndcDepth  = ((2.0 * gl_FragCoord.z - 1) - gl_DepthRange.near - gl_DepthRange.far/2) / (gl_DepthRange.far - gl_DepthRange.near);

  fragment_color = vertex_color;

}""",
    GLShader=(0, 2, 0),
    PreviewSortOrder=2,
    VertexShader="""#version 330

layout(location = 0) in vec3 vertex;
layout(location = 1) in vec4 vcolor1;
layout(location = 2) in float t;
layout(location = 3) in vec4 vcolor2;
layout(location = 4) in float alpha;

uniform mat4 _worldToClip;
out vec4 vertex_color;
  

void main() {
  
  vertex_color.r = pow(t,2) * vcolor1.r + (1-pow(t,2))* vcolor2.r ;
  vertex_color.g = pow(t,2) * vcolor1.g + (1-pow(t,2))* vcolor2.g;
  vertex_color.b = pow(t,2) * vcolor1.b + (1-pow(t,2))* vcolor2.b;
  vertex_color.a = (1-t/3) * alpha;
  
  gl_Position = _worldToClip * vec4(vertex, 1.0);
}""",
    glLineWidth=1,
    glPointSize=1)  # -> Color, Depth

# ----
particle_preview = ParticlePreviewSettings(Particles=solver.OutputParticles, PointSize=2)
preview_voxel_density = PreviewVoxelDensity(Voxels=solver.OutputVoxels, Type=list_2, MinimumTreshold=0, MaximumTreshold=100, Colour=RGBA(0, 0, 0, 0))

expression_12 = Expression(x=number_slider_6, Expression="\"Sensor Distance: \" & x")  # -> flatten(R)
expression_13 = Expression(x=Slider(1, range=0..10), Expression="\"Trail Frequency: \" & x")  # -> flatten(R)
expression_14 = Expression(x=number_slider_8, Expression="\"Particle Count: \" & x")  # -> flatten(R)
expression_15 = Expression(x=number_slider_7, Expression="\"Rotation Angle: \" & x")  # -> flatten(R)
expression_16 = Expression(x=number_slider_9, Expression="\"Sensor Angle: \" & x")  # -> flatten(R)
expression_17 = Expression(x=number_slider_10, Expression="\"Exploration: \" & x")  # -> flatten(R)
expression_18 = Expression(x=number_slider_13, Expression="\"Trail Size: \" & x")  # -> flatten(R)
expression_19 = Expression(x=number_slider_11, Expression="\"Deposit: \" & x")  # -> flatten(R)
expression_20 = Expression(x=number_slider_12, Expression="\"Speed: \" & x")  # -> flatten(R)

panel_2 = Panel("----------------------------------")
merge_2 = Merge(
    Data1=panel_2,
    Data2="VOXEL SETTINGS:",
    Data3=panel_2,
    Data4=expression_5,
    Data5=expression_7,
    Data6=expression_8,
    Data7=expression_9,
    Data8=expression_6,
    Data9=panel_2,
    Data10="MAP SETTINGS:",
    Data11=panel_2,
    Data12=expression_4,
    Data13=expression_3,
    Data14=panel_2,
    Data15="PARTICLE SETTINGS:",
    Data16=panel_2,
    Data17=expression_14,
    Data18=expression_20,
    Data19=expression_12,
    Data20=expression_16,
    Data21=expression_15,
    Data22=expression_19,
    Data23=expression_17,
    Data24=expression_18,
    Data25=expression_13,
    Data26=panel_2,
    Data27="SOLVER SETTINGS:",
    Data28=panel_2,
    Data29=expression_10)
panel_3 = Panel(merge_2)
number_slider_20 = Slider(20, range=0..100)
lng_2 = ListLength(List=panel_3)
series = Series(Start=number_slider_20, Step=number_slider_20, Count=lng_2)
pt = ConstructPoint(XCoordinate=Slider(220, range=0..1000, expression="-x"), YCoordinate=expr("2*x+30", number_slider_3), ZCoordinate=0)
Y_2 = UnitY(Factor=series)  # -> expr("-x", UnitVector)
move_3 = Move(Geometry=pt, Motion=Y_2)  # -> Geometry, Transform
tag_2 = TextTag3D(Location=move_3.Geometry, Text=panel_3, Size=10, Colour=ColourSwatch(SwatchColor=RGB(255, 255, 255)), Justification=7)
