# Grasshopper definition 05_City Map_v3.gh (Grasshopper 1.0.8)
# plug-ins: ghgl, Nuclei4

# ---- group: Define Design Space
number_slider = Slider(1, range=0..1)
number_slider_2 = Slider(1000, range=0..3000)
number_slider_3 = Slider(1000, range=0..3000)
construct_voxels = ConstructVoxels(VoxelSize=number_slider, XVoxels=number_slider_2, YVoxels=number_slider_3, ZVoxels=Slider(1, range=0..1))

# ---- group: Sample Image Values
expression = Expression(voxelSize=number_slider, resX=number_slider_2, Expression="voxelSize/resX")
expression_2 = Expression(voxelSize=number_slider, resY=number_slider_3, Expression="voxelSize/resY")
voxel_centers = ExtractVoxelPositions(Voxels=construct_voxels)
scale_nu = ScaleNU(Geometry=voxel_centers, Plane=PlaneXY(0, 0, 0), ScaleX=expression, ScaleY=expression_2, ScaleZ=1)  # -> Geometry, Transform
image = ImageSampler(
    scale_nu.Geometry,
    FilePath="C:\Users\madal\OneDrive\Desktop\map.jpg",
    Filter="Value",
    Interpolate=False,
    Umax=1,
    Umin=0,
    Vmax=1,
    Vmin=0,
    Wrap=1)

# ---- group: Remap Values
bnd = Bounds(Numbers=image)
dom = ConstructDomain(DomainStart=Slider(0, range=0..1), DomainEnd=Slider(0.6, range=0..1))
remap = RemapNumbers(Value=image, Source=bnd, Target=dom)  # -> Mapped, Clipped

# ----
number_slider_4 = Slider(1, range=0..10)
trail_settings = ParticleTrailSettings(TrailSize=Slider(15, range=0..100))

voxel_settings_slime = VoxelSettingsSlime(
    DiffuseRate=Slider(0.1, range=0..1),
    DecayRate=Slider(0.03, range=0..1),
    Falloff=Slider(0.5, range=0..1),
    DiffuseRange=Slider(2, range=0..10))

voxel_wrap_settings = VoxelWrapSettings(Wrap=Toggle(False))

remapped_values = Number(remap.Mapped)

list = ValueList({"Minimum Density": 0, "Maximum Density": 1, "Speed": 2, "Sensor Distance": 3, "Sensor Angle": 4, "Rotation Angle": 5, "Slime Food": 6, "Ant Food": 13}, selected="Minimum Density")
voxel_values = DefineVoxelValues(Voxels=construct_voxels, Type=list, MultiplierValue=remapped_values, ValueOrderMode=0)

construct_slime_particles = ConstructSlimeParticles(
    VoxelField=voxel_values,
    ParticleCount=Slider(75000, range=0..1000000),
    Speed=Slider(1.5, range=0..10),
    SensorDistance=Slider(6, range=0..10),
    SensorAngle=Slider(45, range=0..180),
    RotationAngle=Slider(45, range=0..180),
    Deposit=Slider(0.5, range=0..5),
    Exploration=Slider(0, range=0..1),
    Colour=RGBA(220, 255, 0, 125),
    ProbabilisticSteering=False)  # -> flatten(OutputParticleGroup)

solver = Nuclei3Solver(
    Reset=Toggle(True),
    Voxels=voxel_values,
    Particles=flatten(construct_slime_particles),
    SolverSettings=flatten([voxel_wrap_settings, voxel_settings_slime, trail_settings]))  # -> OutputParticles, OutputVoxels, GPUStatus
trigger = Trigger(Interval=10, TimerInterval=10, Target=solver)  # disabled

# ---- group: Extract Particle Trails
trail_points = ExtractParticleTrails(Particles=solver.OutputParticles)  # disabled
lng = ListLength(List=trail_points)
range = Range(Domain=Domain(0, 1), Steps=expr("x-1", lng))
gl_shader = GLShader(
    Vertex=trail_points,
    Vcolor1=ColourSwatch(SwatchColor=RGB(105, 237, 255)),
    Vcolor2=ColourSwatch(SwatchColor=RGB(255, 0, 255)),
    T=range,
    Alpha=Slider(0.35, range=0..1),
    DepthTestingEnabled=False,
    DepthWritingEnabled=False,
    DrawMode=3,
    FragmentShader="""#version 330

in vec4 vertex_color;
out vec4 fragment_color;
uniform sampler2D _depthBuffer;
uniform vec2 _viewportSize;
float ndcDepth;

void main() {
    
  //vec2 uv = gl_FragCoord.xy / _viewportSize;
  
  //vec4 buffer = texture(_depthBuffer, uv);
  
  //ndcDepth  = ((2.0 * gl_FragCoord.z - 1) - gl_DepthRange.near - gl_DepthRange.far/2) / (gl_DepthRange.far - gl_DepthRange.near);

  fragment_color = vertex_color;

}""",
    GLShader=(0, 2, 0),
    PreviewSortOrder=2,
    VertexShader="""#version 330

layout(location = 0) in vec3 vertex;
layout(location = 1) in vec4 vcolor1;
layout(location = 2) in float t;
layout(location = 3) in vec4 vcolor2;
layout(location = 4) in float alpha;

uniform mat4 _worldToClip;
out vec4 vertex_color;
  

void main() {
  
  vertex_color.r = pow(t,2) * vcolor1.r + (1-pow(t,2))* vcolor2.r ;
  vertex_color.g = pow(t,2) * vcolor1.g + (1-pow(t,2))* vcolor2.g;
  vertex_color.b = pow(t,2) * vcolor1.b + (1-pow(t,2))* vcolor2.b;
  vertex_color.a = (1-t/3) * alpha;
  
  gl_Position = _worldToClip * vec4(vertex, 1.0);
}""",
    glLineWidth=1,
    glPointSize=1)  # -> Color, Depth

# ----
list_2 = ValueList({"Minimum Density": 0, "Maximum Density": 1, "Speed": 2, "Sensor Distance": 3, "Sensor Angle": 4, "Rotation Angle": 5, "Slime Food": 6, "Slime Chemoattractants": 7, "Ant Food Pheromones": 8, "Ant Base Pheromones": 9, "Ant Pheromones": 10, "Ants and Slime": 11, "Ant Food": 13}, selected="Minimum Density")
particle_preview = ParticlePreviewSettings(Particles=solver.OutputParticles, PointSize=2)
preview_voxel_density = PreviewVoxelDensity(Voxels=voxel_values, Type=list_2, MinimumTreshold=0, MaximumTreshold=1, Colour=ColourSwatch(SwatchColor=RGB(46, 46, 46)))
