# Grasshopper definition 06_Attractor Curves 1_v3.gh (Grasshopper 1.0.8)
# plug-ins: ghgl, Nuclei4

# ---- group: Define Design Space
number_slider = Slider(800, range=0..1000)
construct_voxels = ConstructVoxels(
    VoxelSize=Slider(1, range=0..1),
    XVoxels=number_slider,
    YVoxels=Slider(800, range=0..1000),
    ZVoxels=Slider(1, range=0..1))

# ---- group: Create Concentric Circles
voxel_box = ExtractVoxelBoundingBox(Voxels=construct_voxels)
expression = Expression(x=number_slider, Expression="x/2")
volume = Volume(Geometry=voxel_box)  # -> Volume, Centroid
dom = ConstructDomain(DomainStart=Slider(0.1, range=0..0.1), DomainEnd=expression)
number_slider_2 = Slider(7, range=0..30)
range = Range(Domain=dom, Steps=number_slider_2)
circle = CircleCNR(Center=volume.Centroid, Normal=Vector(0, 0, 1), Radius=range)  # -> simplify(graft(Circle))

# ---- group: Extract Voxels Depending On Closest Curve
curve_attractor = CurveAttractorForVoxels(
    Voxels=construct_voxels,
    AttractorCurves=flatten(circle),
    MinimumRange=0,
    MaximumRange=Slider(5, range=0..100),
    InvertVoxelSelection=False,
    Average=False,
    Maximum=False,
    Minimum=True)  # -> OutputVoxels, OutputVoxelPositions, OutputDistancesToVoxels, OutputVoxelIndices

# ----
distance_values = Number(curve_attractor.OutputDistancesToVoxels)
voxel_indices = Integer(curve_attractor.OutputVoxelIndices)

# ---- group: Remap Values
bnd = Bounds(Numbers=distance_values)
dom_2 = ConstructDomain(DomainStart=Slider(1, range=0..1), DomainEnd=Slider(0.05, range=0..1))
range_2 = Range(Domain=dom_2, Steps=number_slider_2)
dom_3 = ConstructDomain(DomainStart=range_2, DomainEnd=Slider(0, range=0..1))  # -> graft(Domain)
remap = RemapNumbers(Value=distance_values, Source=bnd, Target=dom_3)  # -> Mapped, Clipped

# ----
remapped_voxel_value = Number(flatten(remap.Mapped))
voxel_indices_2 = Integer(flatten(voxel_indices))
sort = SortList(Keys=voxel_indices_2, ValuesA=remapped_voxel_value)  # -> Keys, ValuesA
sorted_remapped_voxel_value = Number(flatten(sort.ValuesA))

construct_slime_particles = ConstructSlimeParticles(
    VoxelField=construct_voxels,
    ParticleCount=Slider(100000, range=0..100000),
    Speed=Slider(1.3, range=0..10),
    SensorDistance=Slider(6, range=0..10),
    SensorAngle=Slider(30, range=0..180),
    RotationAngle=Slider(60, range=0..180),
    Deposit=Slider(0.75, range=0..5),
    Exploration=Slider(0, range=0..1),
    Colour=RGBA(220, 255, 0, 125),
    ProbabilisticSteering=False)  # -> flatten(OutputParticleGroup)

number_slider_3 = Slider(1, range=0..10)
trail_settings = ParticleTrailSettings(TrailSize=Slider(15, range=0..100))

voxel_settings_slime = VoxelSettingsSlime(
    DiffuseRate=Slider(0.1, range=0..1),
    DecayRate=Slider(0.03, range=0..1),
    Falloff=Slider(0.5, range=0..1),
    DiffuseRange=Slider(1, range=0..10))

list = ValueList({"Minimum Density": 0, "Maximum Density": 1, "Speed": 2, "Sensor Distance": 3, "Sensor Angle": 4, "Rotation Angle": 5, "Slime Food": 6, "Ant Food": 13}, selected="Minimum Density")
voxel_values = DefineVoxelValues(Voxels=curve_attractor.OutputVoxels, Type=list, MultiplierValue=sorted_remapped_voxel_value, ValueOrderMode=0)

voxel_values_2 = DefineVoxelValues(Voxels=curve_attractor.OutputVoxels, Type=list, MultiplierValue=sorted_remapped_voxel_value, ValueOrderMode=0)
preview_voxel_density = PreviewVoxelDensity(Voxels=voxel_values, Type=list, MinimumTreshold=0, MaximumTreshold=1, Colour=RGBA(0, 0, 0, 0))
voxel_selection_union = VoxelSelectionUnion(V1=construct_voxels, V2=voxel_values, Average=True, Maximum=False, Minimum=False)
trigger = Trigger(Interval=10, TimerInterval=10, Target=solver)  # disabled
solver = Nuclei3Solver(
    Reset=Toggle(True),
    Voxels=voxel_selection_union,
    Particles=flatten(construct_slime_particles),
    SolverSettings=flatten([voxel_settings_slime, trail_settings]))  # -> OutputParticles, OutputVoxels, GPUStatus
particle_preview = ParticlePreviewSettings(Particles=solver.OutputParticles, PointSize=2)

particle_positions = ExtractParticlePositions(Particles=solver.OutputParticles)  # disabled
lng = ListLength(List=particle_positions)
range_3 = Range(Domain=Domain(0, 1), Steps=expr("x-1", lng))
gl_shader = GLShader(
    Vertex=particle_positions,
    Vcolor1=ColourSwatch(SwatchColor=RGB(105, 237, 255)),
    Vcolor2=ColourSwatch(SwatchColor=RGB(255, 0, 255)),
    T=range_3,
    Alpha=Slider(0.35, range=0..1),
    DepthTestingEnabled=False,
    DepthWritingEnabled=False,
    DrawMode=3,
    FragmentShader="""#version 330

in vec4 vertex_color;
out vec4 fragment_color;
uniform sampler2D _depthBuffer;
uniform vec2 _viewportSize;
float ndcDepth;

void main() {
    
  //vec2 uv = gl_FragCoord.xy / _viewportSize;
  
  //vec4 buffer = texture(_depthBuffer, uv);
  
  //ndcDepth  = ((2.0 * gl_FragCoord.z - 1) - gl_DepthRange.near - gl_DepthRange.far/2) / (gl_DepthRange.far - gl_DepthRange.near);

  fragment_color = vertex_color;

}""",
    GLShader=(0, 2, 0),
    PreviewSortOrder=2,
    VertexShader="""#version 330

layout(location = 0) in vec3 vertex;
layout(location = 1) in vec4 vcolor1;
layout(location = 2) in float t;
layout(location = 3) in vec4 vcolor2;
layout(location = 4) in float alpha;

uniform mat4 _worldToClip;
out vec4 vertex_color;
  

void main() {
  
  vertex_color.r = pow(t,2) * vcolor1.r + (1-pow(t,2))* vcolor2.r ;
  vertex_color.g = pow(t,2) * vcolor1.g + (1-pow(t,2))* vcolor2.g;
  vertex_color.b = pow(t,2) * vcolor1.b + (1-pow(t,2))* vcolor2.b;
  vertex_color.a = (1-t/3) * alpha;
  
  gl_Position = _worldToClip * vec4(vertex, 1.0);
}""",
    glLineWidth=1,
    glPointSize=1)  # -> Color, Depth
