# Grasshopper definition 08_Vector Fields 1_v3.gh (Grasshopper 1.0.8)
# plug-ins: ghgl, Nuclei4

# ---- group: Define Design Space
construct_voxels = ConstructVoxels(
    VoxelSize=Slider(1, range=0..1),
    XVoxels=Slider(800, range=0..1000),
    YVoxels=Slider(800, range=0..1000),
    ZVoxels=Slider(1, range=0..1))

# ----
voxel_box = ExtractVoxelBoundingBox(Voxels=construct_voxels)

construct_slime_particles = ConstructSlimeParticles(
    VoxelField=construct_voxels,
    ParticleCount=Slider(65000, range=0..100000),
    Speed=Slider(1.3, range=0..10),
    SensorDistance=Slider(6, range=0..10),
    SensorAngle=Slider(45, range=0..180),
    RotationAngle=Slider(45, range=0..180),
    Deposit=Slider(0.4, range=0..5),
    Exploration=Slider(0, range=0..1),
    Colour=RGBA(220, 255, 0, 125),
    ProbabilisticSteering=False)  # -> flatten(OutputParticleGroup)

number_slider = Slider(1, range=0..10)
trail_settings = ParticleTrailSettings(TrailSize=Slider(15, range=0..100))

iterations = Nuclei3SolverIterations(Iterations=Slider(100, range=0..300))

voxel_settings_slime = VoxelSettingsSlime(
    DiffuseRate=Slider(0.1, range=0..1),
    DecayRate=Slider(0.03, range=0..1),
    Falloff=Slider(0, range=0..1),
    DiffuseRange=Slider(1, range=0..10))

trigger = Trigger(Interval=10, TimerInterval=10, Target=solver)  # disabled

# ---- group: Extract Voxels Depending On Point Proximity
area = Area(Geometry=voxel_box)  # -> Area, Centroid

# ----
attractor_point = Point(area.Centroid)

# ---- group: Extract Voxels Depending On Point Proximity (continued)
point_attractor = PointAttractorForVoxels(
    Voxels=construct_voxels,
    AttractorPoints=flatten(attractor_point),
    MinimumRange=Slider(50, range=0..100),
    MaximumRange=Slider(300, range=0..1000),
    InvertVoxelSelection=False,
    Average=False,
    Maximum=False,
    Minimum=True)  # -> OutputVoxels, OutputVoxelPositions, OutputDistancesToVoxels, OutputVoxelIndices

# ----
distance_values = Number(point_attractor.OutputDistancesToVoxels)
voxel_position = Point(point_attractor.OutputVoxelPositions)

# ---- group: Graph Values
bnd = Bounds(Numbers=distance_values)
remap = RemapNumbers(Value=distance_values, Source=bnd, Target=Domain(0, 1))  # -> Mapped, Clipped
graph = GraphMapper(remap.Mapped, x0=0, x1=1, y0=0, y1=1, container_name="Bezier", cpx=[0, 0.6939393878, 0.6484848261, 1], cpy=[0, 0, 1, 1])

# ----
grapped_values = Number(graph)
attractor_point_2 = Point(attractor_point)

# ---- group: Remap Values
dom = ConstructDomain(DomainStart=Slider(1.5, range=0..100), DomainEnd=Slider(0, range=0..1))
remap_2 = RemapNumbers(Value=grapped_values, Source=Domain(0, 1), Target=dom)  # -> Mapped, Clipped

# ---- group: Create Vectors
voxel_position_2 = Point(voxel_position)
vec2pt = Vector2Pt(PointA=voxel_position_2, PointB=attractor_point_2, Unitize=True)  # -> Vector, Length
multiplication = Multiplication(A=vec2pt.Vector, B=remap_2.Mapped)
move = Move(Geometry=voxel_position_2, Motion=multiplication)  # -> Geometry, Transform

# ---- group: Remap Values
dom_2 = ConstructDomain(DomainStart=Slider(1, range=0..10), DomainEnd=Slider(10, range=0..100))
remap_3 = RemapNumbers(Value=grapped_values, Source=Domain(0, 1), Target=dom_2)  # -> Mapped, Clipped

# ---- group: Preview Vectors
ln = Line(StartPoint=voxel_position_2, EndPoint=move.Geometry)

# ----
voxel_vectors = DefineVoxelVectors(Voxels=point_attractor.OutputVoxels, VoxelVector=flatten(multiplication), Frequency=flatten(remap_3.Mapped))
voxel_selection_union = VoxelSelectionUnion(V1=construct_voxels, V2=voxel_vectors, Average=True, Maximum=False, Minimum=False)
solver = Nuclei3Solver(
    Reset=Toggle(True),
    Voxels=voxel_selection_union,
    Particles=flatten(construct_slime_particles),
    SolverSettings=flatten([voxel_settings_slime, trail_settings, iterations]))  # -> OutputParticles, OutputVoxels, GPUStatus

# ---- group: Extract Particle Trails
trail_points = ExtractParticleTrails(Particles=solver.OutputParticles)  # disabled
lng = ListLength(List=trail_points)  # disabled
number_slider_2 = Slider(0.35, range=0..1)  # disabled
range = Range(Domain=Domain(0, 1), Steps=expr("x-1", lng))  # disabled
swatch = ColourSwatch(SwatchColor=RGB(105, 237, 255))  # disabled
swatch_2 = ColourSwatch(SwatchColor=RGB(255, 0, 255))  # disabled
gl_shader = GLShader(
    Vertex=trail_points,
    Vcolor1=swatch,
    Vcolor2=swatch_2,
    T=range,
    Alpha=number_slider_2,
    DepthTestingEnabled=False,
    DepthWritingEnabled=False,
    DrawMode=3,
    FragmentShader="""#version 330

in vec4 vertex_color;
out vec4 fragment_color;
uniform sampler2D _depthBuffer;
uniform vec2 _viewportSize;
float ndcDepth;

void main() {
    
  //vec2 uv = gl_FragCoord.xy / _viewportSize;
  
  //vec4 buffer = texture(_depthBuffer, uv);
  
  //ndcDepth  = ((2.0 * gl_FragCoord.z - 1) - gl_DepthRange.near - gl_DepthRange.far/2) / (gl_DepthRange.far - gl_DepthRange.near);

  fragment_color = vertex_color;

}""",
    GLShader=(0, 2, 0),
    PreviewSortOrder=2,
    VertexShader="""#version 330

layout(location = 0) in vec3 vertex;
layout(location = 1) in vec4 vcolor1;
layout(location = 2) in float t;
layout(location = 3) in vec4 vcolor2;
layout(location = 4) in float alpha;

uniform mat4 _worldToClip;
out vec4 vertex_color;
  

void main() {
  
  vertex_color.r = pow(t,2) * vcolor1.r + (1-pow(t,2))* vcolor2.r ;
  vertex_color.g = pow(t,2) * vcolor1.g + (1-pow(t,2))* vcolor2.g;
  vertex_color.b = pow(t,2) * vcolor1.b + (1-pow(t,2))* vcolor2.b;
  vertex_color.a = (1-t/3) * alpha;
  
  gl_Position = _worldToClip * vec4(vertex, 1.0);
}""",
    glLineWidth=1,
    glPointSize=1)  # -> Color, Depth; disabled

# ----
particle_preview = ParticlePreviewSettings(Particles=solver.OutputParticles, PointSize=2)
