# Grasshopper definition 09_Vector Fields 2_v3.gh (Grasshopper 1.0.8)
# plug-ins: ghgl, Nuclei4

# ---- group: Define Design Space
construct_voxels = ConstructVoxels(
    VoxelSize=Slider(1, range=0..1),
    XVoxels=Slider(800, range=0..1000),
    YVoxels=Slider(800, range=0..1000),
    ZVoxels=Slider(1, range=0..1))

# ----
attractor_points = Point([Point(676.5771253, 646.4616545, 0), Point(188.8536009, 301.7356033, 0), Point(294.8249426, 568.5791022, 0), Point(603.8016256, 248.1115509, 0)])

# ---- group: Extract Voxels Depending On Point Proximity
point_attractor = PointAttractorForVoxels(
    Voxels=construct_voxels,
    AttractorPoints=flatten(attractor_points),
    MinimumRange=0,
    MaximumRange=Slider(500, range=0..1000),
    InvertVoxelSelection=False,
    Average=False,
    Maximum=False,
    Minimum=True)  # -> OutputVoxels, OutputVoxelPositions, OutputDistancesToVoxels, OutputVoxelIndices

# ---- group: Create Vector Field
pcharge = PointCharge(Point=attractor_points, Charge=Slider(-20, range=-100..100), Decay=Slider(1, range=0..1))
mergef = MergeFields(Fields=pcharge)

# ---- group: Preview Field
voxel_box = ExtractVoxelBoundingBox(Voxels=construct_voxels)
pop2d = Populate2D(Region=voxel_box, Count=100, Seed=1)
preview_field = FieldLine(Field=mergef, Point=pop2d, Steps=1000, Accuracy=0.1, Method=3)

# ----
distance_values = Number(point_attractor.OutputDistancesToVoxels)
voxel_position = Point(point_attractor.OutputVoxelPositions)
voxel_indices = Integer(point_attractor.OutputVoxelIndices)

bnd = Bounds(Numbers=distance_values)
dom = ConstructDomain(DomainStart=Slider(1, range=0..5), DomainEnd=Slider(10, range=0..10))
remap = RemapNumbers(Value=distance_values, Source=bnd, Target=dom)  # -> Mapped, Clipped
remapped_value = Number(remap.Mapped)

# ---- group: Extract Vectors From Vector Field
evf = EvaluateField(Field=mergef, Point=voxel_position)  # -> Tensor, Strength

# ---- group: Preview Vectors
move = Move(Geometry=voxel_position, Motion=evf.Tensor)  # -> Geometry, Transform
ln = Line(StartPoint=voxel_position, EndPoint=move.Geometry)

# ----
sort = SortList(Keys=flatten(voxel_indices), ValuesA=flatten(evf.Tensor))  # -> Keys, ValuesA
sort_2 = SortList(Keys=flatten(voxel_indices), ValuesA=flatten(remapped_value))  # -> Keys, ValuesA
uniform_frequency = Slider(3, range=0..10)

construct_slime_particles = ConstructSlimeParticles(
    VoxelField=construct_voxels,
    ParticleCount=Slider(65000, range=0..100000),
    Speed=Slider(1.3, range=0..10),
    SensorDistance=Slider(6, range=0..10),
    SensorAngle=Slider(45, range=0..180),
    RotationAngle=Slider(45, range=0..180),
    Deposit=Slider(0.4, range=0..5),
    Exploration=Slider(0, range=0..1),
    Colour=RGBA(220, 255, 0, 125),
    ProbabilisticSteering=False)  # -> flatten(OutputParticleGroup)

sorted_frequency_values = Number(sort_2.ValuesA)

iterations = Nuclei3SolverIterations(Iterations=Slider(100, range=0..300))

voxel_settings_slime = VoxelSettingsSlime(
    DiffuseRate=Slider(0.1, range=0..1),
    DecayRate=Slider(0.03, range=0..1),
    Falloff=Slider(0, range=0..1),
    DiffuseRange=Slider(1, range=0..10))

sorted_vectors = Vector(sort.ValuesA)

voxel_wrap_settings = VoxelWrapSettings(Wrap=Toggle(True))

voxel_vectors = DefineVoxelVectors(Voxels=point_attractor.OutputVoxels, VoxelVector=flatten(sorted_vectors), Frequency=flatten(sorted_frequency_values))
voxel_selection_union = VoxelSelectionUnion(V1=construct_voxels, V2=voxel_vectors, Average=True, Maximum=False, Minimum=False)
trigger = Trigger(Interval=10, TimerInterval=10, Target=solver)  # disabled
solver = Nuclei3Solver(
    Reset=Toggle(True),
    Voxels=voxel_selection_union,
    Particles=flatten(construct_slime_particles),
    SolverSettings=flatten([voxel_wrap_settings, voxel_settings_slime, iterations]))  # -> OutputParticles, OutputVoxels, GPUStatus

# ---- group: Extract Particle Trails
trail_points = ExtractParticleTrails(Particles=solver.OutputParticles)
lng = ListLength(List=trail_points)  # disabled
number_slider = Slider(0.35, range=0..1)  # disabled
range = Range(Domain=Domain(0, 1), Steps=expr("x-1", lng))  # disabled
swatch = ColourSwatch(SwatchColor=RGB(105, 237, 255))  # disabled
swatch_2 = ColourSwatch(SwatchColor=RGB(255, 0, 255))  # disabled
gl_shader = GLShader(
    Vertex=trail_points,
    Vcolor1=swatch,
    Vcolor2=swatch_2,
    T=range,
    Alpha=number_slider,
    DepthTestingEnabled=False,
    DepthWritingEnabled=False,
    DrawMode=3,
    FragmentShader="""#version 330

in vec4 vertex_color;
out vec4 fragment_color;
uniform sampler2D _depthBuffer;
uniform vec2 _viewportSize;
float ndcDepth;

void main() {
    
  //vec2 uv = gl_FragCoord.xy / _viewportSize;
  
  //vec4 buffer = texture(_depthBuffer, uv);
  
  //ndcDepth  = ((2.0 * gl_FragCoord.z - 1) - gl_DepthRange.near - gl_DepthRange.far/2) / (gl_DepthRange.far - gl_DepthRange.near);

  fragment_color = vertex_color;

}""",
    GLShader=(0, 2, 0),
    PreviewSortOrder=2,
    VertexShader="""#version 330

layout(location = 0) in vec3 vertex;
layout(location = 1) in vec4 vcolor1;
layout(location = 2) in float t;
layout(location = 3) in vec4 vcolor2;
layout(location = 4) in float alpha;

uniform mat4 _worldToClip;
out vec4 vertex_color;
  

void main() {
  
  vertex_color.r = pow(t,2) * vcolor1.r + (1-pow(t,2))* vcolor2.r ;
  vertex_color.g = pow(t,2) * vcolor1.g + (1-pow(t,2))* vcolor2.g;
  vertex_color.b = pow(t,2) * vcolor1.b + (1-pow(t,2))* vcolor2.b;
  vertex_color.a = (1-t/3) * alpha;
  
  gl_Position = _worldToClip * vec4(vertex, 1.0);
}""",
    glLineWidth=1,
    glPointSize=1)  # -> Color, Depth; disabled

# ----
particle_preview = ParticlePreviewSettings(Particles=solver.OutputParticles, PointSize=2)
