# Grasshopper definition 10_Multiple Populations_v3.gh (Grasshopper 1.0.8)
# plug-ins: Nuclei4

number_slider = Slider(500, range=0..1000)
construct_voxels = ConstructVoxels(VoxelSize=1, XVoxels=number_slider, YVoxels=number_slider, ZVoxels=1)

construct_slime_particles = ConstructSlimeParticles(
    VoxelField=construct_voxels,
    ParticleCount=Slider(25000, range=0..100000),
    Speed=Slider(1, range=0..10),
    SensorDistance=Slider(2, range=0..10),
    SensorAngle=Slider(120, range=0..180),
    RotationAngle=Slider(120, range=0..180),
    Deposit=Slider(3, range=0..5),
    Exploration=Slider(0, range=0..1),
    Colour=ColourSwatch(SwatchColor=RGB(71, 174, 230)),
    ProbabilisticSteering=True)  # -> flatten(OutputParticleGroup)

construct_slime_particles_2 = ConstructSlimeParticles(
    VoxelField=construct_voxels,
    ParticleCount=Slider(50000, range=0..100000),
    Speed=Slider(3, range=0..10),
    SensorDistance=Slider(7, range=0..10),
    SensorAngle=Slider(30, range=0..180),
    RotationAngle=Slider(30, range=0..180),
    Deposit=Slider(3, range=0..5),
    Exploration=Slider(0, range=0..1),
    Colour=ColourSwatch(SwatchColor=RGB(222, 71, 230)),
    ProbabilisticSteering=False)  # -> flatten(OutputParticleGroup)

voxel_settings_slime = VoxelSettingsSlime(
    DiffuseRate=Slider(0.8, range=0..1),
    DecayRate=Slider(0.15, range=0..1),
    Falloff=Slider(0, range=0..1),
    DiffuseRange=Slider(8, range=0..10))

voxel_wrap_settings = VoxelWrapSettings(Wrap=Toggle(False))

trigger = Trigger(Interval=20, TimerInterval=20, Target=nuclei3_solver)  # disabled
nuclei3_solver = Nuclei3Solver(
    Reset=Toggle(True),
    Voxels=construct_voxels,
    Particles=flatten([construct_slime_particles_2, construct_slime_particles]),
    SolverSettings=flatten([voxel_wrap_settings, voxel_settings_slime]))  # -> OutputParticles, OutputVoxels, GPUStatus
particle_preview = ParticlePreview(Particles=nuclei3_solver.OutputParticles, PointSize=2)
