# Grasshopper definition 13_Ants Intro_v3.gh (Grasshopper 1.0.8)
# plug-ins: Nuclei4

# ---- group: Define Design Space
construct_voxels = ConstructVoxels(VoxelSize=1, XVoxels=Slider(500, range=0..1000), YVoxels=Slider(500, range=0..1000), ZVoxels=Slider(1, range=0..1))

# ----
voxel_box = ExtractVoxelBoundingBox(Voxels=construct_voxels)
area = Area(Geometry=voxel_box)  # -> Area, Centroid
attractor_point = Point(area.Centroid)
point_attractor = PointAttractorForVoxels(
    Voxels=construct_voxels,
    AttractorPoints=flatten(attractor_point),
    MinimumRange=0,
    MaximumRange=Slider(30, range=0..1000),
    InvertVoxelSelection=False,
    Average=False,
    Maximum=False,
    Minimum=True)  # -> OutputVoxels, OutputVoxelPositions, OutputDistancesToVoxels, OutputVoxelIndices

food_points = Point([Point(125.1260015, 393.4964232, 0), Point(400.4062236, 438.1562465, 0), Point(434.0841231, 103.5736361, 0), Point(103.8942823, 80.14553211, 0), Point(45.32402226, 180.4471024, 0), Point(355.0142721, 45.73550435, 0)])
point_attractor_2 = PointAttractorForVoxels(
    Voxels=construct_voxels,
    AttractorPoints=flatten(food_points),
    MinimumRange=0,
    MaximumRange=Slider(5, range=0..1000),
    InvertVoxelSelection=False,
    Average=False,
    Maximum=False,
    Minimum=True)  # -> OutputVoxels, OutputVoxelPositions, OutputDistancesToVoxels, OutputVoxelIndices

lng = ListLength(List=point_attractor.OutputVoxelPositions)
multiplication = Multiplication(A=lng, B=Slider(0.5, range=0..1))
reduce = RandomReduce(List=point_attractor.OutputVoxelPositions, Reduction=multiplication, Seed=1)

particle_start_positions = Point(reduce)

voxel_settings_ant = VoxelSettingsAnt(
    FoodPheromonesDiffuseRate=Slider(0.05, range=0..1),
    FoodDecayRate=Slider(0.001, range=0..1),
    BasePheromonesDiffuseRate=Slider(0.05, range=0..1),
    BaseDecayRate=Slider(0.02, range=0..1),
    DiffuseRange=Slider(4, range=0..10))

ant_particles = ConstructAntParticles(
    VoxelField=construct_voxels,
    InitialParticlePositions=particle_start_positions,
    ParticleCount=0,
    Speed=Slider(3, range=0..10),
    SensorDistance=Slider(6, range=0..10),
    SensorAngle=Slider(45, range=0..180),
    RotationAngle=Slider(45, range=0..180),
    Deposit=Slider(4, range=0..5),
    Wander=Slider(0.1, range=0..1),
    Colour=RGBA(66, 236, 122, 125))  # -> flatten(OutputParticleGroup)

list = ValueList({"Minimum Density": 0, "Maximum Density": 1, "Speed": 2, "Sensor Distance": 3, "Sensor Angle": 4, "Rotation Angle": 5, "Slime Food": 6, "Ant Food": 13}, selected="Ant Food")
voxel_values = DefineVoxelValues(Voxels=point_attractor_2.OutputVoxels, Type=list, MultiplierValue=Slider(2, range=0..10), ValueOrderMode=0)

voxel_selection_union = VoxelSelectionUnion(V1=construct_voxels, V2=voxel_values, Average=True, Maximum=False, Minimum=False)
solver = Nuclei3Solver(
    Reset=Toggle(True),
    Voxels=voxel_selection_union,
    Particles=flatten(ant_particles),
    SolverSettings=flatten(voxel_settings_ant))  # -> OutputParticles, OutputVoxels, GPUStatus
trigger = Trigger(Interval=10, TimerInterval=10, Target=solver)  # disabled

# ---- group: Preview
list_2 = ValueList({"Minimum Density": 0, "Maximum Density": 1, "Speed": 2, "Sensor Distance": 3, "Sensor Angle": 4, "Rotation Angle": 5, "Slime Food": 6, "Slime Chemoattractants": 7, "Ant Food Pheromones": 8, "Ant Base Pheromones": 9, "Ant Pheromones": 10, "Ants and Slime": 11, "Ant Food": 13}, selected="Ants and Slime")
preview_voxel_density = PreviewVoxelDensity(Voxels=solver.OutputVoxels, Type=list_2, MinimumTreshold=0, MaximumTreshold=1, Colour=RGBA(0, 0, 0, 0))

# ----
particle_preview = ParticlePreviewSettings(Particles=solver.OutputParticles, PointSize=2)
