# Grasshopper definition 15_3D Intro_v3.gh (Grasshopper 1.0.8)
# plug-ins: DendroGH, Nuclei4

# ---- group: Define Design Space
number_slider = Slider(100, range=0..1000)
construct_voxels = ConstructVoxels(VoxelSize=1, XVoxels=number_slider, YVoxels=number_slider, ZVoxels=number_slider)

# ----
construct_slime_particles = ConstructSlimeParticles(
    VoxelField=construct_voxels,
    ParticleCount=Slider(100000, range=0..150000),
    Speed=Slider(3, range=0..10),
    SensorDistance=Slider(9, range=0..10),
    SensorAngle=Slider(45, range=0..180),
    RotationAngle=Slider(45, range=0..180),
    Deposit=Slider(1, range=0..5),
    Exploration=Slider(0, range=0..1),
    Colour=RGBA(220, 255, 0, 125),
    ProbabilisticSteering=False)  # -> flatten(OutputParticleGroup)

voxel_settings_slime = VoxelSettingsSlime(
    DiffuseRate=Slider(0.15, range=0..1),
    DecayRate=Slider(0.03, range=0..1),
    Falloff=Slider(0, range=0..1),
    DiffuseRange=Slider(1, range=0..10))

voxel_wrap_settings = VoxelWrapSettings(Wrap=Toggle(True))

trigger = Trigger(Interval=10, TimerInterval=10, Target=solver)  # disabled
solver = Nuclei3Solver(
    Reset=Toggle(True),
    Voxels=construct_voxels,
    Particles=flatten(construct_slime_particles),
    SolverSettings=flatten([voxel_settings_slime, voxel_wrap_settings]))  # -> OutputParticles, OutputVoxels, GPUStatus
list = ValueList({"Minimum Density": 0, "Maximum Density": 1, "Speed": 2, "Sensor Distance": 3, "Sensor Angle": 4, "Rotation Angle": 5, "Slime Food": 6, "Slime Chemoattractants": 7, "Ant Food Pheromones": 8, "Ant Base Pheromones": 9, "Ant Pheromones": 10, "Ants and Slime": 11, "Ant Food": 13}, selected="Slime Chemoattractants")

list_2 = ValueList({"Minimum Density": 0, "Maximum Density": 1, "Speed": 2, "Sensor Distance": 3, "Sensor Angle": 4, "Rotation Angle": 5, "Slime Food": 6, "Slime Chemoattractants": 7, "Ant Food Pheromones": 8, "Ant Base Pheromones": 9, "Ant Pheromones": 10, "Ants and Slime": 11, "Ant Food": 13}, selected="Slime Chemoattractants")
particle_preview = ParticlePreviewSettings(Particles=solver.OutputParticles, PointSize=2)
preview_voxel_density = PreviewVoxelDensity(Voxels=solver.OutputVoxels, Type=list_2, MinimumTreshold=0, MaximumTreshold=100, Colour=RGBA(0, 0, 0, 0))

to_dendro = Nuclei3ToDendroVolume(
    Voxels=solver.OutputVoxels,
    IsoValue=Slider(0.5, range=0..1),
    Method=0,
    MaximumElements=5000000,
    Update=Toggle(False),
    SmoothingIterations=1)
vsmooth = SmoothVolume(Volume=to_dendro, Width=1, Type=3, Iterations=Slider(5, range=0..10))
vsettings = CreateSettings(VoxelSize=Slider(0.5, range=0..1), Bandwidth=1, Isovalue=0, Adaptivity=0.1)
mvolume = VolumeToMesh(Volume=vsmooth, VolumeSettings=vsettings)
