# Grasshopper definition 03-minimizing-transport-networks-1.gh (Grasshopper 1.0.9)
# plug-ins: Nuclei4

# ---- group: Define Environment
number_slider = Slider(250, range=0..1000)
construct_voxels = ConstructVoxels(VoxelSize=1, XVoxels=number_slider, YVoxels=number_slider, ZVoxels=Slider(1, range=1..30))

# ---- group: Extract Centre of Environment
extract_voxel_bounding_box = ExtractVoxelBoundingBox(Voxels=construct_voxels)
environment = Brep(extract_voxel_bounding_box)
expression = Expression(x=number_slider, Expression="x/2")
area = Area(Geometry=environment)  # -> Area, Centroid
xy = XYPlane(Origin=Point(0, 0, 0))
project = Project(Geometry=area.Centroid, Plane=xy)  # -> Geometry, Transform

# ----
environment_centre = Point(project.Geometry)

# ---- group: Create Food Points
polygon = Polygon(Plane=environment_centre, Radius=expr("0.8*x", expression), Segments=Slider(6, range=0..10), FilletRadius=0)  # -> Polygon, Length
explode = Explode(Curve=polygon.Polygon, Recursive=True)  # -> Segments, Vertices
cullpt = CullDuplicates(Points=explode.Vertices, Tolerance=0.1, CullMode=3)  # -> Points, Indices, Valence

# ---- group: Create Disc
circle = CircleCNR(Center=environment_centre, Normal=Vector(0, 0, 1), Radius=expression)
Z = UnitZ(Factor=1)
extr = Extrude(Base=circle, Direction=Z)
cap = CapHoles(Brep=extr)
mesh = MeshBrep(
    Brep=cap,
    Settings={GridMaxCount=0, GridMinCount=16, JaggedSeams=False, MaxEdgeLength=0, MinEdgeLength=0.0001, MinTolerance=0, Refine=True, RefineAngle=0, RelativeTolerance=0.65, SimplePlanes=True, Tolerance=0})

# ----
mesh_disc_simulation_will_only_run_insid = Mesh(mesh)  # "Mesh Disc (Simulation Will Only Run Inside It)"

# ---- group: Point Attractor Selects Voxels Around Attractor Points
point_attractor_for_voxels = PointAttractorForVoxels(
    Voxels=construct_voxels,
    AttractorPoints=flatten(cullpt.Points),
    MinimumRange=0,
    MaximumRange=Slider(5, range=0..10),
    InvertVoxelSelection=False,
    Average=False,
    Maximum=False,
    Minimum=True)  # -> OutputVoxels, OutputVoxelPositions, OutputDistancesToVoxels, OutputVoxelIndices

# ----
list = ValueList({"Minimum Density": 0, "Maximum Density": 1, "Speed": 2, "Sensor Distance": 3, "Sensor Angle": 4, "Rotation Angle": 5, "Slime Food": 6, "Ant Food": 13}, selected="Slime Food")
define_voxel_values = DefineVoxelValues(Voxels=point_attractor_for_voxels.OutputVoxels, Type=list, MultiplierValue=Slider(2, range=0..10))

number_slider_2 = Slider(20000, range=0..30000)
construct_slime_particles = ConstructSlimeParticles(
    VoxelField=construct_voxels,
    ParticleCount=number_slider_2,
    Speed=Slider(3, range=0..10),
    SensorDistance=Slider(9, range=0..10),
    SensorAngle=Slider(45, range=0..120),
    RotationAngle=Slider(45, range=0..120),
    Deposit=Slider(1.1, range=0..10),
    Exploration=0,
    Colour=RGBA(220, 255, 0, 125),
    ProbabilisticSteering=False)  # -> flatten(OutputParticleGroup)

particle_population_settings = ParticlePopulationSettings(
    MinimumPopulation=expr("x/20", number_slider_2),
    MaximumPopulation=Slider(20000, range=0..100000),
    RandomDivision=0,
    RandomDeath=Slider(0.025, range=0..0.025),
    Frequency=Slider(1, range=0..1))

# ---- group: Environment Settings
voxel_settings_slime = VoxelSettingsSlime(
    DiffuseRate=Slider(0.15, range=0..1),
    DecayRate=Slider(0.01, range=0..0.05),
    Falloff=Slider(1, range=0..1),
    DiffuseRange=Slider(3, range=0..10),
    Input2StoresLegacyGradual=False,
    VoxelSettingsSlimeSchema=2)

# ----
nuclei4_solver_iterations = Nuclei4SolverIterations(Iterations=Slider(500, range=0..1000))

particle_trail_settings = ParticleTrailSettings(TrailSize=Slider(15, range=0..100))

# ---- group: Select Voxels Inside Mesh
voxel_inclusion_in_mesh = VoxelInclusionInMesh(Voxels=construct_voxels, InclusionMeshes=flatten(mesh_disc_simulation_will_only_run_insid), InvertVoxelSelection=False)  # -> OutputVoxels, OutputVoxelPositions

# ---- group: Combine Voxels
voxel_selection_union = VoxelSelectionUnion(V1=voxel_inclusion_in_mesh.OutputVoxels, V2=define_voxel_values, Average=True, Maximum=False, Minimum=False)

# ----
trigger = Trigger(Interval=1, TimerInterval=5, Target=nuclei3_solver)  # disabled
nuclei3_solver = Nuclei3Solver(
    Reset=Toggle(True),
    Voxels=voxel_selection_union,
    Particles=flatten(construct_slime_particles),
    SolverSettings=flatten([voxel_settings_slime, particle_population_settings, nuclei4_solver_iterations, particle_trail_settings]))  # -> OutputParticles, OutputVoxels, GPUStatus
list_2 = ValueList({"Minimum Density": 0, "Maximum Density": 1, "Speed": 2, "Sensor Distance": 3, "Sensor Angle": 4, "Rotation Angle": 5, "Slime Food": 6, "Ant Food": 13, "Slime Chemoattractants": 7, "Ant Food Pheromones": 8, "Ant Base Pheromones": 9, "Ant Pheromones": 10, "Ants and Slime": 11}, selected="Slime Chemoattractants")
particle_preview = ParticlePreview(Particles=nuclei3_solver.OutputParticles, PointSize=2)
particle_trail_preview = ParticleTrailPreview(Particles=nuclei3_solver.OutputParticles, Alpha=0.35, DepthFocus=0.55)
voxel_preview = VoxelPreview(
    Voxels=nuclei3_solver.OutputVoxels,
    Type=list_2,
    MinimumTreshold=0,
    MaximumTreshold=1,
    Colour=RGBA(0, 0, 0, 0),
    HighResolutionPreview=False)
