# Grasshopper definition 04-minimizing-transport-networks-2.gh (Grasshopper 1.0.9)
# plug-ins: Pufferfish, Nuclei4

# ---- group: Define Environment
number_slider = Slider(500, range=0..1000)
construct_voxels = ConstructVoxels(VoxelSize=1, XVoxels=number_slider, YVoxels=number_slider, ZVoxels=Slider(1, range=1..30))

# ---- group: Extract Centre of Environment
extract_voxel_bounding_box = ExtractVoxelBoundingBox(Voxels=construct_voxels)
environment = Brep(extract_voxel_bounding_box)
expression = Expression(x=number_slider, Expression="x/2")
area = Area(Geometry=environment)  # -> Area, Centroid
xy = XYPlane(Origin=Point(0, 0, 0))
project = Project(Geometry=area.Centroid, Plane=xy)  # -> Geometry, Transform

# ----
environment_centre = Point(project.Geometry)

# ---- group: Create Disc
circle = CircleCNR(Center=environment_centre, Normal=Vector(0, 0, 1), Radius=expr("x*0.95", expression))
Z = UnitZ(Factor=1)
extr = Extrude(Base=circle, Direction=Z)
cap = CapHoles(Brep=extr)
mesh = MeshBrep(
    Brep=cap,
    Settings={GridMaxCount=0, GridMinCount=16, JaggedSeams=False, MaxEdgeLength=0, MinEdgeLength=0.0001, MinTolerance=0, Refine=True, RefineAngle=0, RelativeTolerance=0.65, SimplePlanes=True, Tolerance=0})

# ---- group: Create Food Points
brec = BoundingRectangle(Geometry=circle, Plane=PlaneXY(0, 0, 0), Axis=0, Slide=0, Union=True)  # -> Bounding, DimensionX, DimensionY
pop2d = Populate2D(Region=brec.Bounding, Count=Slider(20, range=0..100), Seed=14654564)
incurve = PointInCurve(Point=pop2d, Curve=circle)  # -> Relationship, Point
cull = CullPattern(List=pop2d, CullPattern=incurve.Relationship)

# ----
mesh_disc_simulation_will_only_run_insid = Mesh(mesh)  # "Mesh Disc (Simulation Will Only Run Inside It)"

# ---- group: Point Attractor Selects Voxels Around Attractor Points
point_attractor_for_voxels = PointAttractorForVoxels(
    Voxels=construct_voxels,
    AttractorPoints=flatten(cull),
    MinimumRange=0,
    MaximumRange=Slider(5, range=0..10),
    InvertVoxelSelection=False,
    Average=False,
    Maximum=False,
    Minimum=True)  # -> OutputVoxels, OutputVoxelPositions, OutputDistancesToVoxels, OutputVoxelIndices

# ----
particle_population_settings = ParticlePopulationSettings(
    MinimumPopulation=Slider(3000, range=0..10000),
    MaximumPopulation=Slider(20000, range=0..20000),
    RandomDivision=0,
    RandomDeath=Slider(0.001, range=0..0.01),
    Frequency=Slider(1, range=0..1))

list = ValueList({"Minimum Density": 0, "Maximum Density": 1, "Speed": 2, "Sensor Distance": 3, "Sensor Angle": 4, "Rotation Angle": 5, "Slime Food": 6, "Ant Food": 13}, selected="Slime Food")
define_voxel_values = DefineVoxelValues(Voxels=point_attractor_for_voxels.OutputVoxels, Type=list, MultiplierValue=Slider(0.5, range=0..10))

construct_slime_particles = ConstructSlimeParticles(
    VoxelField=construct_voxels,
    ParticleCount=Slider(20000, range=0..20000),
    Speed=Slider(3, range=0..10),
    SensorDistance=Slider(9, range=0..10),
    SensorAngle=Slider(45, range=0..120),
    RotationAngle=Slider(45, range=0..120),
    Deposit=Slider(1.1, range=0..10),
    Wander=Slider(0.5, range=0..1),
    Colour=RGBA(220, 255, 0, 125))  # -> flatten(OutputParticleGroup)

# ---- group: Environment Settings
voxel_settings_slime = VoxelSettingsSlime(
    DiffuseRate=Slider(0.15, range=0..1),
    DecayRate=Slider(0.01, range=0..0.05),
    Falloff=Slider(0.8, range=0..1),
    DiffuseRange=Slider(3, range=0..10),
    Input2StoresLegacyGradual=False,
    VoxelSettingsSlimeSchema=2)

# ----
nuclei4_solver_iterations = Nuclei4SolverIterations(Iterations=Slider(1100, range=0..10000))

particle_trail_settings = ParticleTrailSettings(TrailSize=Slider(2, range=0..10))

# ---- group: Select Voxels Inside Mesh
voxel_inclusion_in_mesh = VoxelInclusionInMesh(Voxels=construct_voxels, InclusionMeshes=flatten(mesh_disc_simulation_will_only_run_insid), InvertVoxelSelection=False)  # -> OutputVoxels, OutputVoxelPositions

# ---- group: Combine Voxels
voxel_selection_union = VoxelSelectionUnion(V1=voxel_inclusion_in_mesh.OutputVoxels, V2=define_voxel_values, Average=True, Maximum=False, Minimum=False)

# ----
trigger = Trigger(Interval=1, TimerInterval=5, Target=nuclei3_solver)  # disabled
nuclei3_solver = Nuclei3Solver(
    Reset=Toggle(False),
    Voxels=voxel_selection_union,
    Particles=flatten(construct_slime_particles),
    SolverSettings=flatten([Slider(1100, range=0..1100), particle_population_settings, voxel_settings_slime, nuclei4_solver_iterations, particle_trail_settings]))  # -> OutputParticles, OutputVoxels, GPUStatus
list_2 = ValueList({"Minimum Density": 0, "Maximum Density": 1, "Speed": 2, "Sensor Distance": 3, "Sensor Angle": 4, "Rotation Angle": 5, "Slime Food": 6, "Ant Food": 13, "Slime Chemoattractants": 7, "Ant Food Pheromones": 8, "Ant Base Pheromones": 9, "Ant Pheromones": 10, "Ants and Slime": 11}, selected="Slime Food")
particle_trail_preview = ParticleTrailPreview(Particles=nuclei3_solver.OutputParticles, Alpha=0.35, DepthFocus=0.55)
particle_preview = ParticlePreview(Particles=nuclei3_solver.OutputParticles, PointSize=Slider(1, range=0..1))
voxel_preview = VoxelPreview(
    Voxels=voxel_selection_union,
    Type=list_2,
    MinimumTreshold=0,
    MaximumTreshold=1,
    Colour=RGBA(0, 0, 0, 0),
    HighResolutionPreview=True)
