# Grasshopper definition 06-attractor-curves-1.gh (Grasshopper 1.0.9)
# plug-ins: Nuclei4

# ---- group: Define Design Space
number_slider = Slider(1000, range=0..1000)
construct_voxels = ConstructVoxels(VoxelSize=Slider(1, range=0..1), XVoxels=number_slider, YVoxels=number_slider, ZVoxels=Slider(1, range=0..1))

# ---- group: Create Concentric Circles
voxel_box = ExtractVoxelBoundingBox(Voxels=construct_voxels)
expression = Expression(x=number_slider, Expression="x/2")
volume = Volume(Geometry=voxel_box)  # -> Volume, Centroid
dom = ConstructDomain(DomainStart=Slider(0.1, range=0..0.1), DomainEnd=expression)
number_slider_2 = Slider(7, range=0..30)
range = Range(Domain=dom, Steps=number_slider_2)
circle = CircleCNR(Center=volume.Centroid, Normal=Vector(0, 0, 1), Radius=range)  # -> simplify(graft(Circle))

# ---- group: Extract Voxels Depending On Closest Curve
curve_attractor = CurveAttractorForVoxels(
    Voxels=construct_voxels,
    AttractorCurves=flatten(circle),
    MinimumRange=0,
    MaximumRange=Slider(5, range=0..100),
    InvertVoxelSelection=False,
    Average=False,
    Maximum=False,
    Minimum=True)  # -> OutputVoxels, OutputVoxelPositions, OutputDistancesToVoxels, OutputVoxelIndices

# ----
distance_values = Number(curve_attractor.OutputDistancesToVoxels)
voxel_indices = Integer(curve_attractor.OutputVoxelIndices)

# ---- group: Remap Values
bnd = Bounds(Numbers=distance_values)
dom_2 = ConstructDomain(DomainStart=Slider(1, range=0..1), DomainEnd=Slider(0.05, range=0..1))
range_2 = Range(Domain=dom_2, Steps=number_slider_2)
dom_3 = ConstructDomain(DomainStart=range_2, DomainEnd=Slider(0, range=0..1))  # -> graft(Domain)
remap = RemapNumbers(Value=distance_values, Source=bnd, Target=dom_3)  # -> Mapped, Clipped

# ----
remapped_voxel_value = Number(flatten(remap.Mapped))
voxel_indices_2 = Integer(flatten(voxel_indices))
sort = SortList(Keys=voxel_indices_2, ValuesA=remapped_voxel_value)  # -> Keys, ValuesA
sorted_remapped_voxel_value = Number(flatten(sort.ValuesA))

construct_slime_particles = ConstructSlimeParticles(
    VoxelField=construct_voxels,
    ParticleCount=Slider(30000, range=0..100000),
    Speed=Slider(1.3, range=0..10),
    SensorDistance=Slider(6, range=0..10),
    SensorAngle=Slider(45, range=0..180),
    RotationAngle=Slider(60, range=0..180),
    Deposit=Slider(2, range=0..5),
    Wander=Slider(0, range=0..1),
    Colour=RGBA(220, 255, 0, 125))  # -> flatten(OutputParticleGroup)

trail_settings = ParticleTrailSettings(TrailSize=Slider(15, range=0..100))

voxel_settings_slime = VoxelSettingsSlime(
    DiffuseRate=Slider(0.1, range=0..1),
    DecayRate=Slider(0.03, range=0..1),
    Falloff=Slider(0.5, range=0..1),
    DiffuseRange=Slider(1, range=0..10),
    Input2StoresLegacyGradual=False,
    VoxelSettingsSlimeSchema=2)

list = ValueList({"Minimum Density": 0, "Maximum Density": 1, "Speed": 2, "Sensor Distance": 3, "Sensor Angle": 4, "Rotation Angle": 5, "Slime Food": 6, "Ant Food": 13}, selected="Minimum Density")
voxel_values = DefineVoxelValues(Voxels=curve_attractor.OutputVoxels, Type=list, MultiplierValue=sorted_remapped_voxel_value)

voxel_values_2 = DefineVoxelValues(Voxels=curve_attractor.OutputVoxels, Type=list, MultiplierValue=sorted_remapped_voxel_value)
voxel_wrap_settings = VoxelWrapSettings(Wrap=Toggle(True))
preview_voxel_density = PreviewVoxelDensity(
    Voxels=voxel_values,
    Type=list,
    MinimumTreshold=0,
    MaximumTreshold=1,
    Colour=RGBA(0, 0, 0, 0),
    HighResolutionPreview=False)
voxel_selection_union = VoxelSelectionUnion(V1=construct_voxels, V2=voxel_values, Average=True, Maximum=False, Minimum=False)
trigger = Trigger(Interval=10, TimerInterval=10, Target=solver)  # disabled
solver = Nuclei3Solver(
    Reset=Toggle(True),
    Voxels=voxel_selection_union,
    Particles=flatten(construct_slime_particles),
    SolverSettings=flatten([voxel_settings_slime, trail_settings, voxel_wrap_settings]))  # -> OutputParticles, OutputVoxels, GPUStatus
particle_trail_preview = ParticleTrailPreview(Particles=solver.OutputParticles, Alpha=0.35, DepthFocus=0.55)
