# Grasshopper definition 13-ants-intro-3d.gh (Grasshopper 1.0.9)
# plug-ins: Nuclei4

falloff = Slider(0, range=0..1)
voxel_settings_ant = VoxelSettingsAnt(
    FoodPheromonesDiffuseRate=Slider(0.2, range=0..1),
    FoodDecayRate=Slider(0.0001, range=0..1),
    BasePheromonesDiffuseRate=Slider(0.2, range=0..1),
    BaseDecayRate=Slider(0.0003, range=0..1),
    Falloff=falloff,
    DiffuseRange=Slider(2, range=0..10))

# ---- group: Define Design Space
number_slider = Slider(250, range=0..1000)
construct_voxels = ConstructVoxels(VoxelSize=1, XVoxels=number_slider, YVoxels=number_slider, ZVoxels=number_slider)

# ----
voxel_box = ExtractVoxelBoundingBox(Voxels=construct_voxels)
area = Area(Geometry=voxel_box)  # -> Area, Centroid
attractor_point = Point(area.Centroid)
point_attractor = PointAttractorForVoxels(
    Voxels=construct_voxels,
    AttractorPoints=flatten(attractor_point),
    MinimumRange=0,
    MaximumRange=Slider(10, range=0..1000),
    InvertVoxelSelection=False,
    Average=False,
    Maximum=False,
    Minimum=True)  # -> OutputVoxels, OutputVoxelPositions, OutputDistancesToVoxels, OutputVoxelIndices

food_points = Point([Point(217.0420616, 51.78681806, 54.82441574), Point(51.94714114, 40.07276606, 28.57130584), Point(62.56300077, 196.7482116, 174.8202889), Point(200.2031118, 219.0781232, 73.24614223), Point(177.5071361, 22.86775218, 211.5269432), Point(22.66201113, 90.2235512, 139.1336604)])
point_attractor_2 = PointAttractorForVoxels(
    Voxels=construct_voxels,
    AttractorPoints=flatten(food_points),
    MinimumRange=0,
    MaximumRange=Slider(5, range=0..1000),
    InvertVoxelSelection=False,
    Average=False,
    Maximum=False,
    Minimum=True)  # -> OutputVoxels, OutputVoxelPositions, OutputDistancesToVoxels, OutputVoxelIndices

lng = ListLength(List=point_attractor.OutputVoxelPositions)
multiplication = Multiplication(A=lng, B=Slider(0.66, range=0..1))
reduce = RandomReduce(List=point_attractor.OutputVoxelPositions, Reduction=multiplication, Seed=1)

particle_start_positions = Point(reduce)

list = ValueList({"Minimum Density": 0, "Maximum Density": 1, "Speed": 2, "Sensor Distance": 3, "Sensor Angle": 4, "Rotation Angle": 5, "Slime Food": 6, "Ant Food": 13}, selected="Ant Food")
voxel_values = DefineVoxelValues(Voxels=point_attractor_2.OutputVoxels, Type=list, MultiplierValue=Slider(3, range=0..5))

ant_particles = ConstructAntParticles(
    VoxelField=construct_voxels,
    InitialParticlePositions=particle_start_positions,
    Speed=Slider(3, range=0..10),
    SensorDistance=Slider(9, range=0..10),
    SensorAngle=Slider(45, range=0..180),
    RotationAngle=Slider(45, range=0..180),
    Deposit=Slider(20, range=0..20),
    Wander=Slider(0.15, range=0..1),
    Colour=RGBA(66, 236, 122, 125))  # -> flatten(OutputParticleGroup)

particle_trail_settings = ParticleTrailSettings(TrailSize=Slider(5, range=0..10))

voxel_selection_union = VoxelSelectionUnion(V1=construct_voxels, V2=voxel_values, Average=True, Maximum=False, Minimum=False)
trigger = Trigger(Interval=1, TimerInterval=5, Target=solver)  # disabled
solver = Nuclei3Solver(
    Reset=Toggle(True),
    Voxels=voxel_selection_union,
    Particles=flatten(ant_particles),
    SolverSettings=flatten([voxel_settings_ant, particle_trail_settings]))  # -> OutputParticles, OutputVoxels

# ---- group: Preview
list_2 = ValueList({"Minimum Density": 0, "Maximum Density": 1, "Speed": 2, "Sensor Distance": 3, "Sensor Angle": 4, "Rotation Angle": 5, "Slime Food": 6, "Slime Chemoattractants": 7, "Ant Food Pheromones": 8, "Ant Base Pheromones": 9, "Ant Pheromones": 10, "Ants and Slime": 11, "Ant Food": 13}, selected="Ants and Slime")
preview_voxel_density = PreviewVoxelDensity(
    Voxels=solver.OutputVoxels,
    Type=list_2,
    MinimumTreshold=0,
    MaximumTreshold=1,
    Colour=RGBA(0, 0, 0, 0),
    HighResolutionPreview=False)

# ----
particle_preview = ParticlePreview(Particles=solver.OutputParticles, PointSize=2)
particle_trail_preview = ParticleTrailPreview(Particles=solver.OutputParticles, Alpha=0.35, DepthFocus=0.55)
