# Grasshopper definition 13-ants-intro.gh (Grasshopper 1.0.9)
# plug-ins: Nuclei4

falloff = Slider(0, range=0..1)
voxel_settings_ant = VoxelSettingsAnt(
    FoodPheromonesDiffuseRate=Slider(0.1, range=0..1),
    FoodDecayRate=Slider(0.003, range=0..1),
    BasePheromonesDiffuseRate=Slider(0.1, range=0..1),
    BaseDecayRate=Slider(0.05, range=0..1),
    Falloff=falloff,
    DiffuseRange=Slider(4, range=0..10))

# ---- group: Define Design Space
construct_voxels = ConstructVoxels(VoxelSize=1, XVoxels=Slider(1000, range=0..1000), YVoxels=Slider(1000, range=0..1000), ZVoxels=Slider(1, range=0..1))

# ----
voxel_box = ExtractVoxelBoundingBox(Voxels=construct_voxels)
area = Area(Geometry=voxel_box)  # -> Area, Centroid
attractor_point = Point(area.Centroid)
point_attractor = PointAttractorForVoxels(
    Voxels=construct_voxels,
    AttractorPoints=flatten(attractor_point),
    MinimumRange=0,
    MaximumRange=Slider(30, range=0..1000),
    InvertVoxelSelection=False,
    Average=False,
    Maximum=False,
    Minimum=True)  # -> OutputVoxels, OutputVoxelPositions, OutputDistancesToVoxels, OutputVoxelIndices

food_points = Point([Point(250.2520031, 786.9928464, 0), Point(800.8124472, 876.312493, 0), Point(868.1682463, 207.1472722, 0), Point(207.7885646, 160.2910642, 0), Point(90.64804452, 360.8942048, 0), Point(710.0285442, 91.4710087, 0)])
point_attractor_2 = PointAttractorForVoxels(
    Voxels=construct_voxels,
    AttractorPoints=flatten(food_points),
    MinimumRange=0,
    MaximumRange=Slider(15, range=0..1000),
    InvertVoxelSelection=False,
    Average=False,
    Maximum=False,
    Minimum=True)  # -> OutputVoxels, OutputVoxelPositions, OutputDistancesToVoxels, OutputVoxelIndices

lng = ListLength(List=point_attractor.OutputVoxelPositions)
multiplication = Multiplication(A=lng, B=Slider(0.66, range=0..1))
reduce = RandomReduce(List=point_attractor.OutputVoxelPositions, Reduction=multiplication, Seed=1)

particle_start_positions = Point(reduce)

ant_particles = ConstructAntParticles(
    VoxelField=construct_voxels,
    InitialParticlePositions=particle_start_positions,
    Speed=Slider(3, range=0..10),
    SensorDistance=Slider(9, range=0..10),
    SensorAngle=Slider(45, range=0..180),
    RotationAngle=Slider(45, range=0..180),
    Deposit=Slider(10, range=0..10),
    Wander=Slider(0.2, range=0..1),
    Colour=RGBA(66, 236, 122, 125))  # -> flatten(OutputParticleGroup)

list = ValueList({"Minimum Density": 0, "Maximum Density": 1, "Speed": 2, "Sensor Distance": 3, "Sensor Angle": 4, "Rotation Angle": 5, "Slime Food": 6, "Ant Food": 13}, selected="Ant Food")
voxel_values = DefineVoxelValues(Voxels=point_attractor_2.OutputVoxels, Type=list, MultiplierValue=Slider(5, range=0..5))

voxel_selection_union = VoxelSelectionUnion(V1=construct_voxels, V2=voxel_values, Average=True, Maximum=False, Minimum=False)
solver = Nuclei3Solver(
    Reset=Toggle(True),
    Voxels=voxel_selection_union,
    Particles=flatten(ant_particles),
    SolverSettings=flatten(voxel_settings_ant))  # -> OutputParticles, OutputVoxels
trigger = Trigger(Interval=1, TimerInterval=5, Target=solver)  # disabled

# ---- group: Preview
list_2 = ValueList({"Minimum Density": 0, "Maximum Density": 1, "Speed": 2, "Sensor Distance": 3, "Sensor Angle": 4, "Rotation Angle": 5, "Slime Food": 6, "Slime Chemoattractants": 7, "Ant Food Pheromones": 8, "Ant Base Pheromones": 9, "Ant Pheromones": 10, "Ants and Slime": 11, "Ant Food": 13}, selected="Ants and Slime")
preview_voxel_density = PreviewVoxelDensity(
    Voxels=solver.OutputVoxels,
    Type=list_2,
    MinimumTreshold=0,
    MaximumTreshold=1,
    Colour=RGBA(0, 0, 0, 0),
    HighResolutionPreview=False)
